# Grasshopper definition 00_comobrick_fabrication_03.ghx (Grasshopper 1.0.7)
# plug-ins: Pufferfish

# ----
# Brick
# Predefine a brick element and its dimensions
# Visualise the defined element
show = BooleanToggle(True)
elem_def = GhPythonScript()  # -> out, elem_full, elem_half
# ---------- elem_def: Python ----------
import os
import sys
import json

from compas.geometry import Frame
from compas.geometry import Vector
from compas.geometry import Box

from cooperative_mobile_brickwork.assembly import Element


# dimensions full brick
width = 0.11
length = 0.235
height = 0.052

elem_full = Element.from_dimensions(length, width, height)
elem_full.tool_frame = Frame([0, 0, 0], [-1, 0, 0], [0, -1, 0])

elem_half = Element.from_dimensions(length/2, width, height)
elem_half.tool_frame = Frame([0, 0, 0], [1, 0, 0], [0, 1, 0])
# ---------- end elem_def ----------
draw = PythonScript(elem_full=elem_def.elem_full, elem_half=elem_def.elem_half, show=show)  # -> M, F, S
# ---------- draw: Python ----------
from compas.geometry import Transformation
from compas.geometry import Frame
from compas.datastructures import mesh_transformed
from compas.artists import Artist

if show:
    M = [Artist(elem_full.mesh).draw()]
    F = [Artist(elem_full.frame).draw()]
    #S = [Artist(elem_full._source.frame).draw()]
    S = [Artist(elem_full.tool_frame).draw()]
# ---------- end draw ----------

# ----
# Brick
# Predefine a brick element and its dimensions
# Visualise the defined element
show_2 = BooleanToggle(False)
elem_def_2 = GhPythonScript()  # -> out, elem_full, elem_half
# ---------- elem_def_2: Python ----------
import os
import sys
import json

from compas.geometry import Frame
from compas.geometry import Vector
from compas.geometry import Box

from cooperative_mobile_brickwork.assembly import Element


# dimensions full brick
width = 0.11
length = 0.235
height = 0.052

elem_full = Element.from_dimensions(length, width, height)
elem_full.tool_frame = Frame([0, 0, height], [1, 0, 0], [0, -1, 0])

elem_half = Element.from_dimensions(length/2, width, height)
elem_half.tool_frame = Frame([0, 0, height], [1, 0, 0], [0, -1, 0])
# ---------- end elem_def_2 ----------
draw_2 = PythonScript(elem_full=elem_def_2.elem_full, elem_half=elem_def_2.elem_half, show=show_2)  # -> M, F, S
# ---------- draw_2: Python ----------
from compas.geometry import Transformation
from compas.geometry import Frame
from compas.datastructures import mesh_transformed
from compas.artists import Artist

if show:
    M = [Artist(elem_full.mesh).draw()]
    F = [Artist(elem_full.frame).draw()]
    #S = [Artist(elem_full._source.frame).draw()]
    S = [Artist(elem_full.tool_frame).draw()]
    
    
    M = [Artist(elem_half.mesh).draw()]
    F = [Artist(elem_half.frame).draw()]
    #S = [Artist(elem_half._source.frame).draw()]
    S = [Artist(elem_half.tool_frame).draw()]
# ---------- end draw_2 ----------

# ----
# 2a.
reload = Button()
py = PythonScript(reload=reload)
# ---------- py: Python ----------
from compas_rhino.utilities.misc import get_tolerance
from compas_ghpython import unload_modules

unload_modules("ur_fabrication_control")
unload_modules("fabrication_control")
unload_modules("assembly_information_model")
unload_modules("humocap")
# ---------- end py ----------

x_axis = Curve(<curve referenced from the Rhino model>)
x_axis_2 = Curve(<curve referenced from the Rhino model>)
y_axis = Curve(<curve referenced from the Rhino model>)
x_axis_3 = Curve(<curve referenced from the Rhino model>)
y_axis_2 = Curve(<curve referenced from the Rhino model>)
y_axis_3 = Curve(<curve referenced from the Rhino model>)
vorne = PythonScript(plane_axes=[x_axis_2, y_axis])  # -> plane; inputs plane_axes: list of Curve
# ---------- vorne: Python ----------
import Rhino.Geometry as rg

x_axis, y_axis = plane_axes

x_axis = rg.Line(x_axis.PointAtStart, x_axis.PointAtEnd)
y_axis = rg.Line(y_axis.PointAtStart, y_axis.PointAtEnd)

if x_axis.From.DistanceTo(y_axis.From) < 0.01:
    origin = x_axis.From
    xvec = x_axis.Direction
    yvec = y_axis.Direction
elif x_axis.To.DistanceTo(y_axis.To) < 0.01:
    origin = x_axis.To
    xvec = -x_axis.Direction
    yvec = -y_axis.Direction
elif x_axis.From.DistanceTo(y_axis.To) < 0.01:
    origin = x_axis.From
    xvec = x_axis.Direction
    yvec = -y_axis.Direction
elif x_axis.To.DistanceTo(y_axis.From) < 0.01:
    origin = x_axis.To
    xvec = -x_axis.Direction
    yvec = y_axis.Direction

plane = rg.Plane(origin, xvec, yvec)
# ---------- end vorne ----------
oben = PythonScript(plane_axes=[x_axis, y_axis_3])  # -> plane; inputs plane_axes: list of Curve; same code as vorne
unten = PythonScript(plane_axes=[x_axis_3, y_axis_2])  # -> plane; inputs plane_axes: list of Curve; same code as vorne
disconnect = Button()
connect = Button()

# ----
# Load robot from local package
list = ValueList({"ur_description", "ur_e_description", "ur_setups"}, selected="ur_e_description")
list_2 = ValueList({"ur3.urdf", "ur3_rot.urdf", "ur5.urdf", "ur10.urdf", "ur3e.urdf", "ur5e.urdf", "ur10e.urdf", "ur10e_rot.urdf"}, selected="ur10e_rot.urdf")
list_3 = ValueList({"ur3.srdf", "ur5.srdf", "ur10.srdf", "ur3e.srdf", "ur5e.srdf", "ur10e.srdf"}, selected="ur10e.srdf")
py_2 = PythonScript()  # -> DATA
# ---------- py_2: Python ----------
import os
import getpass

HERE = os.path.dirname(ghdoc.Path)
DATA = os.path.abspath(os.path.join(HERE, "..", "data\models"))
print(DATA)
# ---------- end py_2 ----------
py_3 = PythonScript(data_path=py_2, package=list, urdf_name=list_2, srdf_name=list_3)  # -> loaders, urdf_filename, srdf_filename
# ---------- py_3: Python ----------
import os
from compas.robots import LocalPackageMeshLoader

path = os.path.join(data_path, "robot_description")

#loaders
packages = ["ur_description", "ur_e_description", "ur_end_effectors", "ur_setups"]
loaders = [LocalPackageMeshLoader(path, pck) for pck in packages]

#files
package_path = os.path.join(path, package)
print package_path

urdf_filename = os.path.join(package_path, "urdf", urdf_name)
srdf_filename = os.path.join(package_path, srdf_name)

assert os.path.isfile(urdf_filename)
assert os.path.isfile(srdf_filename)
# ---------- end py_3 ----------

pln = Plane([draw.F, draw.S])
baseplane_01 = Plane(Plane(origin=(43.763332, 34.171485, 1.102744), x=(-0.9749720173, 0.2217830039, 0.01555200028), y=(-0.2217233372, -0.9750941999, 0.00548298952)))
baseplane_02 = Plane(Plane(origin=(43.772352, 34.18155, 1.097462), x=(-0.9710950923, 0.2381860226, 0.01554800148), y=(-0.2380244931, -0.9711904748, 0.01154999452)))
py_4 = PythonScript()  # -> HERE, DATA
# ---------- py_4: Python ----------
import os

HERE = os.path.dirname(ghdoc.Path)
DATA = os.path.abspath(os.path.join(HERE, "..", "data"))
print(HERE)
print(DATA)
# ---------- end py_4 ----------

layers = Slider(19, range=2..30)
layers_2 = Slider(20, range=2..30)

layers_3 = Slider(10, range=2..30)
layers_4 = Slider(21, range=2..30)

crv = Curve(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)
crv_2 = Curve(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)
brep = Geometry(<brep referenced from the Rhino model>)
mesh = Mesh(brep)
mesh_2 = PythonScript(mesh=mesh)  # -> compas_mesh
# ---------- mesh_2: Python ----------
from compas.datastructures import Mesh
from compas_rhino.geometry import RhinoMesh

compas_mesh = RhinoMesh.from_guid(mesh).to_compas()
# ---------- end mesh_2 ----------
list_4 = ValueList({"rotation_factor": 1, "attractor_points": 2}, selected="attractor_points")
list_5 = ValueList({"rotation_factor": 1, "attractors_points": 2}, selected="attractors_points")

# ----
# Assembly
angle2 = Slider(0.8, range=0..100.01)
angle1 = Slider(42, range=-30.01..60)
layers_5 = Slider(20, range=0..30)
crv_3 = Curve(<curve referenced from the Rhino model>)
python = GhPythonScript(
    input_crv=crv_3,
    angle1=angle1,
    angle2=angle2,
    num=layers_5,
    offset_step=Slider(0.02, range=0..0.035),
    before_layer_num=layers,
    after_layer_num=layers_2,
    bricklen="0.235",
    interval="0.072")  # -> out, plane_grid, offset_curves, curves, planes; inputs input_crv: Curve, num: Int32
# ---------- python: Python ----------
import Rhino.Geometry as rg
import math as m
import rhinoscriptsyntax as rs
from Rhino.Geometry import CurveOffsetCornerStyle as cs

#new_curve = input_crv.Trim(0.1, 0.2)

start_pts = []
end_pts = []
curves = []
offset_curves = []

def list_from_2darray(array):
    return [item for sublist in array for item in sublist]
    
def create_curves(input_crv, angle1, angle2, interval, num):

    offset = 0
    
    for i in range(num):
        # duplicate and translate a new curve
        new_curve = rg.Curve.DuplicateCurve(input_crv)
        new_curve.Translate(rg.Vector3d.ZAxis*interval*i)
        
        # get the plane on which the new curve lies
        #crv_plane = rg.Plane(new_curve.PointAtStart, new_curve.PointAtEnd, new_curve.PointAtNormalizedLength(0.5))
        crv_plane = rg.Plane(new_curve.PointAtStart, rg.Vector3d.ZAxis)
        # compute an offset value based on layer number
        if i < before_layer_num:
            offset += offset_step
        elif i > after_layer_num:
            offset -= offset_step
        
        # offset the new curve
        offset_crv = rg.Curve.Offset(new_curve, crv_plane, -offset, 0.01, cs.None)[0]
        
        # for visualization
        offset_curves.append(offset_crv)
        
        # rotate the new curve around the axis defined by its end points (angle1); 
        # add an additional rotation of the curve based on layer number (angle2*i)
        rot_vector = rg.Vector3d(input_crv.PointAtStart) - rg.Vector3d(input_crv.PointAtEnd)
        offset_crv.Rotate(m.radians(-angle1-(i*angle2)), rot_vector, input_crv.PointAtNormalizedLength(0.5))
        
        # add the new curve to the list of curves
        curves.append(offset_crv)
    return curves

def create_planegrid(input_crv, angle1, angle2, interval, num, bricklen):

    curves = create_curves(input_crv, angle1, angle2, interval, num)
    
    plane_grid = []
    offset = 0
    for j, c in enumerate(curves):
        
        #new_start_pt = c.PointAtNormalizedLength(value_list[j])
        new_start_pt = c.PointAtNormalizedLength(0.04*(j/10.))
        c.SetStartPoint(new_start_pt)
    
        row = []

        #vparams = rg.Curve.DivideByCount(c, cols, True)
        vparams = rg.Curve.DivideByLength(c, 0.1325, True)
        planes = rg.Curve.GetPerpendicularFrames(c, vparams)

        for i, plane in enumerate(planes):
            
            plane.Rotate(m.radians(-90), plane.YAxis)
            plane.Rotate(m.radians(-90), plane.XAxis)

            if j%2 == 0 and i%2 == 0: #even course
                if i < 9:
                    plane.Translate(plane.XAxis*+0.0/i) # 0.0
                    plane.Rotate(m.radians(0), plane.ZAxis)
                elif i > len(planes)-11:
                    plane.Translate(plane.XAxis*-0.2/i) # 0.1
                    plane.Rotate(m.radians(0), plane.ZAxis)
                    
                row.append(plane)
                
            if j%2 == 1 and i%2 == 1: #odd course
                if i < 9:
                    plane.Translate(plane.XAxis*+0.01/i) # 0.02
                elif i > len(planes)-8:
                    plane.Translate(plane.XAxis*-0.4/i*(i/50)) # 0.1

                row.append(plane)

        plane_grid.append(row)
    return plane_grid

plane_grid = create_planegrid(input_crv, angle1, angle2, interval, num, bricklen)
planes = list_from_2darray(plane_grid)
# ---------- end python ----------
crv_4 = Curve(python.offset_curves)
pln_2 = Plane(python.planes)
pt = Point([<point referenced from the Rhino model> x3])
generate_assembly = GhPythonScript(
    plane_grid=python.plane_grid,
    rot_mode=list_5,
    rot_factor1=Slider(20, range=0..100),
    rot_factor2=Slider(5, range=0..100),
    attr_pts=pt,
    elem_full=elem_def.elem_full)  # -> assembly; inputs plane_grid: list, attr_pts: list of Point3d
# ---------- generate_assembly: Python ----------
import Rhino.Geometry as rg
import math
from scriptcontext import sticky as st

from compas.geometry import Frame
from compas.geometry import Transformation

from compas_ghpython import draw_frame

from cooperative_mobile_brickwork.assembly import Assembly

import Rhino.Geometry as rg


assembly = Assembly() # initialize an empty assembly class

current_course = 0
for j, row in enumerate(plane_grid):
    for i, plane in enumerate(row):
        
        new_plane = rg.Plane(plane)
        
        if rot_mode == 1:
            rotval1 = math.sin(i/8)*rot_factor1
            #rotval2 = math.sin(i/6)*rot_factor2 
            rotval2 = -rot_factor2
        
        if rot_mode == 2:
            min_dist = 1.50
            for attr_pt in attr_pts:
                dist =  attr_pt.DistanceTo(new_plane.Origin)
                #print dist
                if dist < min_dist: 
                    min_dist = dist
            dist = min_dist
            
            rot_val = (dist/10)*0.4
            angle = math.radians(rot_val**2)*5000

#            if i < 2:
#               angle = 0

        #print 'course:', j, 'brick:', i, 'angle: ' , math.degrees(angle)
        
        if j%2==0: #even layers
            new_plane.Rotate(angle, plane.ZAxis, plane.Origin)
        else:
            new_plane.Rotate(-angle, plane.ZAxis, plane.Origin)
        
        T = Transformation.from_frame_to_frame(Frame.worldXY(), Frame(new_plane.Origin, new_plane.XAxis, new_plane.YAxis))
        
        
        if plane.OriginZ > 0.35:
        #if True:
            e = elem_full.transformed(T)
            assembly.add_element(e)


if transform:
    T = Transformation.from_frame_to_frame(Frame.worldXY(), Frame(ptransf.Origin, ptransf.XAxis, ptransf.YAxis))
    assembly.transform(T)
# ---------- end generate_assembly ----------

show_3 = BooleanToggle(False)
update_network = PythonScript(DATA=py_4.DATA, compute_interfaces_numpy=show_3, assembly=generate_assembly)  # -> assembly
# ---------- update_network: Python ----------
from assembly_information_model.assembly.courses import assembly_courses, assembly_with_interfaces_courses


if compute_interfaces_numpy:
    import os
    from compas.rpc import Proxy
    from assembly_information_model.assembly import Assembly
    p = Proxy('cooperative_mobile_brickwork.assembly.interfaces_numpy')
    p.stop_server()
    p.start_server()

    filename_before = "brickwall_ex2.json"
    filename_after = "brickwall_interfaces_ex2.json"

    PATH_BEFORE = os.path.join(DATA, filename_before)
    PATH_AFTER = os.path.join(DATA, filename_after)
    
    # the assembly has to be serialized such that it can be called from CPython
    assembly.to_json(PATH_BEFORE)
    
    # call the CPython Function using COMPAS RPC
    p.assembly_interfaces_numpy_fromtojson(PATH_BEFORE, PATH_AFTER, nmax=10, tmax= 0.04, amin = 0.00001)

    assembly = Assembly.from_json(PATH_AFTER)


# now compute the courses
assembly_courses(assembly)

# example test: get the bottom keys
c_min = min(assembly.network.nodes_attribute(name='course'))
#print(c_min)
#keys_on_bottom = list(assembly.network.edges_where({'course': c_min}))
#print(keys_on_bottom)

# example test: get the top keys
c_max = max(assembly.network.nodes_attribute(name='course'))
##print(c_max)
#keys_on_top = list(assembly.network.edges_where({'course': c_max}))
#print(keys_on_top)
# ---------- end update_network ----------

# ----
# to JSON
export = Button()
export_2 = Button()
export_3 = PythonScript(DATA=py_4.DATA, assembly=update_network, export_to_json=export, export_to_json_unity=export_2)
# ---------- export_3: Python ----------
import os
from compas.datastructures.mesh import mesh_quads_to_triangles
from compas.datastructures.mesh import mesh_unify_cycles
filename = "brickwall_ex1.json"
PATH = os.path.join(DATA, filename)
print PATH
if export_to_json:
    
    filename = "brickwall_ex1.json"
    PATH = os.path.join(DATA, filename)
    print PATH
    
    # the assembly has to be serialized such that it can be called from CPython
    assembly.to_json(PATH)
    

if export_to_json_unity:
    
    for key, e in assembly.elements():
    
        #convert to trimesh
        mesh_quads_to_triangles(e._mesh, check_angles=False)
        #mesh_unify_cycles(e._mesh)
        #print e._mesh.faces
        #print e._mesh.face_vertices(list(e._mesh.faces())[0])

    filename = "brickwall_ex1_unity.json"
    PATH = os.path.join(DATA, filename)
    assembly.to_json(PATH)
# ---------- end export_3 ----------

crv_5 = Curve(python.curves)

# ----
# Brick Vault large
midpt = CurveMiddle(Curve=crv_5)
series = Series(Start=0, Step=1, Count=20)
tag = TextTag(Location=midpt, Text=series)
total = GhPythonScript(assembly=generate_assembly)  # -> out
# ---------- total: Python ----------
brick_weight = 3.2

total_bricks = assembly.number_of_elements()
total_weight_bricks = total_bricks*brick_weight
#total_weight_mortar = 

print total_bricks, 'bricks total.'
print total_weight_bricks, 'kg', 'weight bricks.'
print '??? kg', 'weight mortar.'
# ---------- end total ----------
panel = Panel(total)

# ----
# ROBOT - IP Settings
ur_ip = ValueList({"192.168.0.210"}, selected="192.168.0.210")

# ----
# Check robot availability
ping = Button()
py_5 = PythonScript(ping=ping)  # -> out, trigger
# ---------- py_5: Python ----------
from scriptcontext import sticky as st
from ur_fabrication_control.direct_control import is_available

guid = str(ghenv.Component.InstanceGuid)
txt_key = "txt_" + guid
if txt_key not in st:
    st[txt_key] = ""

ip = st["ur_ip"]
print ip

if ping:
    
    available = is_available(ip)
    
    if available:
        st[txt_key] = "%s is up!" % ip
        trigger = True
    else:
        st[txt_key] = "%s is down!" % ip
        trigger = False

print(st[txt_key])
# ---------- end py_5 ----------
panel_2 = Panel(py_5.out)

key = Slider(40, range=0..388)
till_key = Button()
start = Button()
reset = Button()
stop = Button()
back = Button()
step = Button()
full = Button()
list_6 = ValueList({"20", "50", "100", "500", "1000", "5000"}, selected="50")

key_2 = Slider(17, range=0..388)
till_key_2 = Button()
start_2 = Button()
reset_2 = Button()
stop_2 = Button()
back_2 = Button()
step_2 = Button()
full_2 = Button()
list_7 = ValueList({"20", "50", "100", "500", "1000", "5000"}, selected="50")

# ----
# Network Viz
number_slider = Slider(0, range=0..47)
show_4 = BooleanToggle(False)
network_viz = GhPythonScript(assembly=generate_assembly, show_network=show_4, key=number_slider)  # -> out, nodes, edges, current_node, current_node_neighbors; inputs key: Int32
# ---------- network_viz: Python ----------
import sys, os
import ghpythonlib.components as ghcomp
from compas.datastructures import Network
from compas_ghpython.artists import NetworkArtist
from compas_rhino.geometry import RhinoLine

import compas_ghpython
import Rhino.Geometry as rg


data = assembly.network.to_data()
network = Network.from_data(data)

print assembly.network.number_of_nodes()

def draw_network(network):
    """Draw a network in Grasshopper.
    """
    points = []
    for key, attr in network.nodes(True):
        points.append({
            'pos': network.node_coordinates(key),
        })

    lines = []
    for (u, v), attr in network.edges(True):
        lines.append({
            'start': network.node_coordinates(u),
            'end': network.node_coordinates(v),
        })

    points_rg = compas_ghpython.draw_points(points)
    lines_rg = compas_ghpython.draw_lines(lines)

    return points_rg, lines_rg

if show_network:
    nodes, edges = draw_network(network)
    
    current_node = {'pos': network.node_coordinates(key), 'radius': 0.03}
    current_node = compas_ghpython.draw_spheres([current_node])
    
    current_node_neighbors_keys = network.neighbors(key)
    current_node_neighbors = [{'pos': network.node_coordinates(key), 'radius': 0.02} for key in current_node_neighbors_keys]
    current_node_neighbors = compas_ghpython.draw_spheres(current_node_neighbors)
# ---------- end network_viz ----------
pt_2 = Point(network_viz.nodes)
line = Line(network_viz.edges)
brep_2 = Brep(network_viz.current_node)
brep_3 = Brep(network_viz.current_node_neighbors)
preview = CustomPreview(Geometry=[brep_2, line], Material=ColourSwatch(SwatchColor=RGB(0, 0, 0)))
preview_2 = CustomPreview(Geometry=brep_3, Material=ColourSwatch(SwatchColor=RGB(255, 207, 207)))

# ----
# Draw
# Visualise the entire assembly and its underlying network topology.
counter = CountThroughList(
    assembly=generate_assembly,
    start=start_2,
    stop=stop_2,
    step=step_2,
    step_back=back_2,
    reset=reset_2,
    full=full_2,
    till_key=till_key_2,
    key=key_2,
    interval=list_7)  # -> item, counter; inputs start: Boolean, stop: Boolean, step_back: Boolean, key: Int32
# ---------- counter: Python ----------
from scriptcontext import sticky as st
from compas_ghpython import update_component


L = list(assembly.elements())
# store data in component
guid = str(ghenv.Component.InstanceGuid)
counter_key = "counter_" + guid
running_key = "running_" + guid

if counter_key not in st:
    st[counter_key] = 0

if running_key not in st:
    st[running_key] = False
    

if st[running_key]:
    if st[counter_key] < len(L) - 1:
        st[counter_key] += 1
        update_component(ghenv, interval)
    else:
        st[counter_key] = 0
        st[running_key] = False
    
    
if start:
    st[running_key] = True

if stop:
    st[running_key] = False

if step:
    if st[counter_key] < len(L) - 1:
        st[counter_key] += 1

if step_back:
    if  0 < st[counter_key] < len(L):
        st[counter_key] -= 1

if reset:
    st[counter_key] = 0

if till_key:
    st[counter_key] = key

if full:
    st[counter_key] = len(L)-1

if len(L):
    item = L[st[counter_key]]



#st["visualisation_counter"] = st[counter_key]
#st[counter_key]= 500
counter = st[counter_key]
# ---------- end counter ----------
idx = Panel(counter.counter)

# ---- group: Assembly Artist
show_5 = BooleanToggle(False)
show_6 = BooleanToggle(True)
draw_3 = PythonScript(assembly=generate_assembly, show_all=show_5, show_counter=show_6, counter=counter.counter)  # -> G, tool_planes_WCS, current_tool_plane; inputs counter: Int32
# ---------- draw_3: Python ----------
import os
import sys

import math

from compas.colors import Color
from compas.artists import Artist


G = []
color = Color.from_rgb255(243,169,137)

key_index = assembly.network.key_index()
keys = [key_index[key] for key in assembly.network.nodes()]
elements = [assembly.element(key) for key in keys]
#print elements
#print([(e.gripping_frame) for e in elements])

tool_planes_WCS = [Artist(e.tool_frame).draw() for e in elements]

current_tool_plane = tool_planes_WCS[counter]

if show_all and not show_counter:
    for element in elements:
        mesh = Artist(element.mesh).draw(color)
        G.append(mesh)

if show_counter:
    for element in elements[0:counter+1]:
        mesh = Artist(element.mesh).draw(color)
        G.append(mesh)
# ---------- end draw_3 ----------
geo = Geometry(draw_3.G)
pln_3 = Plane(draw_3.tool_planes_WCS)
pln_4 = Plane(draw_3.current_tool_plane)
preview_3 = CustomPreview(Geometry=pln_3, Shader=ColourSwatch(SwatchColor=RGB(178, 178, 178)))
preview_4 = CustomPreview(Geometry=geo, Shader=ColourSwatch(SwatchColor=RGB(243, 169, 137)))

# ----
tolerance_vector = Vector(Vector(0, 0, 0.001))  # disabled
safelevel_vector = Vector(Vector(0, 0, 0.05))  # disabled

# ----
# Step
number_slider_2 = Slider(3, range=0..100)  # disabled
python_2 = PythonScript(assembly=generate_assembly, key=number_slider_2)  # -> out, element, M; inputs key: Int32; disabled
# ---------- python_2: Python ----------
from compas.artists import Artist


element = assembly.element(key)

M = Artist(element.mesh).draw()
# ---------- end python_2 ----------
element = Data(python_2.element)  # disabled
colour_swatch = ColourSwatch(SwatchColor=RGBA(255, 0, 0, 218))  # disabled
preview_5 = CustomPreview(Geometry=python_2.M, Shader=colour_swatch)  # disabled

# ---- group: cartesian motion
# 6. Save assembly to json
panel_3 = Panel("assembly_stack_planned.json")
save = Button()
python_3 = PythonScript(assembly=generate_assembly, DATA=py_4.DATA, name=panel_3, save=save)  # -> out, a
# ---------- python_3: Python ----------
import os
filename = os.path.join(DATA, name)

print assembly.element(0)

if save:
    assembly.to_json(filename, pretty=True)
# ---------- end python_3 ----------

# ----
list_8 = ValueList({"start": 0, "end": 1, "picking": 2, "placing": 3}, selected="placing")
config_32 = GhPythonScript()  # -> out, a
# ---------- config_32: Python ----------
from compas_fab.robots import JointTrajectoryPoint, Duration

a = [JointTrajectoryPoint((0.262, -1.798, 2.496, -2.269, -1.571, -2.094), (0, 0, 0, 0, 0, 0), (0.000, 0.000, 0.000, 0.000, 0.000, 0.000), (-0.051, 0.000, 0.000, 0.000, 0.000, 0.000), (0.000, 0.000, 0.000, 0.000, 0.000, 0.000), Duration(0, 0)), JointTrajectoryPoint((0.252, -1.615, 2.305, -2.183,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
# ---------- end config_32 ----------
config_34 = GhPythonScript()  # -> out, a
# ---------- config_34: Python ----------
from compas_fab.robots import JointTrajectoryPoint, Duration

a = [JointTrajectoryPoint((0.262, -1.798, 2.496, -2.269, -1.571, -2.094), (0, 0, 0, 0, 0, 0), (0.000, 0.000, 0.000, 0.000, 0.000, 0.000), (0.253, 0.000, 0.000, 0.000, 0.000, 0.000), (0.000, 0.000, 0.000, 0.000, 0.000, 0.000), Duration(0, 0)), JointTrajectoryPoint((0.295, -1.668, 2.394, -2.211, -1.585, -2.088), (0, 0, 0, 0, 0, 0), (0.109, 0.431, -0.337, 0.193, -0.047, 0.019), (0.247, 0.971, -0.760, 0.435, -0.106, 0.042), (0.000, 0.000, 0.000, 0.000, 0.000, 0.000), Duration(0, 511451664)), JointTrajectoryPoint((0.328, -1.538, 2.292, -2.152, -1.599, -2.083), (0, 0, 0, 0, 0, 0), (0.176, 0.694, -0.543, 0.311, -0.076, 0.030), (0.233, 0.916, -0.717, 0.411, -0.100, 0.039), (0.000, 0.000, 0.000, 0.000, 0.000, 0.000), Duration(0, 725875851)), JointTrajectoryPoint((0.361, -1.408, 2.190, -2.094, -1.614, -2.077), (0, 0, 0, 0, 0, 0), (0.216, 0.851, -0.666, 0.382, -0.093, 0.037), (0.231, 0.908, -0.711, 0.407, -0.099, 0.039), (0.000, 0.000, 0.000, 0.000, 0.000, 0.000), Duration(0, 892432260)), JointTrajectoryPoint((0.394, -1.277, 2.089, -2.036, -1.628, -2.072), (0, 0, 0, 0, 0, 0), (0.249, 0.979, -0.766, 0.439, -0.107, 0.042), (0.218, 0.860, -0.673, 0.385, -0.094, 0.037), (0.000, 0.000, 0.000, 0.000, 0.000, 0.000), Duration(1, 33717825)), JointTrajectoryPoint((0.427, -1.147, 1.987, -1.977, -1.642, -2.066), (0, 0, 0, 0, 0, 0), (0.251, 0.989, -0.774, 0.444, -0.108, 0.043), (-0.180, -0.709, 0.555, -0.318, 0.078, -0.030), (0.000, 0.000, 0.000, 0.000, 0.000, 0.000), Duration(1, 159356459)), JointTrajectoryPoint((0.460, -1.017, 1.885, -1.919, -1.656, -2.060), (0, 0, 0, 0, 0, 0), (0.220, 0.868, -0.679, 0.389, -0.095, 0.037), (-0.252, -0.991, 0.776, -0.445, 0.108, -0.043), (0.000, 0.000, 0.000, 0.000, 0.000, 0.000), Duration(1, 297459657)), JointTrajectoryPoint((0.494, -0.887, 1.783, -1.861, -1.671, -2.055), (0, 0, 0, 0, 0, 0), (0.179, 0.704, -0.551, 0.316, -0.077, 0.030), (-0.239, -0.939, 0.735, -0.421, 0.103, -0.040), (0.000, 0.000, 0.000, 0.000, 0.000, 0.000), Duration(1, 461675114)), JointTrajectoryPoint((0.527, -0.757, 1.681, -1.802, -1.685, -2.049), (0, 0, 0, 0, 0, 0), (0.111, 0.435, -0.341, 0.195, -0.048, 0.019), (-0.254, -1.001, 0.784, -0.449, 0.109, -0.043), (0.000, 0.000, 0.000, 0.000, 0.000, 0.000), Duration(1, 672869542)), JointTrajectoryPoint((0.560, -0.627, 1.579, -1.744, -1.699, -2.044), (0, 0, 0, 0, 0, 0), (0.000, 0.000, 0.000, 0.000, 0.000, 0.000), (-0.253, -0.995, 0.779, -0.446, 0.109, -0.043), (0.000, 0.000, 0.000, 0.000, 0.000, 0.000), Duration(2, 184321206))]
# ---------- end config_34 ----------
config_33 = GhPythonScript()  # -> out, a
# ---------- config_33: Python ----------
from compas_fab.robots import JointTrajectoryPoint, Duration

a = [JointTrajectoryPoint((0.262, -1.798, 2.496, -2.269, -1.571, -2.094), (0, 0, 0, 0, 0, 0), (0.000, 0.000, 0.000, 0.000, 0.000, 0.000), (0.040, 0.000, 0.000, 0.000, 0.000, 0.000), (0.000, 0.000, 0.000, 0.000, 0.000, 0.000), Duration(0, 0)), JointTrajectoryPoint((0.268, -1.654, 2.372, -2.208, -1.605, -2.149), (0, 0, 0, 0, 0, 0), (0.018, 0.459, -0.393, 0.196, -0.107, -0.174), (0.040, 0.999, -0.855, 0.426, -0.233, -0.379), (0.000, 0.000, 0.000, 0.000, 0.000, 0.000), Duration(0, 535932604)), JointTrajectoryPoint((0.274, -1.510, 2.249, -2.146, -1.638, -2.203), (0, 0, 0, 0, 0, 0), (0.030, 0.739, -0.633, 0.315, -0.172, -0.280), (0.037, 0.920, -0.788, 0.392, -0.214, -0.349), (0.000, 0.000, 0.000, 0.000, 0.000, 0.000), Duration(0, 758523485)), JointTrajectoryPoint((0.279, -1.365, 2.125, -2.085, -1.672, -2.258), (0, 0, 0, 0, 0, 0), (0.036, 0.904, -0.774, 0.385, -0.210, -0.342), (0.037, 0.912, -0.781, 0.389, -0.212, -0.346), (0.000, 0.000, 0.000, 0.000, 0.000, 0.000), Duration(0, 932233613)), JointTrajectoryPoint((0.285, -1.221, 2.002, -2.023, -1.705, -2.313), (0, 0, 0, 0, 0, 0), (0.041, 1.016, -0.870, 0.433, -0.237, -0.385), (0.022, 0.554, -0.475, 0.236, -0.129, -0.210), (0.000, 0.000, 0.000, 0.000, 0.000, 0.000), Duration(1, 79890972)), JointTrajectoryPoint((0.291, -1.077, 1.878, -1.962, -1.739, -2.367), (0, 0, 0, 0, 0, 0), (0.040, 0.989, -0.847, 0.422, -0.230, -0.375), (-0.037, -0.907, 0.777, -0.387, 0.211, 0.344), (0.000, 0.000, 0.000, 0.000, 0.000, 0.000), Duration(1, 216527112)), JointTrajectoryPoint((0.297, -0.933, 1.755, -1.900, -1.772, -2.422), (0, 0, 0, 0, 0, 0), (0.035, 0.869, -0.744, 0.370, -0.202, -0.329), (-0.026, -0.649, 0.555, -0.277, 0.151, 0.246), (0.000, 0.000, 0.000, 0.000, 0.000, 0.000), Duration(1, 372837737)), JointTrajectoryPoint((0.303, -0.788, 1.631, -1.839, -1.806, -2.477), (0, 0, 0, 0, 0, 0), (0.029, 0.729, -0.624, 0.311, -0.170, -0.276), (-0.034, -0.854, 0.731, -0.364, 0.199, 0.324), (0.000, 0.000, 0.000, 0.000, 0.000, 0.000), Duration(1, 549898357)), JointTrajectoryPoint((0.308, -0.644, 1.508, -1.777, -1.840, -2.531), (0, 0, 0, 0, 0, 0), (0.018, 0.456, -0.391, 0.195, -0.106, -0.173), (-0.040, -0.985, 0.843, -0.420, 0.229, 0.373), (0.000, 0.000, 0.000, 0.000, 0.000, 0.000), Duration(1, 774089158)), JointTrajectoryPoint((0.314, -0.500, 1.384, -1.716, -1.873, -2.586), (0, 0, 0, 0, 0, 0), (0.000, 0.000, 0.000, 0.000, 0.000, 0.000), (-0.040, -1.004, 0.860, -0.428, 0.234, 0.381), (0.000, 0.000, 0.000, 0.000, 0.000, 0.000), Duration(2, 310021762))]
# ---------- end config_33 ----------
config_35 = GhPythonScript()  # -> out, a; same code as config_34
# 3.
crv_6 = Curve(<curve referenced from the Rhino model>)  # disabled

# ----
# Set Digital Out
number = Slider(1, range=0..10)
value = BooleanToggle(True)
digital_out = PythonScript(number=number, value=value)  # -> urscript; inputs number: Int32, value: Boolean
# ---------- digital_out: Python ----------
from ur_fabrication_control.direct_control import URScript

urscript = URScript()
urscript.start()
urscript.add_line("\tset_digital_out({}, {})".format(number, value))
urscript.end()
urscript = urscript.generate()

print(urscript)
# ---------- end digital_out ----------
send = Button()
send_2 = GhPythonScript(urscript=digital_out, send=send)  # -> out; inputs send: Boolean
# ---------- send_2: Python ----------
from scriptcontext import sticky as st
from ur_fabrication_control.direct_control import send_script

ur_ip = st["ur_ip"]
ur_port = st["ur_port"]

if send:
    send_script(urscript, ur_ip, ur_port)
# ---------- end send_2 ----------

python_4 = PythonScript()  # -> trajectory; inputs trajectory1: list, trajectory2: list, trajectory3: list; disabled
# ---------- python_4: Python ----------
trajectory = []

if trajectory1 != [None]:
    trajectory += trajectory1

if trajectory2 != [None]:
    trajectory += trajectory2

if trajectory3 != [None]:
    trajectory += trajectory3
# ---------- end python_4 ----------

# ----
# Stop
stop_3 = Button()
stop_4 = PythonScript(stop=stop_3)
# ---------- stop_4: Python ----------
from scriptcontext import sticky as st
from ur_fabrication_control.direct_control.common import send_stop

ur_ip = st["ur_ip"]
ur_port = st["ur_port"]

if stop:
    send_stop(ur_ip, ur_port)
# ---------- end stop_4 ----------

divide = DivideCurve(Curve=crv_6, Count=10, Kinks=False)  # -> Points, Tangents, Parameters; disabled
reset_3 = Button()  # disabled
start_3 = Button()  # disabled
stop_5 = Button()  # disabled
hframe = HorizontalFrame(Curve=crv_6, Parameter=divide.Parameters)  # disabled
counter_2 = CountThroughList(L=python_4, start=start_3, stop=stop_5, step=False, reset=reset_3, interval=10)  # -> item; inputs L: list, start: Boolean, stop: Boolean; disabled
# ---------- counter_2: Python ----------
from scriptcontext import sticky as st
from compas_ghpython.utilities import update_component

if not interval:
    interval = 10

# store data in component
guid = str(ghenv.Component.InstanceGuid)
counter_key = "counter_" + guid
running_key = "running_" + guid

if counter_key not in st:
    st[counter_key] = 0

if running_key not in st:
    st[running_key] = False

if start:
    st[running_key] = True

if stop:
    st[running_key] = False

if step:
    if st[counter_key] < len(L) - 1:
        st[counter_key] += 1

if back:
    if st[counter_key] > 1:
        st[counter_key] -= 1

if len(L):
    item = L[st[counter_key]]

if st[running_key]:
    if st[counter_key] < len(L) - 1:
        st[counter_key] += 1
        update_component(ghenv, interval)
    else:
        st[counter_key] = 0
        st[running_key] = False


print interval
# ---------- end counter_2 ----------
number_slider_3 = Slider(90, range=-180..100)  # disabled
flippln = FlipPlane(Plane=hframe, FlipX=False, FlipY=False, FlipZ=True)  # -> Flipped, R; disabled
deplane = DeconstructPlane(Plane=flippln.Flipped)  # -> Origin, XAxis, YAxis, ZAxis; disabled
rad = Radians(Degrees=number_slider_3)  # disabled
rotate = Rotate(Geometry=flippln.Flipped, Angle=rad, Plane=deplane.Origin)  # -> Geometry, Transform; disabled

# ----
# Area Gripper Switch
open = BooleanToggle(False)
digital_out_2 = PythonScript(open=open)  # -> urscript
# ---------- digital_out_2: Python ----------
from ur_fabrication_control.direct_control import URScript
from ur_fabrication_control.direct_control.mixins import AreaGripMixins

class URScript_AreaGrip(URScript, AreaGripMixins):
    pass

urscript = URScript_AreaGrip()
urscript.start()

if open:
    # on
    urscript.areagrip_on()
else: 
    # off
    urscript.areagrip_off()

urscript.end()
urscript = urscript.generate()
print(urscript)
# ---------- end digital_out_2 ----------
send_3 = Button()
send_4 = GhPythonScript(urscript=digital_out_2, send=send_3)  # -> out; inputs send: Boolean
# ---------- send_4: Python ----------
from scriptcontext import sticky as st
from ur_fabrication_control.direct_control import send_script

ur_ip = st["ur_ip"]
ur_port = st["ur_port"]

print ur_ip

if send:
    send_script(urscript, ur_ip, ur_port)
# ---------- end send_4 ----------

pln_5 = Plane(rotate.Geometry)  # disabled
item = ListItem(List=pln_5, Index=0, Wrap=True)  # disabled

# ----
# Get Pose Cartesian
get = Button()
pose = PythonScript(get=get)  # -> pose_cartesian_meter
# ---------- pose: Python ----------
from scriptcontext import sticky as st
from ur_fabrication_control.online_control.ur_direct import get_current_pose_cartesian
from compas.geometry import Frame
from compas_ghpython import draw_frame

robot = st["robot"]

server_ip = st["server_ip"]
server_port = st["server_port"]
ur_port = st["ur_port"]
ur_ip = st["ur_ip"]
pose_cartesian_meter = []
print ur_ip

# retrieve the current tool frame in axis angle format
if robot.attached_tool:
    print ("attached")
    tool_angle_axis = list(robot.attached_tool.frame.point) + list(robot.attached_tool.frame.axis_angle_vector)
    
else:
    tool0_frame = Frame([0, 0, 0], [1, 0, 0], [0, 1, 0])
    tool_angle_axis = list(tool0_frame.point) + list(tool0_frame.axis_angle_vector)

print(tool_angle_axis)

guid = str(ghenv.Component.InstanceGuid)
pose_cartesian_key = "pose_cartesian" + guid


if get:
    print ("getting pose")
    #st[pose_cartesian_key] = get_current_pose_cartesian(tool_angle_axis, server_ip, server_port, ur_ip, ur_port, send=True)
    st[pose_cartesian_key] = get_current_pose_cartesian(server_ip, server_port, ur_ip, tool_angle_axis)
    

if pose_cartesian_key not in st:
    pose_cartesian_mm = []
    pose_cartesian_meter = []
else:
    pose_cartesian = st[pose_cartesian_key]

print(pose_cartesian)

for i in pose_cartesian:
    new_c = i / 1000
    pose_cartesian_meter.append(new_c)

print (pose_cartesian_meter)
# ---------- end pose ----------
panel_4 = Panel(pose)

# ----
# Get Pose Joint
get_2 = Button()
pose_2 = PythonScript(get=get_2)  # -> configuration, pose_joints
# ---------- pose_2: Python ----------
from scriptcontext import sticky as st
from ur_fabrication_control.online_control.ur_direct import get_current_pose_joints
from compas_fab.robots import Configuration


robot = st["robot"]

server_ip= st["server_ip"]
server_port = st["server_port"]
ur_port = st["ur_port"]
ur_ip = st["ur_ip"]
print ur_ip

guid = str(ghenv.Component.InstanceGuid)
pose_joints_key = "pose_joints" + guid

# retrieve the current tool frame in axis angle format
if robot.attached_tool:
    tool_angle_axis = list(robot.attached_tool.frame.point) + list(robot.attached_tool.frame.axis_angle_vector)
else:
    tool0_frame = Frame([0, 0, 0], [1, 0, 0], [0, 1, 0])
    tool_angle_axis = list(tool0_frame.point) + list(tool0_frame.axis_angle_vector)

print(tool_angle_axis)

# send script to the robot to receive the current joint configuration
if get:
    st[pose_joints_key] = get_current_pose_joints(server_ip, server_port, ur_ip, tool_angle_axis)

print (st[pose_joints_key])
configuration = Configuration.from_revolute_values(st[pose_joints_key])
pose_joints = configuration.joint_values
"""
if pose_joints_key not in st:
    configuration = Configuration.from_revolute_values([0,0,0,0,0,0])
else:
    configuration = Configuration.from_revolute_values(st[pose_joints_key])

pose_joints = configuration.values
"""
# ---------- end pose_2 ----------
panel_5 = Panel(pose_2.pose_joints)

baseplane_01_2 = Plane(Plane(origin=(43.763332, 34.171485, 1.102744), x=(-0.9749720173, 0.2217830039, 0.01555200028), y=(-0.2217233372, -0.9750941999, 0.00548298952)))

# ----
# Calculate Basis - 3-Point Method
list_9 = ValueList({"o, pos.x-axis, xy pl": 0, "o, pos.y-axis, xy pl": 1}, selected="o, pos.x-axis, xy pl")
clear = Button()
rec = PythonScript(msg=pose, rec=get, clear=clear)  # -> rec; inputs msg: list
# ---------- rec: Python ----------
from scriptcontext import sticky as st

guid = str(ghenv.Component.InstanceGuid)
recorded_key =  "recorded_" + guid
just_cleared_key = "just_cleared_" + guid


if recorded_key not in st:
    st[recorded_key] = []

if just_cleared_key not in st:
    st[just_cleared_key] = False

if clear:
    st[recorded_key] = []
    st[just_cleared_key] = True
else:
    if len(msg):
        if msg != [None] and not st[just_cleared_key] and rec:
            st[recorded_key].append(msg)
    st[just_cleared_key] = False
        


rec = st[recorded_key]

print rec
# ---------- end rec ----------
calc_base = PythonScript(poses=rec, input_type=list_9)  # -> out, base_plane; inputs poses: list
# ---------- calc_base: Python ----------
import Rhino.Geometry as rg
import math


if len(poses) > 2:
    
    O = poses[0]
    P1 = poses[1]
    P2 = poses[2]
    
    if input_type == 0:
        # origin, pt on positive x-axis, pt in xy plane
        origin = rg.Point3d(O[0], O[1], O[2])
        pt_on_xaxis = rg.Point3d(P1[0], P1[1], P1[2])
        pt_in_xyplane = rg.Point3d(P2[0], P2[1], P2[2])
        
        xaxis = pt_on_xaxis - origin
        xaxis.Unitize()
        
        v = pt_in_xyplane - origin
        zaxis = rg.Vector3d.CrossProduct(v, xaxis)
        zaxis.Unitize()
        
        # zaxis must look up!
        if math.acos(rg.Vector3d.ZAxis * zaxis) > math.acos(rg.Vector3d.ZAxis * -zaxis):
            zaxis = -zaxis
        
        yaxis = rg.Vector3d.CrossProduct(zaxis, xaxis)
    
    elif input_type == 1:
        # origin, pt on positive y-axis, pt in xy plane
        origin = rg.Point3d(O[0], O[1], O[2])
        pt_on_yaxis = rg.Point3d(P1[0], P1[1], P1[2])
        pt_in_xyplane = rg.Point3d(P2[0], P2[1], P2[2])
        
        yaxis = pt_on_yaxis - origin
        yaxis.Unitize()
        
        v = pt_in_xyplane - origin
        zaxis = rg.Vector3d.CrossProduct(v, yaxis)
        zaxis.Unitize()
        
        # zaxis must look up!
        if math.acos(rg.Vector3d.ZAxis * zaxis) > math.acos(rg.Vector3d.ZAxis * -zaxis):
            zaxis = -zaxis
        
        xaxis = rg.Vector3d.CrossProduct(yaxis, zaxis)
        
        
    print "Copy the following into base component:"
    print " "
    print "origin = [%.2f, %.2f, %.2f]" % tuple(list(origin))
    print "xaxis = [%.5f, %.5f, %.5f]" % tuple(list(xaxis))
    print "yaxis = [%.5f, %.5f, %.5f]" % tuple(list(yaxis))
    

#print rg.Vector3d.CrossProduct(rg.Vector3d.YAxis, rg.Vector3d.ZAxis)
#print rg.Vector3d.CrossProduct(rg.Vector3d.ZAxis, rg.Vector3d.XAxis)

    base_plane = rg.Plane(origin, xaxis, xaxis)
# ---------- end calc_base ----------
panel_6 = Panel(rec)
panel_7 = Panel(calc_base.out)

plane_01 = Plane(Plane(origin=(43.66802394, 34.12290406, 1.164991481), x=(-0.975923335, 0.2181138332, 0), y=(-0.2181138332, -0.975923335, 0)))
pt_3 = Point([<point referenced from the Rhino model> x4])

# ----
# Direct UR Control
# Calculate Basis - Point fitting method via RPC
config = GhPythonScript()  # -> out, joint_configs
# ---------- config: Python ----------
from compas_fab.robots import Configuration

values=[-0.785, -1.571, 1.571, -1.571, -1.571, -1.571]
#((-0.785, -1.571, 1.571, -1.571, -1.571, -1.571), (0, 0, 0, 0, 0, 0))
joint_configs = [Configuration.from_revolute_values(values)]
# ---------- end config ----------
calc_base_2 = PythonScript(poses=rec, pts_cad=pt_3, base_plane_init_guess=baseplane_01_2, calc=Toggle(False))  # -> out, pts_mtip_init_guess, pts_mtip_fit, base_plane_fit; inputs poses: list, pts_cad: list of Point3d, base_plane_init_guess: Plane
# ---------- calc_base_2: Python ----------
import ghpythonlib.components as ghcomp
import Rhino.Geometry as rg
from scriptcontext import sticky as st
from compas.geometry import Frame
import math as m
import sys
from compas.rpc import Proxy # for calling the numpy function in CPython

#icp_func = Proxy('ur_fabrication_control.optimisation.icp', python = 'C://Users//doerf//.conda//envs//rsrd_22//python.exe') #C:\Users\doerf\.conda\envs\rsrd_22
#print icp_func._python
#print poses

if len(poses):
    
    # get points from poses
    pts_mtip = [rg.Point3d(p[0], p[1], p[2]) for p in poses]
    
    T_W_R_init_guess = rg.Transform.PlaneToPlane(rg.Plane.WorldXY, base_plane_init_guess)
    pts_mtip_init_guess = [ghcomp.Transform(pt, T_W_R_init_guess) for pt in pts_mtip]
    
    # format Rhino transformation
    T_W_R_init_guess_flattened = [float(f) for f in T_W_R_init_guess.ToFloatArray(True)]
    T_W_R_init_guess_list = [T_W_R_init_guess_flattened[i:(i + 4)] for i in range(0, len(T_W_R_init_guess_flattened), 4)]  

    # format ptsA and ptsB
    dataB = [list(pt) for pt in pts_cad]
    dataA = [list(pt) for pt in pts_mtip]
    
    # call the function
    max_iterations = 100
    
    if calc:
        icp_func = Proxy('ur_fabrication_control.optimisation.icp', python = 'C://Users//lidet//anaconda3//envs//ur_fab//python.exe')
        #icp_func = Proxy('ur_fabrication_control.optimisation.icp', python = 'C://Users//doerf//.conda//envs//rsrd_22//python.exe') #C:\Users\doerf\.conda\envs\rsrd_22
        
        
        print icp_func._python

        transformation, distances = icp_func.icp(dataA, dataB, init_guess=T_W_R_init_guess_list, max_iterations=max_iterations, tolerance=0.000001)
        
        print "distances", distances
        
        # format result
        T = rg.Transform.Identity
        for i in range(4):
            for j in range(4):
                code = "T.M%i%i = %f" % (i, j, transformation[i][j])
                print code
                exec(code)
        #print T
        
        # now transform the points with the transformation calculated
        pts_mtip_fit = [ghcomp.Transform(pt, T) for pt in pts_mtip]
        base_plane_fit = ghcomp.Transform(rg.Plane.WorldXY, T)
        
        
        #f = Frame(base_plane_fit)
        #print f.get_pose_quaternion()
        
        # correct the zvalue
        #base_plane_fit = ghcomp.Transform(base_plane_fit, rg.Transform.Translation(0,0,-3))
# ---------- end calc_base_2 ----------
pln_6 = Plane(calc_base.base_plane)
pln_7 = Plane(calc_base_2.base_plane_fit)
pt_4 = Point(calc_base_2.pts_mtip_init_guess)
pt_5 = Point(calc_base_2.pts_mtip_fit)

init_guess_01 = Plane(Plane(origin=(43.66802394, 34.12290406, 1.164991481), x=(-0.975923335, 0.2181138332, 0), y=(-0.2181138332, -0.975923335, 0)))
init_guess_02 = Plane(Plane(origin=(43.763332, 34.171485, 1.102744), x=(-0.9749720173, 0.2217830039, 0.01555200028), y=(-0.2217233372, -0.9750941999, 0.00548298952)))
pts_01 = Point([<point referenced from the Rhino model> x4])
pt_6 = Point([Point(44.56076366, 34.65321673, 0.4500000004), Point(44.55807306, 34.45825075, 0.4500000004), Point(44.64946851, 34.73950519, 0.4500000004), Point(44.53852937, 34.85355172, 0.4500000004)])
baseplane_01_3 = Plane(Plane(origin=(43.763332, 34.171485, 1.102744), x=(-0.9749720173, 0.2217830039, 0.01555200028), y=(-0.2217233372, -0.9750941999, 0.00548298952)))
baseplane_02_2 = Plane(Plane(origin=(43.772352, 34.18155, 1.097462), x=(-0.9710950923, 0.2381860226, 0.01554800148), y=(-0.2380244931, -0.9711904748, 0.01154999452)))

# ----
# Stop
# 4b.
stop_6 = Button()  # disabled
stop_7 = PythonScript(stop=stop_6)  # disabled; same code as stop_4

move_configurations = Data([-0.7378762823, -1.645309655, 1.740348054, -0.3678008479, -0.3738495375, -0.1107411527])  # disabled
place_configurations = Data([-0.7378762823, -1.645309655, 1.740348054, -0.3678008479, -0.3738495375, -0.1107411527])  # disabled

# ----
# Set Digital Out
number_2 = Slider(7, range=0..10)  # disabled
value_2 = BooleanToggle(True)  # disabled
digital_out_3 = PythonScript(number=number_2, value=value_2)  # -> urscript; inputs number: Int32, value: Boolean; disabled; same code as digital_out
send_5 = Button()  # disabled
send_6 = GhPythonScript(urscript=digital_out_3, send=send_5)  # -> out; inputs send: Boolean; disabled; same code as send_2

# ----
# Get Pose Cartesian
get_3 = Button()  # disabled
pose_3 = PythonScript(get=get_3)  # -> pose_cartesian, frame_WCS, plane_WCS; disabled
# ---------- pose_3: Python ----------
from scriptcontext import sticky as st
from ur_fabrication_control.direct_control.common import get_current_pose_cartesian
from compas.geometry import Frame
from compas_ghpython import draw_frame

robot = st["robot"]

server_address = st["server_address"]
server_port = st["server_port"]
ur_port = st["ur_port"]
ur_ip = st["ur_ip"]


# retrieve the current tool frame in axis angle format
if robot.attached_tool:
    tool_angle_axis = list(robot.attached_tool.frame.point) + list(robot.attached_tool.frame.axis_angle_vector)
else:
    tool0_frame = Frame([0, 0, 0], [1, 0, 0], [0, 1, 0])
    tool_angle_axis = list(tool0_frame.point) + list(tool0_frame.axis_angle_vector)

print(tool_angle_axis)

guid = str(ghenv.Component.InstanceGuid)
pose_cartesian_key = "pose_cartesian" + guid


if get:
    st[pose_cartesian_key] = get_current_pose_cartesian(tool_angle_axis, server_address, server_port, ur_ip, ur_port, send=True)

if pose_cartesian_key not in st:
    pose_cartesian = []
else:
    pose_cartesian = st[pose_cartesian_key]

print(pose_cartesian)

# get frame and plane of the current pose cartesian in world coordinates for visualization
if pose_cartesian:
    frame_RCS = Frame.from_axis_angle_vector(axis_angle_vector=pose_cartesian[3:], point=pose_cartesian[:3])
    frame_WCS = robot.to_world_coordinates(frame_RCS)
    plane_WCS  = draw_frame(frame_WCS)
    print frame_RCS
# ---------- end pose_3 ----------
number_slider_4 = Slider(0.1, range=0..1)  # disabled
draw_4 = GhPythonScript(frames=pose_3.frame_WCS, scale=number_slider_4)  # -> P, V, W; inputs frames: list; disabled
# ---------- draw_4: Python ----------
from System.Drawing import Color
from compas_ghpython.utilities import draw_frame

red = Color.FromArgb(255, 0, 0)
green = Color.FromArgb(0, 255, 0)
blue = Color.FromArgb(0, 0, 255)

P = []
V = []
C = []

scale = float(scale)

for frame in frames:
    if not frame:
        continue
    plane = draw_frame(frame)
    P += [plane.Origin] * 3
    V.append(plane.XAxis * scale)
    V.append(plane.YAxis * scale)
    V.append(plane.ZAxis * scale)
    C += [red, green, blue]

W = 3
# ---------- end draw_4 ----------
vdisex = VectorDisplayEx(Point=draw_4.P, Vector=draw_4.V, Colour=RGB(0, 0, 0), Width=draw_4.W)  # disabled
panel_8 = Panel(pose_3.pose_cartesian)  # disabled

# ----
# Move Cartesian
add = Button()  # disabled
list_10 = ValueList({"send all positions": 0, "send only one position": 1, "from inverse": 2}, selected="from inverse")  # disabled
clear_2 = Button()  # disabled
idx_2 = Slider(0, range=0..100)  # disabled
crv_7 = Curve(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)  # disabled
hframes = HorizontalFrames(Curve=crv_7, Count=10)  # -> Frames, Parameters; disabled
rec_car = PythonScript(msg=pose_3.plane_WCS, rec=add, clear=clear_2)  # -> rec; disabled; same code as rec
item_2 = ListItem(List=hframes.Frames, Index=idx_2, Wrap=True)  # disabled
filter = StreamFilter(Gate=list_10, Stream0=hframes.Frames, Stream1=item_2, Stream2=rec_car)  # disabled
number_slider_5 = Slider(0.075, range=0..0.5)  # disabled
radius = Slider(0.5, range=0..0.5)  # disabled
movel = PythonScript(planes_WCS=filter, velocity=number_slider_5, radius=radius)  # -> urscript; inputs planes_WCS: list; disabled
# ---------- movel: Python ----------
import Rhino.Geometry as rg
from compas.geometry import Frame
from compas.geometry import Transformation, Rotation
from compas_ghpython import draw_frame
from compas_fab.robots import robot
from ur_fabrication_control import direct_control 
import math

from scriptcontext import sticky as st
from ur_fabrication_control.direct_control import URScript

robot = st["robot"]

# retrieve the current tool frame in axis angle format
if robot.attached_tool:
    tool_angle_axis = list(robot.attached_tool.frame.point) + list(robot.attached_tool.frame.axis_angle_vector)
else:
    tool0_frame = Frame([0, 0, 0], [1, 0, 0], [0, 1, 0])
    tool_angle_axis = list(tool0_frame.point) + list(tool0_frame.axis_angle_vector)

frames_RCS = []
for plane_WCS in planes_WCS:
    frame_WCS = Frame(plane_WCS.Origin, plane_WCS.XAxis, plane_WCS.YAxis)
    frame_RCS = robot.to_local_coordinates(frame_WCS)
    frames_RCS.append(frame_RCS)

urscript = URScript()
urscript.start()
urscript.moves_linear(frames_RCS, velocity, radius)
urscript.end()

urscript = urscript.generate()

print(urscript)
# ---------- end movel ----------
send_7 = Button()  # disabled
send_8 = GhPythonScript(urscript=movel, send=send_7)  # -> out; inputs send: Boolean; disabled; same code as send_2

# ----
# Move Process
list_11 = ValueList({"send all positions": 0, "send only one position": 1, "from inverse": 2}, selected="from inverse")  # disabled
idx_3 = Slider(0, range=0..100)  # disabled
crv_8 = Curve(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)  # disabled
hframes_2 = HorizontalFrames(Curve=crv_8, Count=10)  # -> Frames, Parameters; disabled
item_3 = ListItem(List=hframes_2.Frames, Index=idx_3, Wrap=True)  # disabled
filter_2 = StreamFilter(Gate=list_11, Stream0=hframes_2.Frames, Stream1=item_3, Stream2=rec_car)  # disabled
number_slider_6 = Slider(0.075, range=0..0.5)  # disabled
radius_2 = Slider(0.5, range=0..0.5)  # disabled
movep = PythonScript(planes_WCS=filter_2, velocity=number_slider_6, radius=radius_2)  # -> urscript; inputs planes_WCS: list; disabled
# ---------- movep: Python ----------
import Rhino.Geometry as rg
from compas.geometry import Frame
from compas.geometry import Transformation, Rotation
from compas_ghpython import draw_frame
from compas_fab.robots import robot
from ur_fabrication_control import direct_control 
import math

from scriptcontext import sticky as st
from ur_fabrication_control.direct_control import URScript

robot = st["robot"]

# retrieve the current tool frame in axis angle format
if robot.attached_tool:
    tool_angle_axis = list(robot.attached_tool.frame.point) + list(robot.attached_tool.frame.axis_angle_vector)
else:
    tool0_frame = Frame([0, 0, 0], [1, 0, 0], [0, 1, 0])
    tool_angle_axis = list(tool0_frame.point) + list(tool0_frame.axis_angle_vector)

frames_RCS = []
for plane_WCS in planes_WCS:
    frame_WCS = Frame(plane_WCS.Origin, plane_WCS.XAxis, plane_WCS.YAxis)
    frame_RCS = robot.to_local_coordinates(frame_WCS)
    frames_RCS.append(frame_RCS)

urscript = URScript()
urscript.start()
urscript.moves_process(frames_RCS, velocity, radius)
urscript.end()

urscript = urscript.generate()

print(urscript)
# ---------- end movep ----------
send_9 = Button()  # disabled
send_10 = GhPythonScript(urscript=movep, send=send_9)  # -> out; inputs send: Boolean; disabled; same code as send_2

# ----
# Get Pose Joint
get_4 = Button()  # disabled
pose_4 = PythonScript(get=get_4)  # -> configuration, pose_joints; disabled
# ---------- pose_4: Python ----------
from scriptcontext import sticky as st
from ur_fabrication_control.direct_control.common import get_current_pose_joints
from compas_fab.robots import Configuration


robot = st["robot"]

server_address = st["server_address"]
server_port = st["server_port"]
ur_port = st["ur_port"]
ur_ip = st["ur_ip"]


guid = str(ghenv.Component.InstanceGuid)
pose_joints_key = "pose_joints" + guid


# send script to the robot to receive the current joint configuration
if get:
    st[pose_joints_key] = get_current_pose_joints(server_address, server_port, ur_ip, ur_port, send=True)

if pose_joints_key not in st:
    configuration = Configuration.from_revolute_values([0,0,0,0,0,0])
else:
    configuration = Configuration.from_revolute_values(st[pose_joints_key])

pose_joints = configuration.values
# ---------- end pose_4 ----------
panel_9 = Panel(pose_4.pose_joints)  # disabled

# ----
# Calculate Basis - 3-Point Method
# Measure basis:
# 1. Clear the recorded poses
# 2. Move robot to origin and press "get pose"
# 3. Move robot to point in positive x-axis and press "get pose"
# 4. Move robot to an other point in your basis and press "get pose"
# (The further away these positions are, the better)
# 
# 5. Alternatively change the order in the component calc base
# 6. Copy output into base component (TODO: check if it has to be inverted)
list_12 = ValueList({"o, pos.x-axis, xy pl": 0, "o, pos.y-axis, xy pl": 1}, selected="o, pos.x-axis, xy pl")  # disabled
clear_3 = Button()  # disabled
rec_2 = PythonScript(msg=pose_3.pose_cartesian, rec=get_3, clear=clear_3)  # -> rec; inputs msg: list; disabled; same code as rec
calc_base_3 = PythonScript(poses=rec_2, input_type=list_12)  # -> out, base_plane; inputs poses: list; disabled; same code as calc_base
panel_10 = Panel(rec_2)  # disabled
panel_11 = Panel(calc_base_3.out)  # disabled

# ----
# Direct UR Control
config_2 = GhPythonScript()  # -> out, joint_configs; disabled
# ---------- config_2: Python ----------
from compas_fab.robots import Configuration

values=[-0.737876, -1.64531, 1.740348, -0.367801, -0.37385, -0.110741]
joint_configs = [Configuration.from_revolute_values(values)]
# ---------- end config_2 ----------
pln_8 = Plane(calc_base_3.base_plane)  # disabled

# ----
# Move Joints
idx_4 = Slider(0, range=0..100)  # disabled
clear_4 = Button()  # disabled
add_2 = Button()  # disabled
list_13 = ValueList({"send all positions": 0, "send only one position": 1, "from inverse": 2}, selected="from inverse")  # disabled
rec_joints = PythonScript(msg=pose_4.configuration, rec=add_2, clear=clear_4)  # -> rec; disabled
# ---------- rec_joints: Python ----------
from scriptcontext import sticky as st

guid = str(ghenv.Component.InstanceGuid)
recorded_key =  "recorded_" + guid
just_cleared_key = "just_cleared_" + guid


if recorded_key not in st:
    st[recorded_key] = []

if just_cleared_key not in st:
    st[just_cleared_key] = False

if clear:
    st[recorded_key] = []
    st[just_cleared_key] = True
else:
    if msg != [None] and not st[just_cleared_key] and rec:
        st[recorded_key].append(msg)
    st[just_cleared_key] = False
        


rec = st[recorded_key]

print rec
# ---------- end rec_joints ----------
item_4 = ListItem(List=config_2.joint_configs, Index=idx_4, Wrap=True)  # disabled
filter_3 = StreamFilter(Gate=list_13, Stream0=config_2.joint_configs, Stream1=item_4, Stream2=rec_joints)  # disabled
number_slider_7 = Slider(0.032, range=0..0.5)  # disabled
movej = PythonScript(joint_configurations=filter_3, velocity=number_slider_7)  # -> urscript, values; inputs joint_configurations: list; disabled
# ---------- movej: Python ----------
from ur_fabrication_control.direct_control import URScript
import math


"""
for c in joint_configurations:
    for i,v in enumerate(c.values):
        #print v
        if v>math.pi:
            v-=2*math.pi
        if v<-math.pi:
            v+=2*math.pi
        c.values[i]=v
print joint_configurations
values = joint_configurations[0].values
print([math.degrees(v) for v in values])
"""

#joint_config = ["movej({}, v={})".format(c.values, velocity/10) for c in joint_configurations]

urscript = URScript()
urscript.start()
for jc in joint_configurations:
    urscript.move_joint(jc, velocity)
urscript.end()

urscript = urscript.generate()

print(urscript)
# ---------- end movej ----------
send_11 = Button()  # disabled
send_12 = GhPythonScript(urscript=movej.urscript, send=send_11)  # -> out; inputs send: Boolean; disabled; same code as send_2

# ----
# Calculate Basis - Point fitting method via RPC
toggle = BooleanToggle(False)  # disabled
plane_init_guess = Plane(Plane(origin=(0, 0, 0), x=(0, -1, 0), y=(1, 0, 0)))  # disabled
plane_01_2 = Plane(Plane(origin=(43.66802394, 34.12290406, 1.164991481), x=(-0.975923335, 0.2181138332, 0), y=(-0.2181138332, -0.975923335, 0)))  # disabled
pt_7 = Point([<point referenced from the Rhino model> x4])  # disabled
calc_base_4 = PythonScript(poses=rec_2, pts_cad=pt_7, base_plane_init_guess=plane_01_2, calc=toggle)  # -> out, pts_mtip_init_guess, pts_mtip_fit, base_plane_fit; inputs poses: list, pts_cad: list of Point3d, base_plane_init_guess: Plane; disabled
# ---------- calc_base_4: Python ----------
import ghpythonlib.components as ghcomp
import Rhino.Geometry as rg
from scriptcontext import sticky as st
from compas.geometry import Frame
import math as m
import sys
from compas.rpc import Proxy # for calling the numpy function in CPython


if len(poses):
    
    # get points from poses
    pts_mtip = [rg.Point3d(p[0], p[1], p[2]) for p in poses]
    
    T_W_R_init_guess = rg.Transform.PlaneToPlane(rg.Plane.WorldXY, base_plane_init_guess)
    pts_mtip_init_guess = [ghcomp.Transform(pt, T_W_R_init_guess) for pt in pts_mtip]
    
    # format Rhino transformation
    T_W_R_init_guess_flattened = [float(f) for f in T_W_R_init_guess.ToFloatArray(True)]
    T_W_R_init_guess_list = [T_W_R_init_guess_flattened[i:(i + 4)] for i in range(0, len(T_W_R_init_guess_flattened), 4)]  

    # format ptsA and ptsB
    dataB = [list(pt) for pt in pts_cad]
    dataA = [list(pt) for pt in pts_mtip]
    
    # call the function
    max_iterations = 100
    
    if calc:
        icp_func = Proxy('ur_fabrication_control.optimisation.icp', python = 'C://Users//lidet//anaconda3//envs//ur_fab//python.exe')
        #icp_func = Proxy('ur_fabrication_control.optimisation.icp', python = 'C://Users//kathrind//anaconda3//envs//ur_fab//python.exe')
        
        print icp_func._python

        transformation, distances = icp_func.icp(dataA, dataB, init_guess=T_W_R_init_guess_list, max_iterations=max_iterations, tolerance=0.000001)
        
        print "distances", distances
        
        # format result
        T = rg.Transform.Identity
        for i in range(4):
            for j in range(4):
                code = "T.M%i%i = %f" % (i, j, transformation[i][j])
                print code
                exec(code)
        #print T
        
        # now transform the points with the transformation calculated
        pts_mtip_fit = [ghcomp.Transform(pt, T) for pt in pts_mtip]
        base_plane_fit = ghcomp.Transform(rg.Plane.WorldXY, T)
        
        
        #f = Frame(base_plane_fit)
        #print f.get_pose_quaternion()
        
        # correct the zvalue
        #base_plane_fit = ghcomp.Transform(base_plane_fit, rg.Transform.Translation(0,0,-3))
# ---------- end calc_base_4 ----------
pt_8 = Point(calc_base_4.pts_mtip_init_guess)  # disabled
pt_9 = Point(calc_base_4.pts_mtip_fit)  # disabled
pln_9 = Plane(calc_base_4.base_plane_fit)  # disabled

# ---- group: ROS client
list_14 = ValueList({"local": 0, "linux computer": 1}, selected="local")

# ----
connect_2 = PythonScript(ip=list_14, connect=connect, disconnect=disconnect)  # -> out, ros_client
# ---------- connect_2: Python ----------
import sys
import scriptcontext as sc
from compas_fab.backends import RosClient

key = 'rosclient_%s' % str(ghenv.Component.InstanceGuid)
previous_client = sc.sticky.get(key, None)

if previous_client and (connect or disconnect):
    previous_client.close()

if connect:
    if ip == 0: #local, own laptop
        ros_client = RosClient('127.0.0.1', 9090)
    elif ip == 1: # linux computer
        ros_client = RosClient('192.168.0.41', 9090)
    sc.sticky[key] = ros_client
    ros_client.run(5)

ros_client = sc.sticky.get(key, None)
print('ROS connected: {}'.format(ros_client.is_connected if ros_client else 'False'))
# ---------- end connect_2 ----------

# ---- group: ROS client (continued)
is_connected = Panel(connect_2.out)
ros_client = Data(connect_2.ros_client)

# ----
# Robot
units = ValueList({"m": 1, "cm": 100, "mm": 1000}, selected="m")
load = Button()
create = PythonScript(load=load, loaders=py_3.loaders, urdf_filename=py_3.urdf_filename, srdf_filename=py_3.srdf_filename, scale_factor=units)  # -> out, robot; inputs load: Boolean, loaders: list
# ---------- create: Python ----------
import os
from scriptcontext import sticky as st

import compas

from compas.robots import RobotModel
from compas.robots import LocalPackageMeshLoader

#from compas_fab.robots import Robot
from robot_see_robot_do.robot import Robot
from compas_fab.robots import RobotSemantics

from compas_fab.ghpython import RobotArtist

compas.PRECISION = '12f'

# store robot in component
guid = str(ghenv.Component.InstanceGuid)
robot_key = "robot_" + guid

if robot_key not in st:
    st[robot_key] = None

print loaders
if load:
    model = RobotModel.from_urdf_file(urdf_filename)
    
    model.load_geometry(*loaders)
    artist = RobotArtist(model)
    semantics = RobotSemantics.from_srdf_file(srdf_filename, model)
    robot = Robot(model, artist, semantics, client=None)

    
    st[robot_key] = robot

robot = st[robot_key]


if robot:
    robot.scale(scale_factor)
# ---------- end create ----------
set = PythonScript(robot=create.robot, client=ros_client)  # -> robot
# ---------- set: Python ----------
if robot and client:
    robot.client = client
# ---------- end set ----------
robot = Data(set)

# ----
# Base
x_axis_4 = Curve(<curve referenced from the Rhino model>)
y_axis_4 = Curve(<curve referenced from the Rhino model>)
x_axis_5 = Curve(<curve referenced from the Rhino model>)
y_axis_5 = Curve(<curve referenced from the Rhino model>)
plane = PythonScript(plane_axes=[x_axis_4, y_axis_4])  # -> plane; inputs plane_axes: list of Curve; same code as vorne
plane_2 = PythonScript(plane_axes=[x_axis_5, y_axis_5])  # -> plane; inputs plane_axes: list of Curve; same code as vorne
breps = Geometry([<mesh referenced from the Rhino model> x22, <brep referenced from the Rhino model> x82])
base = PythonScript(base_plane=baseplane_02, pickup_plane=plane_2)  # -> base_frame, picking_frame
# ---------- base: Python ----------
from compas.geometry import Frame
from compas.geometry import Transformation, Rotation
from compas_ghpython import draw_frame
import math
import Rhino.Geometry as rg



base_frame = Frame(base_plane.Origin, base_plane.XAxis, base_plane.YAxis)

picking_frame = Frame(pickup_plane.Origin, pickup_plane.XAxis, pickup_plane.YAxis)
# ---------- end base ----------
py_6 = PythonScript(
    robot=robot,
    origin_frame=base.base_frame,
    base_geometry=breps,
    picking_frame=base.picking_frame,
    set_to_origin_frame=Toggle(True))  # -> a, picking_plane_WCF; inputs base_geometry: list, set_to_origin_frame: Boolean
# ---------- py_6: Python ----------
from compas_ghpython import draw_frame
from compas.geometry import Frame, Point, Vector, Transformation
from compas.datastructures import Mesh
from compas_rhino.geometry import RhinoMesh
from compas_fab.robots import CollisionMesh



if set_to_origin_frame == True:
    robot.set_origin_frame(origin_frame)
else:
    robot.set_origin_frame(Frame.worldXY())

if len(base_geometry):
    robot.set_base_geometry(base_geometry)

if picking_frame:
    picking_frame_WCF = robot.to_world_coordinates_origin(picking_frame)
    robot.set_picking_frame(picking_frame_WCF)
    picking_plane_WCF = draw_frame(picking_frame_WCF)
# ---------- end py_6 ----------

# ----
# Tool
panel_12 = Panel("Attach a custom tool")
list_15 = ValueList({"measurement_tool": 0, "area_gripper": 1}, selected="area_gripper")
show_7 = BooleanToggle(False)
python_5 = PythonScript(data_path=py_2, tool=list_15, show=show_7)  # -> tool, M, compas_mesh
# ---------- python_5: Python ----------
import os, math
from compas.geometry import Frame, Rotation
from compas.datastructures import Mesh
from compas_ghpython.artists import MeshArtist
from compas_fab.robots import Tool

tolerance = 0


if tool == 0:
    filename = 'measurement_tool_zaxis.stl'
    ee_frame = Frame([0, 0, 0.109], [1, 0, 0], [0, 1, 0])

elif tool == 1:
    filename = 'area_gripper_zaxis.stl'
    ee_frame = Frame([0, 0, 0.10219 + tolerance], [0, 1, 0], [-1, 0, 0])

data_path = os.path.join(data_path, "tool_geometry")
fullfilename = os.path.join(data_path, filename)
print fullfilename

ee_mesh = Mesh.from_stl(fullfilename)

#R = Rotation.from_axis_and_angle(ee_frame.zaxis, math.radians(180), point=ee_frame.point)
#ee_frame.transform(R)

if show:
    artist = MeshArtist(ee_mesh)
    M = artist.draw()

tool = Tool(ee_mesh, ee_frame)
compas_mesh = ee_mesh
# ---------- end python_5 ----------
py_7 = PythonScript(robot=robot, tool=python_5.tool, attach=Toggle(True))  # -> a
# ---------- py_7: Python ----------
if attach:
    robot.attach_tool(tool)
else:
    robot.detach_tool()
# ---------- end py_7 ----------

scene = PythonScript(robot=robot)  # -> scene
# ---------- scene: Python ----------
from scriptcontext import sticky as st

from compas_fab.robots import PlanningScene

# store scene in component
guid = str(ghenv.Component.InstanceGuid)
scene_key = "scene_" + guid

if scene_key not in st:
    st[scene_key] = None

if robot:
    scene = PlanningScene(robot)
    scene.cm = []
    scene.acm = []
    scene.bcm = None
    st[scene_key] = scene

scene = st[scene_key]
# ---------- end scene ----------

panel_13 = Panel("base collision mesh")
remove = Button()
scale = BooleanToggle(False)
add_3 = Button()
collision = PythonScript(robot=robot, scene=scene, compas_mesh=mesh_2, scale=scale, id="base_cm", add=add_3, remove=remove)  # -> out, a
# ---------- collision: Python ----------
from compas_fab.robots import CollisionMesh


cm = CollisionMesh(compas_mesh, id)


if scene:
    if add:
        scene.add_collision_mesh(cm, scale)
        scene.bcm = cm
    if remove:
        scene.remove_collision_mesh(id)
        scene.bcm = None
# ---------- end collision ----------
panel_14 = Panel(collision.out)

info = PythonScript(robot=robot)  # -> out, main_group_name
# ---------- info: Python ----------
if robot:
    robot.info()
    main_group_name = robot.main_group_name
# ---------- end info ----------
panel_15 = Panel(info.out)

server_ip = ValueList({"192.168.0.49", "127.0.0.1", "192.168.10.111"}, selected="192.168.0.49")
server_port = ValueList({"50000", "50002", "50003", "50004", "50005", "30003"}, selected="50004")
ur_port = ValueList({"30002", "30001"}, selected="30002")
globals = PythonScript(server_ip=server_ip, server_port=server_port, ur_ip=ur_ip, ur_port=ur_port, robot=robot, clear=Button())  # inputs server_port: Int32
# ---------- globals: Python ----------
from scriptcontext import sticky as st

st["server_ip"] = server_ip
st["server_port"] = server_port



st["ur_ip"] = ur_ip
    
st["ur_port"] = ur_port

st["robot"] = robot



if clear:
    st.clear()
# ---------- end globals ----------

# ----
# Settings
python_6 = PythonScript(
    robot=robot,
    element0=elem_def_2.elem_full,
    data_path=py_4.DATA,
    safelevel_vector=safelevel_vector,
    tolerance_vector=tolerance_vector,
    collision_meshes=mesh_2,
    collision_names="base_cm",
    current_element=element)  # -> element_acm, picking_configuration, picking_frame, picking_plane, safelevel_picking_frame, safelevel_target_frame, target_frame, picking_element_mesh; inputs collision_meshes: list, collision_names: list; disabled
# ---------- python_6: Python ----------
import os
import json

from compas.geometry import Frame
from compas.geometry import Vector, Point
from compas_fab.robots import Configuration
from compas.geometry import Transformation, Translation
from compas.artists import Artist
from compas_fab.robots import CollisionMesh, AttachedCollisionMesh

if robot:

    settings_file = os.path.join(data_path, "settings.json")
    
    # convert
    tolerance_vector = Vector(*list(tolerance_vector))
    safelevel_vector = Vector(*list(safelevel_vector))
    
    # create attached collision object
    element0_tool0 = element0.copy()
    T = Transformation.from_frame_to_frame(element0_tool0._tool_frame, robot.attached_tool.frame)
    element0_tool0.transform(T)
    ee_link_name = robot.get_end_effector_link_name()
    element_acm = AttachedCollisionMesh(CollisionMesh(element0_tool0.mesh, 'brick'), ee_link_name)
    
    #picking_configuration = Configuration.from_revolute_values((-1.765, -1.311, 2.365, 3.658, -1.571, -3.336))
    picking_configuration = Configuration((-2.777, -1.846, 2.502, -2.263, -1.651, -3.564), (0, 0, 0, 0, 0, 0), ('shoulder_pan_joint', 'shoulder_lift_joint', 'elbow_joint', 'wrist_1_joint', 'wrist_2_joint', 'wrist_3_joint'))


    #picking_frame = Frame(list(picking_location), Vector(1, 0, 0), Vector(0, 1, 0))
    picking_frame = robot.get_picking_frame()
    T1 = Translation.from_vector(picking_frame.zaxis*0.01)
    picking_frame.transform(T1)
    
    data = {}
    data['picking_configuration'] = picking_configuration.data
    data['picking_frame'] = picking_frame.data
    data['tolerance_vector'] = tolerance_vector.data
    data['safelevel_vector'] = safelevel_vector.data
    data['element0'] = element0.data
    data['collision_meshes'] = [mesh.data for mesh in collision_meshes]
    data['collision_names'] = list(collision_names)
    
    with open(settings_file, 'w') as f:
        json.dump(data, f)
    
    safelevel_picking_frame = picking_frame.copy()
    brick_at_picking_frame = element0.transformed(Transformation.from_frame_to_frame(element0._tool_frame, picking_frame))
    picking_element_mesh = Artist(brick_at_picking_frame.mesh).draw()
    
    picking_frame.point += tolerance_vector
    safelevel_picking_frame.point += safelevel_vector
    
    target_frame = current_element._tool_frame.copy()
    target_frame.point += tolerance_vector
    safelevel_target_frame = target_frame.copy()
    safelevel_target_frame.point += safelevel_vector
    
    picking_plane = Artist(picking_frame).draw()
# ---------- end python_6 ----------
colour_swatch_2 = ColourSwatch(SwatchColor=RGBA(201, 145, 71, 218))  # disabled
preview_6 = CustomPreview(Geometry=python_6.picking_element_mesh, Shader=colour_swatch_2)  # disabled
number_slider_8 = Slider(0.05, range=0..1)  # disabled
draw_5 = GhPythonScript(frames=[python_6.picking_frame, python_6.safelevel_picking_frame], scale=number_slider_8)  # -> P, V, C, W; inputs frames: list; disabled; same code as draw_4
draw_6 = GhPythonScript(frames=[python_6.safelevel_target_frame, python_6.target_frame], scale=number_slider_8)  # -> P, V, C, W; inputs frames: list; disabled; same code as draw_4
vdisex_2 = VectorDisplayEx(Point=draw_5.P, Vector=draw_5.V, Colour=draw_5.C, Width=draw_5.W)  # disabled
vdisex_3 = VectorDisplayEx(Point=draw_6.P, Vector=draw_6.V, Colour=draw_6.C, Width=draw_6.W)  # disabled

# ----
# Fabrication Settings
python_7 = GhPythonScript(robot=robot, current_tool_plane=pln_4)  # -> out, picking_configuration, free_move_start_config, picking_plane_WCF, placing_plane_WCF, picking_plane_safe_WCF, placing_plane_safe_WCF
# ---------- python_7: Python ----------
import math
from compas.geometry import Frame, Transformation
from compas_ghpython import draw_frame
from compas_fab.robots import Configuration
import Rhino.Geometry as rg

if current_tool_plane:
    picking_frame_WCF = robot.get_picking_frame()
    picking_plane_WCF = draw_frame(picking_frame_WCF)
    picking_plane_WCF.Translate(rg.Vector3d.ZAxis*0.00)
    #picking_plane_WCF.Translate(rg.Vector3d.ZAxis*0.05)

    placing_plane_WCF = current_tool_plane
    placing_plane_WCF.Translate(placing_plane_WCF.ZAxis*0.00)
    
    picking_plane_safe_WCF = rg.Plane(picking_plane_WCF)
    R = rg.Transform.Rotation(math.radians(5.0), picking_plane_WCF.XAxis, picking_plane_WCF.Origin)
    picking_plane_safe_WCF.Transform(R)
    picking_plane_safe_WCF.Translate(rg.Vector3d.ZAxis*0.4)
    
    placing_plane_safe_WCF = rg.Plane(placing_plane_WCF)
    placing_plane_safe_WCF.Translate(placing_plane_WCF.ZAxis*-0.1)
    #placing_plane_safe_WCF.Translate(rg.Vector3d.ZAxis*0.30)
    
    move_plane_safe_WCF = rg.Plane(placing_plane_WCF)
    move_plane_safe_WCF.Translate(rg.Vector3d.ZAxis*0.30)
   
    picking_configuration = Configuration((-2.88848, -1.7996, 2.49637, -2.26707, -1.56533, -0.528621), (0, 0, 0, 0, 0, 0), ('shoulder_pan_joint', 'shoulder_lift_joint', 'elbow_joint', 'wrist_1_joint', 'wrist_2_joint', 'wrist_3_joint'))
    
    
    free_move_start_config = Configuration((0.262, -1.798, 2.496, -2.269, -1.571, -2.094), (0, 0, 0, 0, 0, 0))
# ---------- end python_7 ----------

pln_10 = Plane(python_7.picking_plane_safe_WCF)

# ----
# 3.
# Configuration
main_planning_group = Text(info.main_group_name)

# ---- group: forward kinematics
a1 = Slider(15, range=-360..360)
a5 = Slider(-90, range=-360..360)
a2 = Slider(-103, range=-360..360)
a3 = Slider(143, range=-360..360)
a4 = Slider(-130, range=-360..360)
a6 = Slider(-120, range=-360..360)
jp = GhPythonScript()  # -> joint_positions
# ---------- jp: Python ----------
import math
from compas_fab.robots import Configuration

joint_positions = [0,-90,90,0,90,0]
joint_positions = [-180,-90,90,-90,-90,-90]
joint_positions = [math.radians(a) for a in joint_positions]
#joint_positions = [-3.136, -0.328, -1.218, 3.129, 0.852, 0.008]
joint_positions = [-2.316, -1.814, 2.209, -1.965, -1.571, 2.396]
joint_positions = [-2.356, -1.571, 1.571, -1.571, -1.571, -1.571]
#joint_positions = [5.2996800000000004, -1.8766700000000001, -2.4221200000000001, -0.39607100000000001, 1.54617, 0.074741500000000002]
joint_positions = [-2.88848, -1.7996, 2.49637, -2.26707, -1.56533, -0.528621]


#joint_positions = [0] * 6

print joint_positions
# ---------- end jp ----------
forward_kinematics = PythonScript(robot=robot, set_joint_positions=Button(), joint_positions=jp, a1=a1, a2=a2, a3=a3, a4=a4, a5=a5, a6=a6)  # -> full_configuration; inputs joint_positions: list
# ---------- forward_kinematics: Python ----------
import math
import Grasshopper
from compas.robots import Joint
from compas_fab.robots import Configuration

if set_joint_positions:

    j = 0
    for i in range(ghenv.Component.Params.Input.Count):
        nslider = ghenv.Component.Params.Input[i].Sources[0]
        if nslider.GetType() == Grasshopper.Kernel.Special.GH_NumberSlider:
            nslider.TrySetSliderValue(math.degrees(joint_positions[j]))
            j += 1

if robot:
    joint_positions = [a1, a2, a3, a4, a5, a6]
    joint_types = robot.get_configurable_joint_types()
    for i, joint_type in enumerate(joint_types):
        if joint_type == Joint.REVOLUTE:
            joint_positions[i] = math.radians(joint_positions[i])
    full_configuration = Configuration(joint_positions, joint_types)


print(full_configuration)
# ---------- end forward_kinematics ----------

# ----
filter_4 = StreamFilter(
    Gate=list_8,
    Stream0=python_7.picking_plane_safe_WCF,
    Stream1=python_7.placing_plane_safe_WCF,
    Stream2=python_7.picking_plane_WCF,
    Stream3=python_7.placing_plane_WCF)

# ---- group: inverse kinematics
py_8 = PythonScript()  # -> configuration
# ---------- py_8: Python ----------
from compas_fab.robots import Configuration

if robot:
    types = robot.get_configurable_joint_types()
    values = [0] * len(types)
    configuration = Configuration(values, types)
    print configuration
    print robot.get_configurable_joint_names()
# ---------- end py_8 ----------
start_configuration = Data(python_7.picking_configuration)
list_16 = ValueList({"0", "1"}, selected="0")
filter_5 = StreamFilter(Gate=list_16, Stream0=start_configuration, Stream1=py_8)
inverse = PythonScript(robot=robot, group=main_planning_group, start_configuration=filter_5, plane=filter_4, compute=Toggle(True))  # -> out, configuration
# ---------- inverse: Python ----------
import scriptcontext as sc
import logging

from compas.geometry import Frame

from compas_fab.backends.ros import RosError
from compas_fab.robots import Configuration

LOGGER = logging.getLogger('roslibpy')

frame_WCF = Frame(plane.Origin, plane.XAxis, plane.YAxis)
frame_OCF = robot.to_local_coordinates_origin(frame_WCF) # express within the robot frame
if robot.attached_tool:
    frame_OCF = robot.from_tcf_to_t0cf([frame_OCF])[0]

if robot:
    if robot.client and compute:
        if robot.client.is_connected:
            configuration = robot.inverse_kinematics(frame_OCF, start_configuration, group)
            print(configuration)
        else:
            print("Robot is not connected")
# ---------- end inverse ----------
panel_16 = Panel(inverse.out)

number_3 = Number(-1)
select_configuration = Slider(2, range=0..7)
Y = UnitY(Factor=number_3)
pt_10 = Point(Point(43.92655089, 33.23237849, 1.16434636))
pl = ConstructPlane(Origin=pt_10, XAxis=Vector(1, 0, 0), YAxis=Y)
inverse_2 = PythonScript(robot=robot, plane_WCS=filter_4, idx=select_configuration)  # -> out, configuration; inputs plane_WCS: Plane, idx: Int32
# ---------- inverse_2: Python ----------
import Rhino.Geometry as rg
import math
from compas.geometry import Frame, Transformation, Rotation
from compas_fab.robots import Configuration
from ur_fabrication_control.kinematics.ur_kinematics import inverse_kinematics
from ur_fabrication_control.kinematics.ur_params import ur_params
from compas_ghpython import draw_frame


#tcp_WCS = Frame(plane_WCS.Origin, plane_WCS.XAxis, plane_WCS.YAxis)

frame_WCF = Frame(plane_WCS.Origin, plane_WCS.XAxis, plane_WCS.YAxis)
frame_OCF = robot.to_local_coordinates_origin(frame_WCF) # express within the robot frame
if robot.attached_tool:
    frame_OCF = robot.from_tcf_to_t0cf([frame_OCF])[0]

## transform frame to robot coordinate system
#tcp_RCS = robot.to_local_coordinates(frame_OCF)
#tool0_RCS = robot.from_tcf_to_t0cf([tcp_RCS])[0]

# calculate solutions to frame
ur_params = ur_params[robot.name] # get the parameters according to the robot model
solutions = inverse_kinematics(frame_OCF, ur_params)

if not len(solutions):
    joint_values = [0,0,0,0,0,0]
    configuration = Configuration.from_revolute_values(joint_values)
else:
    joint_values = solutions[idx]
    #print joint_values
    
    ### ***** HACK ***** ##### TODO: CHECK!!!
    for i, v in enumerate(joint_values):
        if v > math.pi:
            v -= 2*math.pi
        if v < -math.pi:
            v += 2*math.pi
        joint_values[i] = v
    ### ***** HACK ***** ##### TODO: CHECK!!!
    
    configuration = [Configuration.from_revolute_values(joint_values)]

print(configuration)
# ---------- end inverse_2 ----------

# ---- group: forward kinematics
forward = PythonScript(robot=robot, group=main_planning_group, full_configuration=forward_kinematics)  # -> out, frame_WCF
# ---------- forward: Python ----------
"""Calculate the robot's forward kinematic.
    Inputs:
        robot: :class:`compas_fab.robots.Robot`
            The robot.
        group: str, optional
            The planning group used for calculation. Defaults to the robot's
            main planning group.
        full_configuration : :class:`compas_fab.robots.Configuration`
            The full configuration to calculate the forward kinematic for. If no
            full configuration is passed, the zero-joint state for the other
            configurable joints is assumed.
    Output:
        :class:`Frame`
            The frame in the world coordinate frame (WCF).
"""
from __future__ import print_function
import logging

import compas_fab
print(compas_fab.__version__)

LOGGER = logging.getLogger('roslibpy')

if robot and robot.client and full_configuration:
    if robot.client.is_connected:
        frame_WCF = robot.forward_kinematics(full_configuration, group, options={'backend':'model'})
        #frame_WCF = robot.forward_kinematics(full_configuration, group, backend='model')
        print(frame_WCF)
    else:
        print("Robot is not connected")
# ---------- end forward ----------
panel_17 = Panel(forward.out)

# ----
# Move Cartesian
list_17 = ValueList({"send all positions": 0, "send only one position": 1, "from inverse": 2}, selected="send all positions")  # disabled
crv_9 = Curve(<curve referenced from the Rhino model>)  # disabled
add_4 = Button()  # disabled
clear_5 = Button()  # disabled
idx_5 = Slider(0, range=0..100)  # disabled
hframes_3 = HorizontalFrames(Curve=crv_9, Count=10)  # -> Frames, Parameters; disabled
rec_car_2 = PythonScript(rec=add_4, clear=clear_5)  # -> rec; disabled; same code as rec
item_5 = ListItem(List=python_7.placing_plane_safe_WCF, Index=idx_5, Wrap=True)  # disabled
filter_6 = StreamFilter(Gate=list_17, Stream0=python_7.placing_plane_WCF, Stream1=item_5, Stream2=rec_car_2)  # disabled
number_slider_9 = Slider(0.018, range=0..0.5)  # disabled
radius_3 = Slider(0, range=0..0.5)  # disabled
movel_2 = PythonScript(planes_WCS=filter_6, velocity=number_slider_9, radius=radius_3)  # -> urscript; inputs planes_WCS: list; disabled
# ---------- movel_2: Python ----------
import Rhino.Geometry as rg
from compas.geometry import Frame
from compas.geometry import Transformation, Rotation
from compas_ghpython import draw_frame
from compas_fab.robots import robot
from ur_fabrication_control import direct_control 
import math

from scriptcontext import sticky as st
from ur_fabrication_control.direct_control import URScript

robot = st["robot"]

# retrieve the current tool frame in axis angle format
if robot.attached_tool:
    tool_angle_axis = list(robot.attached_tool.frame.point) + list(robot.attached_tool.frame.axis_angle_vector)
else:
    tool0_frame = Frame([0, 0, 0], [1, 0, 0], [0, 1, 0])
    tool_angle_axis = list(tool0_frame.point) + list(tool0_frame.axis_angle_vector)

frames_RCS = []
for plane_WCS in planes_WCS:
    frame_WCS = Frame(plane_WCS.Origin, plane_WCS.XAxis, plane_WCS.YAxis)
    frame_OCF = robot.to_local_coordinates_origin(frame_WCS)
    #frame_RCS = robot.to_local_coordinates(frame_OCF)
    frames_RCS.append(frame_OCF)

urscript = URScript()
urscript.start()
urscript.moves_linear(frames_RCS, velocity, radius)
urscript.end()

urscript = urscript.generate()

print(urscript)


#frame_OCF = robot.to_local_coordinates_origin(frame_WCF) # express within the robot frame
#if robot.attached_tool:
#    frame_OCF = robot.from_tcf_to_t0cf([frame_OCF])[0]
# ---------- end movel_2 ----------
send_13 = Button()  # disabled
send_14 = GhPythonScript(urscript=movel_2, send=send_13)  # -> out; inputs send: Boolean; disabled; same code as send_2

start_configurations = Data(python_7.picking_configuration)  # disabled

# ----
# Brick Vault small
py_9 = PythonScript()  # -> HERE, DATA; same code as py_4
series_2 = Series(Start=0, Step=1, Count=20)

# ----
# Assembly
angle2_2 = Slider(0.6, range=0..100.01)
angle1_2 = Slider(44, range=-44..60)
layers_6 = Slider(16, range=0..30)
crv_10 = Curve(<curve referenced from the Rhino model>)
pt_11 = Point([<point referenced from the Rhino model> x2])

python_8 = GhPythonScript(num=layers_6)  # -> out, value_list; inputs num: Int32
# ---------- python_8: Python ----------
value_list = []

if num:
    for n in range(num):
        value = 0.04*(n/12.)
        #value = 0
        value_list.append(value)

#value_list[0] = 0.0
#value_list[1] = 0.0
#value_list[2] += 0.01
#value_list[3] += 0.01
#value_list[4] += 0.01
#value_list[5] += 0.01
value_list[6] += 0.003
value_list[7] += 0.005
value_list[8] += 0.005
value_list[9] += 0.012
value_list[10] += 0.005
value_list[11] += 0.005
#value_list[12] -= 0.03
value_list[13] -= 0.002
#value_list[14] = 0.01
#value_list[15] = 0.01
#value_list[16] = 0.0
#value_list[17] = 0.0
#value_list[18] = 0.0
#value_list[19] = 0.00
# ---------- end python_8 ----------

python_9 = GhPythonScript(
    input_crv=crv_10,
    angle1=angle1_2,
    angle2=angle2_2,
    num=layers_6,
    value_list=python_8.value_list,
    offset_step=Slider(0.02, range=-0.1..0.025),
    before_layer_num=layers_3,
    after_layer_num=layers_4,
    bricklen="0.235",
    interval="0.073")  # -> out, plane_grid, curves, planes; inputs input_crv: Curve, num: Int32, value_list: list
# ---------- python_9: Python ----------
import Rhino.Geometry as rg
import math as m
import rhinoscriptsyntax as rs
from Rhino.Geometry import CurveOffsetCornerStyle as cs

#new_curve = input_crv.Trim(0.1, 0.2)

start_pts = []
end_pts = []
curves = []
offset_curves = []

def list_from_2darray(array):
    return [item for sublist in array for item in sublist]
    
def create_curves(input_crv, angle1, angle2, interval, num):

    offset = 0
    
    for i in range(num):
        # duplicate and translate a new curve
        new_curve = rg.Curve.DuplicateCurve(input_crv)
        new_curve.Translate(rg.Vector3d.ZAxis*interval*i)
        
        # get the plane on which the new curve lies
        #crv_plane = rg.Plane(new_curve.PointAtStart, new_curve.PointAtEnd, new_curve.PointAtNormalizedLength(0.5))
        crv_plane = rg.Plane(new_curve.PointAtStart, rg.Vector3d.ZAxis)
        # compute an offset value based on layer number
        if i < before_layer_num:
            offset += offset_step
        elif i > after_layer_num:
            offset -= offset_step
        
        # offset the new curve
        offset_crv = rg.Curve.Offset(new_curve, crv_plane, -offset, 0.01, cs.Sharp)[0]
        
        # for visualization
        offset_curves.append(offset_crv)
        
        # rotate the new curve around the axis defined by its end points (angle1); 
        # add an additional rotation of the curve based on layer number (angle2*i)
        rot_vector = rg.Vector3d(input_crv.PointAtStart) - rg.Vector3d(input_crv.PointAtEnd)
        offset_crv.Rotate(m.radians(-angle1-(i*angle2)), rot_vector, input_crv.PointAtNormalizedLength(0.5))
        
        # add the new curve to the list of curves
        curves.append(offset_crv)
    return curves

def create_planegrid(input_crv, angle1, angle2, interval, num, bricklen):

    curves = create_curves(input_crv, angle1, angle2, interval, num)
    
    plane_grid = []
    offset = 0
    for j, c in enumerate(curves):
        
        new_start_pt = c.PointAtNormalizedLength(value_list[j])
        #new_start_pt = c.PointAtNormalizedLength(0.04*(j/10.))
        c.SetStartPoint(new_start_pt)
    
        row = []

        #vparams = rg.Curve.DivideByCount(c, cols, True)
        vparams = rg.Curve.DivideByLength(c, 0.132, True)
        planes = rg.Curve.GetPerpendicularFrames(c, vparams)

        for i, plane in enumerate(planes):
            
            plane.Rotate(m.radians(-90), plane.YAxis)
            plane.Rotate(m.radians(-90), plane.XAxis)

            if j%2 == 0 and i%2 == 0: #even course
                if i < 8:
                    #plane.Translate(plane.XAxis*0.02*(i/10.))
                    plane.Translate(plane.XAxis*0.025/i)
                    plane.Rotate(m.radians(0), plane.ZAxis)
                elif i > len(planes)-8:
                    plane.Translate(plane.XAxis*0.0/i)
                    plane.Rotate(m.radians(0), plane.ZAxis)
                    
                row.append(plane)
                
            if j%2 == 1 and i%2 == 1: #odd course
                if i < 8:
                    plane.Translate(plane.XAxis*0.025/i)
                elif i > len(planes)-8:
                    plane.Translate(plane.XAxis*-0.0/i)

                row.append(plane)

        plane_grid.append(row)
    return plane_grid

plane_grid = create_planegrid(input_crv, angle1, angle2, interval, num, bricklen)
planes = list_from_2darray(plane_grid)
# ---------- end python_9 ----------
pln_11 = Plane(python_9.planes)
crv_11 = Curve(python_9.curves)
generate_assembly_2 = GhPythonScript(
    plane_grid=python_9.plane_grid,
    rot_mode=list_4,
    rot_factor1=Slider(25, range=0..100),
    rot_factor2=Slider(0, range=0..100),
    attr_pts=pt_11,
    elem_full=elem_def_2.elem_full)  # -> assembly; inputs plane_grid: list, attr_pts: list of Point3d
# ---------- generate_assembly_2: Python ----------
import Rhino.Geometry as rg
import math
from scriptcontext import sticky as st

from compas.geometry import Frame
from compas.geometry import Transformation

from compas_ghpython import draw_frame

from cooperative_mobile_brickwork.assembly import Assembly

import Rhino.Geometry as rg


assembly = Assembly() # initialize an empty assembly class

current_course = 0
for j, row in enumerate(plane_grid):
    for i, plane in enumerate(row):
        
        new_plane = rg.Plane(plane)
        
        if rot_mode == 1:
            rotval1 = math.sin(i/8)*rot_factor1
            #rotval2 = math.sin(i/6)*rot_factor2 
            rotval2 = -rot_factor2
        
        if rot_mode == 2:
            min_dist = 1.50
            for attr_pt in attr_pts:
                dist =  attr_pt.DistanceTo(new_plane.Origin)
                #print dist
                if dist < min_dist: 
                    min_dist = dist
            dist = min_dist
            
            rot_val = (dist/10)*0.4
            angle = math.radians(rot_val**2)*5000

#            if j < 3:
#               angle = 0

        #print 'course:', j, 'brick:', i, 'angle: ' , math.degrees(angle)
        
        if j%2==0: #even layers
            new_plane.Rotate(angle, plane.ZAxis, plane.Origin)
        else:
            new_plane.Rotate(-angle, plane.ZAxis, plane.Origin)
        
        T = Transformation.from_frame_to_frame(Frame.worldXY(), Frame(new_plane.Origin, new_plane.XAxis, new_plane.YAxis))
        
        
        if plane.OriginZ > 0.35:
        #if True:
            e = elem_full.transformed(T)
            assembly.add_element(e)


if transform:
    T = Transformation.from_frame_to_frame(Frame.worldXY(), Frame(ptransf.Origin, ptransf.XAxis, ptransf.YAxis))
    assembly.transform(T)
# ---------- end generate_assembly_2 ----------

show_8 = BooleanToggle(False)
update_network_2 = PythonScript(DATA=py_9.DATA, compute_interfaces_numpy=show_8, assembly=generate_assembly_2)  # -> assembly
# ---------- update_network_2: Python ----------
from assembly_information_model.assembly.courses import assembly_courses, assembly_with_interfaces_courses


if compute_interfaces_numpy:
    import os
    from compas.rpc import Proxy
    from assembly_information_model.assembly import Assembly
    p = Proxy('cooperative_mobile_brickwork.assembly.interfaces_numpy')
    p.stop_server()
    p.start_server()

    filename_before = "brickwall_ex2.json"
    filename_after = "brickwall_interfaces_ex2.json"

    PATH_BEFORE = os.path.join(DATA, filename_before)
    PATH_AFTER = os.path.join(DATA, filename_after)
    
    # the assembly has to be serialized such that it can be called from CPython
    assembly.to_json(PATH_BEFORE)
    
    # call the CPython Function using COMPAS RPC
    p.assembly_interfaces_numpy_fromtojson(PATH_BEFORE, PATH_AFTER, nmax=10, tmax = 0.06, amin = 0.0001)

    assembly = Assembly.from_json(PATH_AFTER)


# now compute the courses
assembly_courses(assembly)

# example test: get the bottom keys
c_min = min(assembly.network.nodes_attribute(name='course'))
#print(c_min)
#keys_on_bottom = list(assembly.network.vertices_where({'course': c_min}))
#print(keys_on_bottom)

# example test: get the top keys
c_max = max(assembly.network.nodes_attribute(name='course'))
#print(c_max)
#keys_on_top = list(assembly.network.vertices_where({'course': c_max}))
#print(keys_on_top)
# ---------- end update_network_2 ----------

# ----
# to JSON
export_4 = Button()
export_5 = Button()
export_6 = PythonScript(DATA=py_9.DATA, assembly=update_network_2, export_to_json=export_4, export_to_json_unity=export_5)
# ---------- export_6: Python ----------
import os
from compas.datastructures.mesh import mesh_quads_to_triangles
from compas.datastructures.mesh import mesh_unify_cycles

if export_to_json:
    
    filename = "brickwall_ex1.json"
    PATH = os.path.join(DATA, filename)
    
    # the assembly has to be serialized such that it can be called from CPython
    assembly.to_json(PATH)
    

if export_to_json_unity:
    
    for key, e in assembly.elements():
    
        #convert to trimesh
        mesh_quads_to_triangles(e._mesh, check_angles=False)
        #mesh_unify_cycles(e._mesh)
        #print e._mesh.faces
        #print e._mesh.face_vertices(list(e._mesh.faces())[0])

    filename = "brickwall_ex1_unity.json"
    PATH = os.path.join(DATA, filename)
    assembly.to_json(PATH)
# ---------- end export_6 ----------

mesh_3 = PythonScript(assembly=generate_assembly_2)  # -> elems_compas_meshes, elem_compas_mesh
# ---------- mesh_3: Python ----------
from compas.geometry import Frame, Transformation
from compas.artists import Artist

elems_compas_meshes = []

for key, elem in assembly.elements():
    m = elem.mesh
    elems_compas_meshes.append(m)

elem = assembly.element(0)
T = Transformation.from_change_of_basis(Frame.worldXY(), elem.frame)
mesh_transformed = elem.mesh.transformed(T)
elem_compas_mesh = mesh_transformed
# ---------- end mesh_3 ----------

panel_18 = Panel("assembly collision mesh")
remove_2 = Button()
add_5 = Button()
collision_2 = PythonScript(robot=robot, scene=scene, compas_meshes=mesh_3.elems_compas_meshes, add=add_5, remove=remove_2)  # -> out, a; inputs compas_meshes: list
# ---------- collision_2: Python ----------
from compas_fab.robots import CollisionMesh



T = robot.transformation_WCF_OCF()

cms_OCF = []
for i, compas_mesh in enumerate(compas_meshes):
    id = 'element_' + str(i)
    compas_mesh_OCF = compas_mesh.transformed(T)
    cm_OFC = CollisionMesh(compas_mesh_OCF, id)
    cms_OCF.append(cm_OFC)


if scene:
    if add:
        for cm in cms_OCF:
            scene.add_collision_mesh(cm)
            scene.cm.append(cm)
    if remove:
        for cm in cms_OCF:
            scene.remove_collision_mesh(id)
            scene.cm.remove(scene.cm[-1])
# ---------- end collision_2 ----------
panel_19 = Panel(collision_2.out)

# ----
# Attach an collision object
# Select link name to attach
# Select the links the object is allowed to touch
number_slider_10 = Slider(7, range=0..7)
idxs = Data([3, 4, 5, 6, 7])
py_10 = PythonScript(robot=robot, idx=number_slider_10)  # -> link_name; inputs idx: Int32
# ---------- py_10: Python ----------
if robot:
    link_names = robot.get_link_names()
    #print link_names
    link_name = link_names[idx]
# ---------- end py_10 ----------
panel_20 = Panel(py_10)
py_11 = PythonScript(robot=robot, idxs=idxs)  # -> touch_links; inputs idxs: list of Int32
# ---------- py_11: Python ----------
if robot:
    link_names = robot.get_link_names()
    touch_links = [link_names[i] for i in idxs]
# ---------- end py_11 ----------
panel_21 = Panel(py_11)
remove_3 = Button()
scale_2 = BooleanToggle(False)
add_6 = Button()
attached = PythonScript(
    scene=scene,
    compas_mesh=mesh_3.elem_compas_mesh,
    scale=scale_2,
    id="tip",
    link_name=py_10,
    touch_links=py_11,
    add=add_6,
    remove=remove_3)  # -> acm, out; inputs touch_links: list
# ---------- attached: Python ----------
from compas_fab.robots import CollisionMesh
from compas_fab.robots import AttachedCollisionMesh

cm = CollisionMesh(compas_mesh, id)
acm = AttachedCollisionMesh(cm, link_name, touch_links)

if scene:
    if add:
        scene.add_attached_collision_mesh(acm, scale)
        scene.acm.append(acm)
    if remove:
        scene.remove_attached_collision_mesh(id)
        scene.remove_collision_mesh(id)
        scene.acm.remove(scene.acm[-1])
# ---------- end attached ----------

midpt_2 = CurveMiddle(Curve=crv_11)
tag_2 = TextTag(Location=midpt_2, Text=series_2)
total_2 = GhPythonScript(assembly=generate_assembly_2)  # -> out; same code as total
panel_22 = Panel(total_2)

# ----
# Network Viz
number_slider_11 = Slider(0, range=0..47)
show_9 = BooleanToggle(False)
network_viz_2 = GhPythonScript(assembly=update_network_2, show_network=show_9, key=number_slider_11)  # -> out, nodes, edges, current_node, current_node_neighbors; inputs key: Int32; same code as network_viz
line_2 = Line(network_viz_2.edges)
pt_12 = Point(network_viz_2.nodes)
brep_4 = Brep(network_viz_2.current_node)
brep_5 = Brep(network_viz_2.current_node_neighbors)
preview_7 = CustomPreview(Geometry=[brep_4, line_2], Material=ColourSwatch(SwatchColor=RGB(0, 0, 0)))
preview_8 = CustomPreview(Geometry=brep_5, Material=ColourSwatch(SwatchColor=RGB(255, 207, 207)))

# ----
# Draw
# Visualise the entire assembly and its underlying network topology.
counter_3 = CountThroughList(
    assembly=generate_assembly_2,
    start=start,
    stop=stop,
    step=step,
    step_back=back,
    reset=reset,
    full=full,
    till_key=till_key,
    key=key,
    interval=list_6)  # -> item, counter; inputs start: Boolean, stop: Boolean, step_back: Boolean, key: Int32; same code as counter
idx_6 = Panel(counter_3.counter)

# ---- group: Assembly Artist
show_10 = BooleanToggle(False)
show_11 = BooleanToggle(False)
draw_7 = PythonScript(assembly=generate_assembly_2, show_all=show_10, show_counter=show_11, counter=counter_3.counter)  # -> G, tool_planes_WCS, current_tool_plane; inputs counter: Int32; same code as draw_3
geo_2 = Geometry(draw_7.G)
pln_12 = Plane(draw_7.tool_planes_WCS)
pln_13 = Plane(draw_7.current_tool_plane)
preview_9 = CustomPreview(Geometry=geo_2, Shader=ColourSwatch(SwatchColor=RGB(243, 169, 137)))
preview_10 = CustomPreview(Geometry=pln_12, Shader=ColourSwatch(SwatchColor=RGB(178, 178, 178)))

# ---- group: plan motion
# 2. 'Move' free-space motion
# If you specify the tolerance vector with [360, 1, 1], it means that
#     the frame's y-axis and z-axis are allowed to rotate about the x-axis by an
#     angle of 360 degrees, whereas the x-axis can only change 1 degree.
# TODO Example:
# Add path constraints
group = Data(main_planning_group)
list_18 = ValueList({"don't use attached collision mesh": 0, "use attached collision mesh": 1}, selected="use attached collision mesh")
py_12 = PythonScript(configurations=python_7.picking_configuration)  # -> last_configuration; inputs configurations: list
# ---------- py_12: Python ----------
from compas_fab.robots import Configuration

if list(configurations) != [None]:
    last_configuration = Configuration(configurations[-1].joint_values, configurations[-1].joint_types)
    print last_configuration
# ---------- end py_12 ----------
python_10 = PythonScript(
    robot=robot,
    group=group,
    goal_plane=python_7.placing_plane_safe_WCF,
    tolerance_position=Slider(0.001, range=0..0.001),
    tolerance_xaxis_deg=Slider(1, range=1..360),
    tolerance_yaxis_deg=Slider(1, range=1..360),
    tolerance_zaxis_deg=Slider(1, range=1..360))  # -> goal_constraints
# ---------- python_10: Python ----------
import math
from compas.geometry import Frame

frame_WCF = Frame(goal_plane.Origin, goal_plane.XAxis, goal_plane.YAxis)
frame_OCF = robot.to_local_coordinates_origin(frame_WCF)

if robot.attached_tool:
    frame_OCF = robot.from_tcf_to_t0cf([frame_OCF])[0]

tolerances_axes = [math.radians(tolerance_xaxis_deg), math.radians(tolerance_yaxis_deg), math.radians(tolerance_zaxis_deg)]

if robot:
    goal_constraints = robot.constraints_from_frame(frame_OCF, tolerance_position, tolerances_axes, group)
# ---------- end python_10 ----------
start_4 = Button()
reset_4 = Button()
step_3 = Button()
compute = Button()
filter_7 = StreamFilter(Gate=list_18, Stream1=attached.acm)
list_19 = ValueList({"RRT", "RRT*": "RRTStar", "EST", "PRM": "RPM", "PRM*": "RPMStar", "SPARS"}, selected="RRT")
plan_motion = PythonScript(
    robot=robot,
    group=group,
    start_configuration=python_7.free_move_start_config,
    goal_constraints=python_10,
    planner_id=list_19,
    attached_collision_meshes=filter_7,
    compute=compute)  # -> out, trajectory; inputs goal_constraints: list, attached_collision_meshes: list
# ---------- plan_motion: Python ----------
"""Calculates a motion path.
    Inputs:
        robot: The robot
        group: str, optional
            The planning group used for calculation. Defaults to the robot's
            main planning group.
        start_configuration: :class:`compas_fab.robots.Configuration`, optional
            The robot's full configuration, i.e. values for all configurable
            joints of the entire robot cell, at the starting position. Defaults
            to the all-zero configuration.
        goal_constraints: list of :class:`compas_fab.robots.Constraint`
            The goal to be achieved, defined in a set of constraints.
            Constraints can be very specific, for example defining value domains
            for each joint, such that the goal configuration is included,
            or defining a volume in space, to which a specific robot link (e.g.
            the end-effector) is required to move to.
        planner_id: str
            The name of the algorithm used for path planning. Defaults to 'RRT'.
        attached_collision_meshes: list of :class:`compas_fab.robots.AttachedCollisionMesh`
            Defaults to None.
        compute: bool
            Press to calculate solution.
    Output:
        :class:`compas_fab.robots.JointTrajectory`
            The calculated trajectory.
"""
from __future__ import print_function
import logging
import scriptcontext as sc

guid = str(ghenv.Component.InstanceGuid)
response_key = "response_" + guid
if response_key not in sc.sticky:
    sc.sticky[response_key] = None

LOGGER = logging.getLogger('roslibpy')

if robot and robot.client and start_configuration and compute:
    if robot.client.is_connected:
        
        sc.sticky[response_key] = robot.plan_motion(goal_constraints,
                                                    start_configuration,
                                                    group,
                                                    options={
                                                        'planner_id': str(planner_id),
                                                        'attached_collision_meshes': list(attached_collision_meshes),
                                                    })
    else:
        print("Robot client is not connected.")

trajectory = sc.sticky[response_key]
# ---------- end plan_motion ----------
vis = PythonScript(response=plan_motion.trajectory)  # -> P, V, A, time
# ---------- vis: Python ----------
from compas_ghpython import list_to_ghtree

if response:

    positions = []
    velocities = []
    accelerations = []
    time_from_start = []

    for p in response.points:
        positions.append(p.positions)
        velocities.append(p.velocities)
        accelerations.append(p.accelerations)
        time_from_start.append(p.time_from_start.seconds)

    P = list_to_ghtree(list(zip(*positions)))
    V = list_to_ghtree(list(zip(*velocities)))
    A = list_to_ghtree(list(zip(*accelerations)))

    time = time_from_start[-1]
    print time
# ---------- end vis ----------
time_s = Panel(vis.time)
prismatic = QuickGraph(vis.P, SortOrder=0)
panel_23 = Panel(plan_motion.out)
panel_24 = Panel("positions")
graph = QuickGraph(vis.V, SortOrder=0)
graph_2 = QuickGraph(vis.A, SortOrder=0)
panel_25 = Panel("velocities")
panel_26 = Panel("accelerations")

# 2. 'Move' free-space motion
# TODO Example:
# Add path constraints
group_2 = Data(main_planning_group)  # disabled
number_slider_12 = Slider(0.001, range=0..0.001)  # disabled
number_slider_13 = Slider(1, range=1..360)  # disabled
number_slider_14 = Slider(1, range=1..360)  # disabled
number_slider_15 = Slider(1, range=1..360)  # disabled
list_20 = ValueList({"don't use attached collision mesh": 0, "use attached collision mesh": 1}, selected="use attached collision mesh")  # disabled
python_11 = PythonScript(
    robot=robot,
    group=group_2,
    goal_plane=python_7.placing_plane_safe_WCF,
    tolerance_position=number_slider_12,
    tolerance_xaxis_deg=number_slider_13,
    tolerance_yaxis_deg=number_slider_14,
    tolerance_zaxis_deg=number_slider_15)  # -> goal_constraints; disabled; same code as python_10
py_13 = PythonScript(configurations=python_7.picking_configuration)  # -> last_configuration; inputs configurations: list; disabled; same code as py_12
start_5 = Button()  # disabled
reset_5 = Button()  # disabled
step_4 = Button()  # disabled
compute_2 = Button()  # disabled
filter_8 = StreamFilter(Gate=list_20, Stream1=attached.acm)  # disabled
list_21 = ValueList({"RRT", "RRT*": "RRTStar", "EST", "PRM": "RPM", "PRM*": "RPMStar", "SPARS"}, selected="RRT")  # disabled
plan_motion_2 = PythonScript(
    robot=robot,
    group=group_2,
    start_configuration=py_13,
    goal_constraints=python_11,
    planner_id=list_21,
    attached_collision_meshes=filter_8,
    compute=compute_2)  # -> out, trajectory; inputs goal_constraints: list, attached_collision_meshes: list; disabled; same code as plan_motion
vis_2 = PythonScript(response=plan_motion_2.trajectory)  # -> P, V, A, time; disabled; same code as vis
time_s_2 = Panel(vis_2.time)  # disabled
prismatic_2 = QuickGraph(vis_2.P, SortOrder=0)  # disabled
panel_27 = Panel(plan_motion_2.out)  # disabled
panel_28 = Panel("positions")  # disabled
graph_3 = QuickGraph(vis_2.V, SortOrder=0)  # disabled
graph_4 = QuickGraph(vis_2.A, SortOrder=0)  # disabled
panel_29 = Panel("velocities")  # disabled
panel_30 = Panel("accelerations")  # disabled
colour_swatch_3 = ColourSwatch(SwatchColor=RGB(139, 59, 161))  # disabled

# ----
# Move Joints
list_22 = ValueList({"send all positions": 0, "send only one position": 1, "from inverse": 2}, selected="send all positions")
clear_6 = Button()
add_7 = Button()
idx_7 = Slider(0, range=0..100)
rec_joints_2 = PythonScript(msg=pose_2.configuration, rec=add_7, clear=clear_6)  # -> rec; same code as rec_joints
send_15 = Button()

list_23 = ValueList({"0 forward_kinematics": 0, "1 inverse_kinematics": 1, "2 cartesian motion": 2, "3 free-space motion": 3, "4 'pick and place'": 4}, selected="1 inverse_kinematics")

# ----
# Generate 'pick and place' commands
number_slider_16 = Slider(0.15, range=0..0.2)
radius_4 = Slider(0.01, range=0..0.1)
move_configurations_2 = Data(config_33.a)
pick_configurations = Data(python_7.picking_configuration)
send_16 = Button()
list_24 = ValueList({"placing": 0, "releasing": 1, "place one": 2, "place safe": 3}, selected="placing")

# ----
# Select configuration input: from fk, ik, path, or from real robot
# Visualisation
show_end_effector_frame = BooleanToggle(True)
show_picking_frame = BooleanToggle(True)
show_origin_frame = BooleanToggle(True)
show_base_frame = BooleanToggle(False)
show_collision = BooleanToggle(False)
show_in_world = BooleanToggle(True)
show_frames = BooleanToggle(False)
show_visual = BooleanToggle(True)
show_bcm = BooleanToggle(False)
show_acm = BooleanToggle(False)
show_cm = BooleanToggle(True)

# ---- group: plan motion (continued)
py_14 = PythonScript(robot=robot, group=group, trajectory=plan_motion.trajectory, in_world=show_in_world)  # -> start_configuration, configurations, full_configurations, frames, planes
# ---------- py_14: Python ----------
from compas.geometry import Transformation
from compas.geometry import Frame
from compas_ghpython import draw_frame
from compas_rhino.conversions import xform_to_rhino

import ghpythonlib.components as ghcomp

joint_positions = []

if in_world:
    T = robot.transformation_OCF_WCF()
else:
    T = Transformation()


if trajectory:
    configurations = trajectory.points
    start_configuration = trajectory.start_configuration
    fraction = trajectory.fraction
    time = trajectory.time_from_start
    full_configurations = [robot.merge_group_with_full_configuration(c, trajectory.start_configuration, group) for c in configurations]
    frames = [robot.forward_kinematics(c, group, options=dict(solver='model')) for c in full_configurations]
    if robot.attached_tool:
        frames = [robot.from_t0cf_to_tcf([frame])[0] for frame in frames]
        
    planes = [draw_frame(frame) for frame in frames]
    planes = ghcomp.Transform(planes, xform_to_rhino(T))
    

    print configurations
    #print full_configurations
# ---------- end py_14 ----------
pline = PolyLine(Vertices=py_14.planes, Closed=False)
counter_4 = CountThroughList(L=py_14.full_configurations, start=start_4, step=step_3, reset=reset_4)  # -> item; inputs L: list, start: Boolean
# ---------- counter_4: Python ----------
from scriptcontext import sticky as st
from compas_ghpython.utilities import update_component


interval = 1

# store data in component
guid = str(ghenv.Component.InstanceGuid)
counter_key = "counter_" + guid
running_key = "running_" + guid

if counter_key not in st:
    st[counter_key] = 0

if running_key not in st:
    st[running_key] = False

if start:
    st[running_key] = True

if step:
    if st[counter_key] < len(L) - 1:
        st[counter_key] += 1
    
if len(L):
    item = L[st[counter_key]]

if st[running_key]:
    if st[counter_key] < len(L) - 1:
        st[counter_key] += 1
        update_component(ghenv, interval)
    else:
        st[counter_key] = 0
        st[running_key] = False
# ---------- end counter_4 ----------
preview_11 = CustomPreview(Geometry=pline, Material=ColourSwatch(SwatchColor=RGB(139, 59, 161)))

py_15 = PythonScript(robot=robot, group=group_2, trajectory=plan_motion_2.trajectory, in_world=show_in_world)  # -> start_configuration, configurations, full_configurations, frames, planes; disabled
# ---------- py_15: Python ----------
from compas.geometry import Transformation
from compas.geometry import Frame
from compas_ghpython import draw_frame
from compas_rhino.conversions import xform_to_rhino

import ghpythonlib.components as ghcomp

joint_positions = []

if in_world:
    T = robot.transformation_OCF_WCF()
else:
    T = Transformation()


if trajectory:
    configurations = trajectory.points
    start_configuration = trajectory.start_configuration
    fraction = trajectory.fraction
    time = trajectory.time_from_start
    full_configurations = [robot.merge_group_with_full_configuration(c, trajectory.start_configuration, group) for c in configurations]
    frames = [robot.forward_kinematics(c, group, options=dict(solver='model')) for c in full_configurations]
    if robot.attached_tool:
        frames = [robot.from_t0cf_to_tcf([frame])[0] for frame in frames]
        
    planes = [draw_frame(frame) for frame in frames]
    planes = ghcomp.Transform(planes, xform_to_rhino(T))
    

    print configurations[0].joint_values
    print full_configurations[0]
# ---------- end py_15 ----------
pline_2 = PolyLine(Vertices=py_15.planes, Closed=False)  # disabled
counter_5 = CountThroughList(L=py_15.full_configurations, start=start_5, step=step_4, reset=reset_5)  # -> item; inputs L: list, start: Boolean; disabled; same code as counter_4
preview_12 = CustomPreview(Geometry=pline_2, Material=colour_swatch_3)  # disabled

# ----
item_6 = ListItem(List=py_14.full_configurations, Index=idx_7, Wrap=True)
filter_9 = StreamFilter(Gate=list_22, Stream0=inverse.configuration, Stream1=item_6, Stream2=rec_joints_2)
movej_2 = PythonScript(joint_configurations=filter_9, velocity=Slider(0.04, range=0..0.5))  # -> urscript, values; inputs joint_configurations: list
# ---------- movej_2: Python ----------
from ur_fabrication_control.direct_control import URScript
import math



#for c in joint_configurations:
#    for i,v in enumerate(c.joint_values):
#        #print v
#        if v>math.pi:
#            v-=2*math.pi
#        if v<-math.pi:
#            v+=2*math.pi
#        c.joint_values[i]=v
#print joint_configurations
#values = joint_configurations[0].joint_values
#print([math.degrees(v) for v in values])


#joint_config = ["movej({}, v={})".format(c.values, velocity/10) for c in joint_configurations]

urscript = URScript()
urscript.start()
for jc in joint_configurations:
    urscript.move_joint(jc, velocity)
urscript.end()

urscript = urscript.generate()

print(urscript)
# ---------- end movej_2 ----------
send_17 = GhPythonScript(urscript=movej_2.urscript, send=send_15)  # -> out; inputs send: Boolean
# ---------- send_17: Python ----------
from scriptcontext import sticky as st
from ur_fabrication_control.direct_control import send_script

ur_ip = st["ur_ip"]
ur_port = st["ur_port"]

print urscript

if send:
    send_script(urscript, ur_ip, ur_port)
# ---------- end send_17 ----------

filter_10 = StreamFilter(Gate=list_23, Stream0=forward_kinematics, Stream1=inverse.configuration, Stream3=counter_4, Stream4=counter_2)

generate_ur_script = PythonScript(
    robot=robot,
    joints_pick_cartesian=pick_configurations,
    free_move_start_config=python_7.free_move_start_config,
    inverse_config=inverse.configuration,
    joints_move_freemotion=move_configurations_2,
    picking_plane=python_7.picking_plane_WCF,
    placing_plane=python_7.placing_plane_WCF,
    picking_plane_safe=python_7.picking_plane_safe_WCF,
    placing_plane_safe=python_7.placing_plane_safe_WCF,
    routine=list_24,
    velocity=number_slider_16,
    radius=radius_4,
    in_world=show_in_world)  # -> out, urscript; inputs joints_move_freemotion: list, routine: Int32
# ---------- generate_ur_script: Python ----------
from ur_fabrication_control.direct_control import URScript
from ur_fabrication_control.direct_control.mixins import AreaGripMixins

import math
from scriptcontext import sticky as st
import Rhino.Geometry as rg

from compas.geometry import Frame, Transformation


class URScript_RSRD(URScript, AreaGripMixins):
    pass

tool_angle_axis = list(robot.attached_tool.frame.point) + list(robot.attached_tool.frame.axis_angle_vector)
sleep = 3.0

def plane_to_frame_OCF(plane_WCS):
    frame_WCS = Frame(plane_WCS.Origin, plane_WCS.XAxis, plane_WCS.YAxis)
    if in_world:
        T = robot.transformation_WCF_OCF()
    else:
        T = Transformation()
    frame_WCS.transform(T)
    return frame_WCS

picking_frame = plane_to_frame_OCF(picking_plane)
placing_frame = plane_to_frame_OCF(placing_plane) 
picking_frame_safe = plane_to_frame_OCF(picking_plane_safe)
placing_frame_safe = plane_to_frame_OCF(placing_plane_safe)
    
#traj_frames = []
#for plane in traj_planes_WCF:
#    traj_frames.append(plane_to_frame(plane))



#joints_1 = [JointTrajectoryPoint((-2.888, -1.800, 2.496, -2.267, -1.565, -0.529), (0, 0, 0, 0, 0, 0), (0.000, 0.000, 0.000, 0.000, 0.000, 0.000), (0.298, 0.000, 0.000, 0.000, 0.000, 0.000), (0.000, 0.000, 0.000, 0.000, 0.000, 0.000), Duration(0, 0)), JointTrajectoryPoint((-2.810, -1.949, 2.494, -2.375, -1.304, -0.569), (0, 0, 0, 0, 0, 0), (0.186, -0.352, -0.006, -0.256, 0.616, -0.096), (0.302, -0.572, -0.010, -0.415, 1.001, -0.156), (0.000, 0.000, 0.000, 0.000, 0.000, 0.000), Duration(0, 727573763)), JointTrajectoryPoint((-2.731, -2.098, 2.491, -2.484, -1.043, -0.610), (0, 0, 0, 0, 0, 0), (0.301, -0.571, -0.010, -0.414, 1.000, -0.155), (0.287, -0.543, -0.010, -0.394, 0.950, -0.148), (0.000, 0.000, 0.000, 0.000, 0.000, 0.000), Duration(1, 26809817)), JointTrajectoryPoint((-2.652, -2.248, 2.488, -2.592, -0.781, -0.651), (0, 0, 0, 0, 0, 0), (0.371, -0.704, -0.013, -0.510, 1.231, -0.191), (0.297, -0.564, -0.010, -0.409, 0.986, -0.153), (0.000, 0.000, 0.000, 0.000, 0.000, 0.000), Duration(1, 258944050)), JointTrajectoryPoint((-2.573, -2.397, 2.485, -2.700, -0.520, -0.691), (0, 0, 0, 0, 0, 0), (0.430, -0.816, -0.015, -0.592, 1.427, -0.222), (0.298, -0.565, -0.010, -0.410, 0.988, -0.154), (0.000, 0.000, 0.000, 0.000, 0.000, 0.000), Duration(1, 454459208)), JointTrajectoryPoint((-2.494, -2.547, 2.483, -2.809, -0.259, -0.732), (0, 0, 0, 0, 0, 0), (0.479, -0.908, -0.017, -0.659, 1.589, -0.247), (0.257, -0.488, -0.009, -0.354, 0.853, -0.133), (0.000, 0.000, 0.000, 0.000, 0.000, 0.000), Duration(1, 626579951)), JointTrajectoryPoint((-2.416, -2.696, 2.480, -2.917, 0.003, -0.772), (0, 0, 0, 0, 0, 0), (0.494, -0.936, -0.017, -0.679, 1.637, -0.255), (-0.082, 0.156, 0.003, 0.113, -0.272, 0.042), (0.000, 0.000, 0.000, 0.000, 0.000, 0.000), Duration(1, 784109868)), JointTrajectoryPoint((-2.337, -2.845, 2.477, -3.026, 0.264, -0.813), (0, 0, 0, 0, 0, 0), (0.466, -0.884, -0.016, -0.641, 1.546, -0.240), (-0.247, 0.467, 0.009, 0.339, -0.818, 0.127), (0.000, 0.000, 0.000, 0.000, 0.000, 0.000), Duration(1, 945879309)), JointTrajectoryPoint((-2.258, -2.995, 2.474, -3.134, 0.525, -0.854), (0, 0, 0, 0, 0, 0), (0.421, -0.797, -0.015, -0.578, 1.395, -0.217), (-0.263, 0.499, 0.009, 0.362, -0.873, 0.136), (0.000, 0.000, 0.000, 0.000, 0.000, 0.000), Duration(2, 122816508)), JointTrajectoryPoint((-2.179, -3.144, 2.472, -3.242, 0.787, -0.894), (0, 0, 0, 0, 0, 0), (0.368, -0.698, -0.013, -0.506, 1.221, -0.190), (-0.256, 0.486, 0.009, 0.352, -0.850, 0.132), (0.000, 0.000, 0.000, 0.000, 0.000, 0.000), Duration(2, 321879017)), JointTrajectoryPoint((-2.100, -3.293, 2.469, -3.351, 1.048, -0.935), (0, 0, 0, 0, 0, 0), (0.300, -0.569, -0.010, -0.413, 0.996, -0.155), (-0.303, 0.574, 0.011, 0.417, -1.005, 0.156), (0.000, 0.000, 0.000, 0.000, 0.000, 0.000), Duration(2, 553147024)), JointTrajectoryPoint((-2.022, -3.443, 2.466, -3.459, 1.309, -0.976), (0, 0, 0, 0, 0, 0), (0.184, -0.349, -0.006, -0.253, 0.610, -0.095), (-0.294, 0.557, 0.010, 0.404, -0.974, 0.152), (0.000, 0.000, 0.000, 0.000, 0.000, 0.000), Duration(2, 856517750)), JointTrajectoryPoint((-1.943, -3.592, 2.464, -3.567, 1.571, -1.016), (0, 0, 0, 0, 0, 0), (0.000, 0.000, 0.000, 0.000, 0.000, 0.000), (-0.297, 0.563, 0.010, 0.408, -0.984, 0.153), (0.000, 0.000, 0.000, 0.000, 0.000, 0.000), Duration(3, 585248746))]
#print joints_move_freemotion
reversed_joints = joints_move_freemotion[::-1]
#print reversed_joints

# placing
if routine == 0:
    commands = URScript_RSRD()
    commands.start()
    commands.set_tcp(tool_angle_axis)
    commands.move_joint(joints_pick_cartesian, velocity) 
    commands.move_linear(picking_frame, velocity, radius)
    commands.areagrip_on()
    commands.add_line("\tsleep({})".format(2.0))
    commands.move_linear(picking_frame_safe, velocity, radius)
    commands.move_joint(free_move_start_config, velocity)
    ##commands.move_joint(inverse_config, velocity)
    commands.moves_joint([joint_move_configuration for joint_move_configuration in joints_move_freemotion], velocity)
    commands.move_linear(placing_frame_safe, velocity, radius)  
    commands.move_linear(placing_frame, velocity, radius)  
    commands.end()  

## releasing
if routine == 1:
    commands = URScript_RSRD()
    commands.start()
    commands.set_tcp(tool_angle_axis)
    commands.areagrip_off()  
    commands.move_linear(placing_frame_safe, velocity, radius)
    commands.move_joint(free_move_start_config, velocity)
    #commands.moves_joint([joint_move_configuration for joint_move_configuration in reversed_joints], velocity)
    commands.move_joint(joints_pick_cartesian, velocity)
    commands.end() 


if routine == 2:
    commands = URScript_RSRD()
    commands.start()
    commands.set_tcp(tool_angle_axis)
    commands.move_linear(placing_frame, velocity, radius)
    commands.end()  
    
if routine == 3:
    commands = URScript_RSRD()
    commands.start()
    commands.set_tcp(tool_angle_axis)
    commands.move_linear(placing_frame_safe, velocity, radius)
    commands.end() 

urscript = commands.generate()

print(urscript)
# ---------- end generate_ur_script ----------
send_18 = GhPythonScript(urscript=generate_ur_script.urscript, send=send_16)  # -> out; inputs send: Boolean
# ---------- send_18: Python ----------
from scriptcontext import sticky as st
from ur_fabrication_control.direct_control import send_script

ur_ip = st["ur_ip"]
ur_port = st["ur_port"]

print urscript
if send:
    send_script(urscript, ur_ip, ur_port)
# ---------- end send_18 ----------

visualize = PythonScript(
    robot=robot,
    group=main_planning_group,
    scene=scene,
    configuration=filter_10,
    redraw=[collision.a, collision_2.a, py_6.a, py_7],
    attached_collision_meshes=attached.acm,
    show_visual=show_visual,
    show_collision=show_collision,
    show_end_effector_frame=show_end_effector_frame,
    show_robot_frames=show_frames,
    show_base_frame=show_base_frame,
    show_origin_frame=show_origin_frame,
    show_picking_frame=show_picking_frame,
    show_cm=show_cm,
    show_bcm=show_bcm,
    show_acm=show_acm,
    in_world=show_in_world)  # -> out, robot, visual, collision_meshes_robot, collision_mesh_base, collision_meshes_obstacles, collision_meshes_attached, frames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; inputs redraw: list, attached_collision_meshes: list
# ---------- visualize: Python ----------
from compas.geometry import Vector
from compas.geometry import Point
from compas.geometry import Transformation
from compas.geometry import Frame
from compas_ghpython.artists import MeshArtist
from compas_fab.robots import Configuration

import ghpythonlib.components as ghcomp
from compas_rhino.conversions import xform_to_rhino


if robot and configuration:
    
    robot.update(configuration, visual=show_visual, collision=show_collision)
    if in_world:
        T = robot.transformation_OCF_WCF()
    else:
        T = Transformation()

    if show_visual:
        visual = robot.artist.draw_visual()
        visual += robot.base_geometry
        visual = ghcomp.Transform(visual, xform_to_rhino(T))

    if show_collision:
        collision_meshes_robot = robot.artist.draw_collision()
        collision_meshes_robot = ghcomp.Transform(collision_meshes_robot, xform_to_rhino(T))
    
    if show_end_effector_frame:
        ee_frame = robot.get_end_effector_frame(group=group, full_configuration=configuration)
        if robot.attached_tool:
            ee_frame = robot.from_t0cf_to_tcf([ee_frame])[0]
        ee_frame = ee_frame.transformed(T)
    
    if show_robot_frames:
        frames = robot.transformed_frames(configuration)
        [f.transform(T) for f in frames]

    if show_base_frame:
        base_frame = robot.get_base_frame(group, configuration)
        base_frame = base_frame.transformed(T)
    
    if show_origin_frame:
        origin_frame = robot.get_origin_frame()

    if show_picking_frame:
        picking_frame = robot.get_picking_frame()
        #picking_frame = picking_frame.transformed(T)
    
    if show_cm:
        M = []
        for cm in scene.cm:
            mesh = cm.mesh
            M.append(MeshArtist(mesh).draw())
        collision_meshes_obstacles = M
        collision_meshes_obstacles = ghcomp.Transform(collision_meshes_obstacles, xform_to_rhino(T))
    
    if show_bcm:
        if scene.bcm:
            collision_mesh_base = MeshArtist(scene.bcm.mesh).draw()
            collision_mesh_base = ghcomp.Transform(collision_mesh_base, xform_to_rhino(T))
    
    if show_acm:
        M = []
        for acm in scene.acm:
            ee_frame = robot.get_end_effector_frame(group=group, full_configuration=configuration)
            if robot.attached_tool:
                ee_frame = robot.from_t0cf_to_tcf([ee_frame])[0]
            T_ee = Transformation.from_frame_to_frame(Frame.worldXY(), ee_frame)
            mesh = acm.collision_mesh.mesh.transformed(T_ee)
            M.append(MeshArtist(mesh).draw(color=[0.6,0.4,0.4,0.4]))
            
        collision_meshes_attached = M
        collision_meshes_attached = ghcomp.Transform(collision_meshes_attached, xform_to_rhino(T))
# ---------- end visualize ----------
draw_8 = GhPythonScript(
    frames=[visualize.ee_frame, visualize.frames, visualize.base_frame, visualize.origin_frame, visualize.picking_frame],
    scale=Slider(0.2, range=0..1))  # -> P, V, C, W; inputs frames: list; same code as draw_4
geo_3 = Geometry(visualize.collision_meshes_attached)
geo_4 = Geometry(visualize.collision_meshes_obstacles)
geo_5 = Geometry(visualize.collision_meshes_robot)
geo_6 = Geometry(visualize.collision_mesh_base)
geo_7 = Geometry(visualize.visual)
preview_13 = CustomPreview(Geometry=geo_7, Shader=ColourSwatch(SwatchColor=RGB(105, 105, 105)))
preview_14 = CustomPreview(Geometry=[geo_5, geo_4, geo_3, geo_6], Shader=ColourSwatch(SwatchColor=RGB(108, 79, 255)))
vdisex_4 = VectorDisplayEx(Point=draw_8.P, Vector=draw_8.V, Colour=draw_8.C, Width=draw_8.W)

move_configurations_3 = Data(py_14.configurations)  # disabled

# ----
# Generate 'pick and place' commands
list_25 = ValueList({"1A. pick_to_pickup_safe": 0, "1B. pickup_safe_to_placing_safe": 1, "1C. placing_safe_to_placing": 2, "2. placing_to_pickup_safe": 3, "3. pick_and_place": 4}, selected="1A. pick_to_pickup_safe")  # disabled
radius_5 = Slider(0.01, range=0..0.1)  # disabled
number_slider_17 = Slider(0.1, range=0..0.1)  # disabled
pick_configurations_2 = Data([-0.7378762823, -1.645309655, 1.740348054, -0.3678008479, -0.3738495375, -0.1107411527])  # disabled
send_19 = Button()  # disabled
generate_ur_script_2 = PythonScript(
    robot=robot,
    start_configuration=start_configurations,
    joints_pick_cartesian=pick_configurations_2,
    joints_move_freemotion=move_configurations_3,
    joints_move_cartesian=move_configurations,
    joints_place_cartesian=place_configurations,
    routine=list_25,
    velocity=number_slider_17,
    radius=radius_5,
    in_world=show_in_world)  # -> out, urscript; inputs joints_pick_cartesian: list, joints_move_freemotion: list, joints_move_cartesian: list, joints_place_cartesian: list, routine: Int32; disabled
# ---------- generate_ur_script_2: Python ----------
from ur_fabrication_control.direct_control import URScript
from ur_fabrication_control.direct_control.mixins import AreaGripMixins

import math
from scriptcontext import sticky as st
import Rhino.Geometry as rg

from compas.geometry import Frame, Transformation


class URScript_RSRD(URScript, AreaGripMixins):
    pass

tool_angle_axis = list(robot.attached_tool.frame.point) + list(robot.attached_tool.frame.axis_angle_vector)
sleep = 3.0

def plane_to_frame_OCF(plane_WCS):
    frame_WCS = Frame(plane_WCS.Origin, plane_WCS.XAxis, plane_WCS.YAxis)
    if in_world:
        T = robot.transformation_WCF_OCF()
    else:
        T = Transformation()
    frame_WCS.transform(T)
    return frame_WCS

    
#traj_frames = []
#for plane in traj_planes_WCF:
#    traj_frames.append(plane_to_frame(plane))

if joints_pick_cartesian:
    print(joints_pick_cartesian[-1].joint_values)

    
# pick_to_pickup_safe
if routine == 0:
    commands = URScript_RSRD()
    commands.start()
    commands.set_tcp(tool_angle_axis)
    #commands.areagrip_on()  
    commands.moves_joint([joint_pick_cartesian for joint_pick_cartesian in joints_pick_cartesian[::-1]], velocity)
    commands.add_line("\tsleep({})".format(2.0))
    #commands.moves_joint([joint_pick_cartesian for joint_pick_cartesian in joints_pick_cartesian], velocity)
    #commands.areagrip_off()  
    commands.end()      
#
## pick_to_pickup_safe
#if routine == 0:
#    commands = URScript_RSRD()
#    commands.start()
#    commands.set_tcp(tool_angle_axis)
#    commands.areagrip_on()  
#    commands.moves_joint([joint_pick_cartesian for joint_pick_cartesian in joints_pick_cartesian[::-1]], velocity)
#    commands.add_line("\tsleep({})".format(sleep))
#    commands.moves_joint([joint_pick_cartesian for joint_pick_cartesian in joints_pick_cartesian], velocity)
#    #commands.areagrip_off()  
#    commands.end()  
#    
## pickup_safe_to_placing_safe
#if routine == 1:
#    commands = URScript_RSRD()
#    commands.start()
#    commands.set_tcp(tool_angle_axis)
#    commands.moves_joint([joint_move_cartesian for joint_move_cartesian in joints_move_cartesian], velocity)
#    commands.end()    
    
# pickup_safe_to_placing_safe
if routine == 1:
    commands = URScript_RSRD()
    commands.start()
    commands.set_tcp(tool_angle_axis)
    commands.moves_joint([joint_move_freemotion for joint_move_freemotion in joints_move_freemotion], velocity)
    commands.end()    

# placing_safe_to_placing
if routine == 2:
    commands = URScript_RSRD()
    commands.start()
    commands.set_tcp(tool_angle_axis)
    commands.moves_joint([joint_place_cartesian for joint_place_cartesian in joints_place_cartesian], velocity)
    commands.end()   

# placing_to_pickup_safe
if routine == 3:
    commands = URScript_RSRD()
    commands.start()
    commands.set_tcp(tool_angle_axis)
    commands.areagrip_off() 
    commands.moves_joint([joint_place_cartesian for joint_place_cartesian in joints_place_cartesian[::-1]], velocity)
    commands.moves_joint([joint_move_cartesian for joint_move_cartesian in joints_move_cartesiann[::-1]], velocity)
    commands.end()   

#  pick and place
if routine == 4:
    commands = URScript_RSRD()
    commands.start()
    commands.set_tcp(tool_angle_axis)
    commands.areagrip_on()  
    commands.moves_joint([joint_pick_cartesian for joint_pick_cartesian in joints_pick_cartesian[::-1]], velocity)
    commands.add_line("\tsleep({})".format(sleep))
    commands.moves_joint([joint_pick_cartesian for joint_pick_cartesian in joints_pick_cartesian], velocity)
    commands.moves_joint([joint_move_cartesian for joint_move_cartesian in joints_move_cartesian], velocity)
    commands.moves_joint([joint_place_cartesian for joint_place_cartesian in joints_place_cartesian], velocity)
    commands.add_line("\tsleep({})".format(sleep))
    commands.areagrip_off() 
    commands.moves_joint([joint_place_cartesian for joint_place_cartesian in joints_place_cartesian[::-1]], velocity)
    commands.moves_joint([joint_move_cartesian for joint_move_cartesian in joints_move_cartesiann[::-1]], velocity)
    commands.end()   


urscript = commands.generate()

print(urscript)
# ---------- end generate_ur_script_2 ----------
send_20 = GhPythonScript(urscript=generate_ur_script_2.urscript, send=send_19)  # -> out; inputs send: Boolean; disabled; same code as send_18
panel_31 = Panel(generate_ur_script_2.out)  # disabled

# ----
# Move Circular
clear_7 = Button()  # disabled
list_26 = ValueList({"send all positions": 0, "send only one position": 1, "from inverse": 2}, selected="from inverse")  # disabled
add_8 = Button()  # disabled
idx_8 = Slider(0, range=0..100)  # disabled
crv_12 = Curve(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)  # disabled
hframes_4 = HorizontalFrames(Curve=crv_12, Count=10)  # -> Frames, Parameters; disabled
rec_viacar = PythonScript(msg=pose_3.plane_WCS, rec=add_8, clear=clear_7)  # -> rec; disabled; same code as rec
item_7 = ListItem(List=hframes_4.Frames, Index=idx_8, Wrap=True)  # disabled
filter_11 = StreamFilter(Gate=list_26, Stream0=hframes_4.Frames, Stream1=item_7, Stream2=rec_car)  # disabled
filter_12 = StreamFilter(Gate=list_26, Stream0=hframes_4.Frames, Stream1=item_7, Stream2=rec_viacar)  # disabled
number_slider_18 = Slider(0.075, range=0..0.5)  # disabled
radius_6 = Slider(0.5, range=0..0.5)  # disabled
send_21 = Button()  # disabled

movec = PythonScript(planes_WCS=filter_11, planes_via_WCS=filter_12, velocity=number_slider_18, radius=radius_6)  # -> urscript; inputs planes_WCS: list, planes_via_WCS: list; disabled
# ---------- movec: Python ----------
import Rhino.Geometry as rg
from compas.geometry import Frame
from compas.geometry import Transformation, Rotation
from compas_ghpython import draw_frame
from compas_fab.robots import robot
from ur_fabrication_control import direct_control 
import math

from scriptcontext import sticky as st
from ur_fabrication_control.direct_control import URScript

robot = st["robot"]

# retrieve the current tool frame in axis angle format
if robot.attached_tool:
    tool_angle_axis = list(robot.attached_tool.frame.point) + list(robot.attached_tool.frame.axis_angle_vector)
else:
    tool0_frame = Frame([0, 0, 0], [1, 0, 0], [0, 1, 0])
    tool_angle_axis = list(tool0_frame.point) + list(tool0_frame.axis_angle_vector)

frames_RCS = []
for plane_WCS in planes_WCS:
    frame_WCS = Frame(plane_WCS.Origin, plane_WCS.XAxis, plane_WCS.YAxis)
    frame_RCS = robot.to_local_coordinates(frame_WCS)
    frames_RCS.append(frame_RCS)

frames_via_RCS = []
for plane_WCS in planes_via_WCS:
    frame_WCS = Frame(plane_WCS.Origin, plane_WCS.XAxis, plane_WCS.YAxis)
    frame_RCS = robot.to_local_coordinates(frame_WCS)
    frames_via_RCS.append(frame_RCS)

urscript = URScript()
urscript.start()
urscript.moves_circular(frames_via_RCS, frames_RCS, velocity, radius)
urscript.end()

urscript = urscript.generate()

print(urscript)
# ---------- end movec ----------

send_22 = GhPythonScript(urscript=movec, send=send_21)  # -> out; inputs send: Boolean; disabled; same code as send_2
