# Grasshopper definition 00_comobrick_final_design.ghx (Grasshopper 1.0.7)

# ----
# Brick
# Predefine a brick element and its dimensions
# Visualise the defined element
show = BooleanToggle(False)
elem_def = GhPythonScript()  # -> out, elem_full, elem_half
# ---------- elem_def: Python ----------
import os
import sys
import json

from compas.geometry import Frame
from compas.geometry import Vector
from compas.geometry import Box

from cooperative_mobile_brickwork.assembly import Element


# dimensions full brick
width = 0.11
length = 0.235
height = 0.052

elem_full = Element.from_dimensions(length, width, height)
elem_full.tool_frame = Frame([0, 0, height], [1, 0, 0], [0, -1, 0])

elem_half = Element.from_dimensions(length/2, width, height)
elem_half.tool_frame = Frame([0, 0, height], [1, 0, 0], [0, -1, 0])
# ---------- end elem_def ----------
draw = PythonScript(elem_full=elem_def.elem_full, elem_half=elem_def.elem_half, show=show)  # -> M, F, S
# ---------- draw: Python ----------
from compas.geometry import Transformation
from compas.geometry import Frame
from compas.datastructures import mesh_transformed
from compas.artists import Artist

if show:
    M = [Artist(elem_full.mesh).draw()]
    F = [Artist(elem_full.frame).draw()]
    #S = [Artist(elem_full._source.frame).draw()]
    S = [Artist(elem_full.tool_frame).draw()]
    
    
    M = [Artist(elem_half.mesh).draw()]
    F = [Artist(elem_half.frame).draw()]
    #S = [Artist(elem_half._source.frame).draw()]
    S = [Artist(elem_half.tool_frame).draw()]
# ---------- end draw ----------

# ----
# Brick
# Predefine a brick element and its dimensions
# Visualise the defined element
show_2 = BooleanToggle(False)
elem_def_2 = GhPythonScript()  # -> out, elem_full, elem_half; same code as elem_def
draw_2 = PythonScript(elem_full=elem_def_2.elem_full, elem_half=elem_def_2.elem_half, show=show_2)  # -> M, F, S; same code as draw

layers = Slider(10, range=2..30)
layers_2 = Slider(21, range=2..30)

py = PythonScript()  # -> HERE, DATA
# ---------- py: Python ----------
import os

HERE = os.path.dirname(ghdoc.Path)
DATA = os.path.abspath(os.path.join(HERE, "..", "data"))
print(HERE)
print(DATA)
# ---------- end py ----------

layers_3 = Slider(20, range=2..30)
layers_4 = Slider(19, range=2..30)

crv = Curve(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)
crv_2 = Curve(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)
list = ValueList({"rotation_factor": 1, "attractor_points": 2}, selected="attractor_points")
list_2 = ValueList({"rotation_factor": 1, "attractors_points": 2}, selected="attractors_points")

# ----
# Assembly
angle1 = Slider(42, range=-30.01..60)
angle2 = Slider(0.8, range=0..100.01)
layers_5 = Slider(20, range=0..30)
crv_3 = Curve(<curve referenced from the Rhino model>)
python = GhPythonScript(
    input_crv=crv_3,
    angle1=angle1,
    angle2=angle2,
    num=layers_5,
    offset_step=Slider(0.02, range=0..0.035),
    before_layer_num=layers_4,
    after_layer_num=layers_3,
    bricklen="0.235",
    interval="0.072")  # -> out, plane_grid, offset_curves, curves, planes; inputs input_crv: Curve, num: Int32
# ---------- python: Python ----------
import Rhino.Geometry as rg
import math as m
import rhinoscriptsyntax as rs
from Rhino.Geometry import CurveOffsetCornerStyle as cs

#new_curve = input_crv.Trim(0.1, 0.2)

start_pts = []
end_pts = []
curves = []
offset_curves = []

def list_from_2darray(array):
    return [item for sublist in array for item in sublist]
    
def create_curves(input_crv, angle1, angle2, interval, num):

    offset = 0
    
    for i in range(num):
        # duplicate and translate a new curve
        new_curve = rg.Curve.DuplicateCurve(input_crv)
        new_curve.Translate(rg.Vector3d.ZAxis*interval*i)
        
        # get the plane on which the new curve lies
        #crv_plane = rg.Plane(new_curve.PointAtStart, new_curve.PointAtEnd, new_curve.PointAtNormalizedLength(0.5))
        crv_plane = rg.Plane(new_curve.PointAtStart, rg.Vector3d.ZAxis)
        # compute an offset value based on layer number
        if i < before_layer_num:
            offset += offset_step
        elif i > after_layer_num:
            offset -= offset_step
        
        # offset the new curve
        offset_crv = rg.Curve.Offset(new_curve, crv_plane, -offset, 0.01, cs.None)[0]
        
        # for visualization
        offset_curves.append(offset_crv)
        
        # rotate the new curve around the axis defined by its end points (angle1); 
        # add an additional rotation of the curve based on layer number (angle2*i)
        rot_vector = rg.Vector3d(input_crv.PointAtStart) - rg.Vector3d(input_crv.PointAtEnd)
        offset_crv.Rotate(m.radians(-angle1-(i*angle2)), rot_vector, input_crv.PointAtNormalizedLength(0.5))
        
        # add the new curve to the list of curves
        curves.append(offset_crv)
    return curves

def create_planegrid(input_crv, angle1, angle2, interval, num, bricklen):

    curves = create_curves(input_crv, angle1, angle2, interval, num)
    
    plane_grid = []
    offset = 0
    for j, c in enumerate(curves):
        
        #new_start_pt = c.PointAtNormalizedLength(value_list[j])
        new_start_pt = c.PointAtNormalizedLength(0.04*(j/10.))
        c.SetStartPoint(new_start_pt)
    
        row = []

        #vparams = rg.Curve.DivideByCount(c, cols, True)
        vparams = rg.Curve.DivideByLength(c, 0.1325, True)
        planes = rg.Curve.GetPerpendicularFrames(c, vparams)

        for i, plane in enumerate(planes):
            
            plane.Rotate(m.radians(-90), plane.YAxis)
            plane.Rotate(m.radians(-90), plane.XAxis)

            if j%2 == 0 and i%2 == 0: #even course
                if i < 9:
                    plane.Translate(plane.XAxis*+0.0/i) # 0.0
                    plane.Rotate(m.radians(0), plane.ZAxis)
                elif i > len(planes)-11:
                    plane.Translate(plane.XAxis*-0.2/i) # 0.1
                    plane.Rotate(m.radians(0), plane.ZAxis)
                    
                row.append(plane)
                
            if j%2 == 1 and i%2 == 1: #odd course
                if i < 9:
                    plane.Translate(plane.XAxis*+0.01/i) # 0.02
                elif i > len(planes)-8:
                    plane.Translate(plane.XAxis*-0.4/i*(i/50)) # 0.1

                row.append(plane)

        plane_grid.append(row)
    return plane_grid

plane_grid = create_planegrid(input_crv, angle1, angle2, interval, num, bricklen)
planes = list_from_2darray(plane_grid)
# ---------- end python ----------
crv_4 = Curve(python.offset_curves)
pln = Plane(python.planes)
pt = Point([<point referenced from the Rhino model> x3])
generate_assembly = GhPythonScript(
    plane_grid=python.plane_grid,
    rot_mode=list_2,
    rot_factor1=Slider(20, range=0..100),
    rot_factor2=Slider(5, range=0..100),
    attr_pts=pt,
    elem_full=elem_def_2.elem_full)  # -> assembly; inputs plane_grid: list, attr_pts: list of Point3d
# ---------- generate_assembly: Python ----------
import Rhino.Geometry as rg
import math
from scriptcontext import sticky as st

from compas.geometry import Frame
from compas.geometry import Transformation

from compas_ghpython import draw_frame

from cooperative_mobile_brickwork.assembly import Assembly

import Rhino.Geometry as rg


assembly = Assembly() # initialize an empty assembly class

current_course = 0
for j, row in enumerate(plane_grid):
    for i, plane in enumerate(row):
        
        new_plane = rg.Plane(plane)
        
        if rot_mode == 1:
            rotval1 = math.sin(i/8)*rot_factor1
            #rotval2 = math.sin(i/6)*rot_factor2 
            rotval2 = -rot_factor2
        
        if rot_mode == 2:
            min_dist = 1.50
            for attr_pt in attr_pts:
                dist =  attr_pt.DistanceTo(new_plane.Origin)
                #print dist
                if dist < min_dist: 
                    min_dist = dist
            dist = min_dist
            
            rot_val = (dist/10)*0.4
            angle = math.radians(rot_val**2)*5000

#            if i < 2:
#               angle = 0

        #print 'course:', j, 'brick:', i, 'angle: ' , math.degrees(angle)
        
        if j%2==0: #even layers
            new_plane.Rotate(angle, plane.ZAxis, plane.Origin)
        else:
            new_plane.Rotate(-angle, plane.ZAxis, plane.Origin)
        
        T = Transformation.from_frame_to_frame(Frame.worldXY(), Frame(new_plane.Origin, new_plane.XAxis, new_plane.YAxis))
        
        
        if plane.OriginZ > 0.35:
        #if True:
            e = elem_full.transformed(T)
            assembly.add_element(e)


if transform:
    T = Transformation.from_frame_to_frame(Frame.worldXY(), Frame(ptransf.Origin, ptransf.XAxis, ptransf.YAxis))
    assembly.transform(T)
# ---------- end generate_assembly ----------

show_3 = BooleanToggle(False)
update_network = PythonScript(DATA=py.DATA, compute_interfaces_numpy=show_3, assembly=generate_assembly)  # -> assembly
# ---------- update_network: Python ----------
from assembly_information_model.assembly.courses import assembly_courses, assembly_with_interfaces_courses


if compute_interfaces_numpy:
    import os
    from compas.rpc import Proxy
    from assembly_information_model.assembly import Assembly
    p = Proxy('cooperative_mobile_brickwork.assembly.interfaces_numpy')
    p.stop_server()
    p.start_server()

    filename_before = "brickwall_ex2.json"
    filename_after = "brickwall_interfaces_ex2.json"

    PATH_BEFORE = os.path.join(DATA, filename_before)
    PATH_AFTER = os.path.join(DATA, filename_after)
    
    # the assembly has to be serialized such that it can be called from CPython
    assembly.to_json(PATH_BEFORE)
    
    # call the CPython Function using COMPAS RPC
    p.assembly_interfaces_numpy_fromtojson(PATH_BEFORE, PATH_AFTER, nmax=10, tmax= 0.04, amin = 0.00001)

    assembly = Assembly.from_json(PATH_AFTER)


# now compute the courses
assembly_courses(assembly)

# example test: get the bottom keys
c_min = min(assembly.network.nodes_attribute(name='course'))
#print(c_min)
#keys_on_bottom = list(assembly.network.edges_where({'course': c_min}))
#print(keys_on_bottom)

# example test: get the top keys
c_max = max(assembly.network.nodes_attribute(name='course'))
##print(c_max)
#keys_on_top = list(assembly.network.edges_where({'course': c_max}))
#print(keys_on_top)
# ---------- end update_network ----------

# ----
# to JSON
export = Button()
export_2 = Button()
export_3 = PythonScript(DATA=py.DATA, assembly=update_network, export_to_json=export, export_to_json_unity=export_2)
# ---------- export_3: Python ----------
import os
from compas.datastructures.mesh import mesh_quads_to_triangles
from compas.datastructures.mesh import mesh_unify_cycles

if export_to_json:
    
    filename = "brickwall_ex1.json"
    PATH = os.path.join(DATA, filename)
    
    # the assembly has to be serialized such that it can be called from CPython
    assembly.to_json(PATH)
    

if export_to_json_unity:
    
    for key, e in assembly.elements():
    
        #convert to trimesh
        mesh_quads_to_triangles(e._mesh, check_angles=False)
        #mesh_unify_cycles(e._mesh)
        #print e._mesh.faces
        #print e._mesh.face_vertices(list(e._mesh.faces())[0])

    filename = "brickwall_ex1_unity.json"
    PATH = os.path.join(DATA, filename)
    assembly.to_json(PATH)
# ---------- end export_3 ----------

crv_5 = Curve(python.curves)

# ----
# Brick Vault large
series = Series(Start=0, Step=1, Count=20)
midpt = CurveMiddle(Curve=crv_5)
tag = TextTag(Location=midpt, Text=series)
total = GhPythonScript(assembly=generate_assembly)  # -> out
# ---------- total: Python ----------
brick_weight = 3.2

total_bricks = assembly.number_of_elements()
total_weight_bricks = total_bricks*brick_weight
#total_weight_mortar = 

print total_bricks, 'bricks total.'
print total_weight_bricks, 'kg', 'weight bricks.'
print '??? kg', 'weight mortar.'
# ---------- end total ----------
panel = Panel(total)

key = Slider(40, range=0..388)
till_key = Button()
start = Button()
reset = Button()
stop = Button()
back = Button()
step = Button()
full = Button()
list_3 = ValueList({"20", "50", "100", "500", "1000", "5000"}, selected="50")

key_2 = Slider(349, range=0..388)
till_key_2 = Button()
start_2 = Button()
reset_2 = Button()
stop_2 = Button()
back_2 = Button()
step_2 = Button()
full_2 = Button()
list_4 = ValueList({"20", "50", "100", "500", "1000", "5000"}, selected="50")

# ----
# Network Viz
number_slider = Slider(0, range=0..47)
show_4 = BooleanToggle(False)
network_viz = GhPythonScript(assembly=update_network, show_network=show_4, key=number_slider)  # -> out, nodes, edges, current_node, current_node_neighbors; inputs key: Int32
# ---------- network_viz: Python ----------
import sys, os
import ghpythonlib.components as ghcomp
from compas.datastructures import Network
from compas_ghpython.artists import NetworkArtist
from compas_rhino.geometry import RhinoLine

import compas_ghpython
import Rhino.Geometry as rg


data = assembly.network.to_data()
network = Network.from_data(data)

print assembly.network.number_of_nodes()

def draw_network(network):
    """Draw a network in Grasshopper.
    """
    points = []
    for key, attr in network.nodes(True):
        points.append({
            'pos': network.node_coordinates(key),
        })

    lines = []
    for (u, v), attr in network.edges(True):
        lines.append({
            'start': network.node_coordinates(u),
            'end': network.node_coordinates(v),
        })

    points_rg = compas_ghpython.draw_points(points)
    lines_rg = compas_ghpython.draw_lines(lines)

    return points_rg, lines_rg

if show_network:
    nodes, edges = draw_network(network)
    
    current_node = {'pos': network.node_coordinates(key), 'radius': 0.03}
    current_node = compas_ghpython.draw_spheres([current_node])
    
    current_node_neighbors_keys = network.neighbors(key)
    current_node_neighbors = [{'pos': network.node_coordinates(key), 'radius': 0.02} for key in current_node_neighbors_keys]
    current_node_neighbors = compas_ghpython.draw_spheres(current_node_neighbors)
# ---------- end network_viz ----------
pt_2 = Point(network_viz.nodes)
line = Line(network_viz.edges)
brep = Brep(network_viz.current_node)
brep_2 = Brep(network_viz.current_node_neighbors)
preview = CustomPreview(Geometry=[brep, line], Material=ColourSwatch(SwatchColor=RGB(0, 0, 0)))
preview_2 = CustomPreview(Geometry=brep_2, Material=ColourSwatch(SwatchColor=RGB(255, 207, 207)))

# ----
# Draw
# Visualise the entire assembly and its underlying network topology.
counter = CountThroughList(
    assembly=update_network,
    start=start_2,
    stop=stop_2,
    step=step_2,
    step_back=back_2,
    reset=reset_2,
    full=full_2,
    till_key=till_key_2,
    key=key_2,
    interval=list_4)  # -> item, counter; inputs start: Boolean, stop: Boolean, step_back: Boolean, key: Int32
# ---------- counter: Python ----------
from scriptcontext import sticky as st
from compas_ghpython import update_component


L = list(assembly.elements())
# store data in component
guid = str(ghenv.Component.InstanceGuid)
counter_key = "counter_" + guid
running_key = "running_" + guid

if counter_key not in st:
    st[counter_key] = 0

if running_key not in st:
    st[running_key] = False
    

if st[running_key]:
    if st[counter_key] < len(L) - 1:
        st[counter_key] += 1
        update_component(ghenv, interval)
    else:
        st[counter_key] = 0
        st[running_key] = False
    
    
if start:
    st[running_key] = True

if stop:
    st[running_key] = False

if step:
    if st[counter_key] < len(L) - 1:
        st[counter_key] += 1

if step_back:
    if  0 < st[counter_key] < len(L):
        st[counter_key] -= 1

if reset:
    st[counter_key] = 0

if till_key:
    st[counter_key] = key

if full:
    st[counter_key] = len(L)-1

if len(L):
    item = L[st[counter_key]]



#st["visualisation_counter"] = st[counter_key]
#st[counter_key]= 500
counter = st[counter_key]
# ---------- end counter ----------
idx = Panel(counter.counter)

# ---- group: Assembly Artist
show_5 = BooleanToggle(False)
show_6 = BooleanToggle(False)
draw_3 = PythonScript(assembly=generate_assembly, show_all=show_5, show_counter=show_6, counter=counter.counter)  # -> G, tool_planes_WCS, current_tool_plane; inputs counter: Int32
# ---------- draw_3: Python ----------
import os
import sys

import math

from compas.colors import Color
from compas.artists import Artist


G = []
color = Color.from_rgb255(243,169,137)

key_index = assembly.network.key_index()
keys = [key_index[key] for key in assembly.network.nodes()]
elements = [assembly.element(key) for key in keys]
#print elements
#print([(e.gripping_frame) for e in elements])

tool_planes_WCS = [Artist(e.tool_frame).draw() for e in elements]

current_tool_plane = tool_planes_WCS[counter]

if show_all and not show_counter:
    for element in elements:
        mesh = Artist(element.mesh).draw(color)
        G.append(mesh)

if show_counter:
    for element in elements[0:counter+1]:
        mesh = Artist(element.mesh).draw(color)
        G.append(mesh)
# ---------- end draw_3 ----------
pln_2 = Plane(draw_3.current_tool_plane)
geo = Geometry(draw_3.G)
pln_3 = Plane(draw_3.tool_planes_WCS)
preview_3 = CustomPreview(Geometry=geo, Shader=ColourSwatch(SwatchColor=RGB(243, 169, 137)))
preview_4 = CustomPreview(Geometry=pln_3, Shader=ColourSwatch(SwatchColor=RGB(178, 178, 178)))

# ----
# Brick Vault small
py_2 = PythonScript()  # -> HERE, DATA; same code as py
series_2 = Series(Start=0, Step=1, Count=20)

# ----
# Assembly
angle1_2 = Slider(44, range=-44..60)
angle2_2 = Slider(0.6, range=0..100.01)
layers_6 = Slider(16, range=0..30)
crv_6 = Curve(<curve referenced from the Rhino model>)
pt_3 = Point([<point referenced from the Rhino model> x2])

python_2 = GhPythonScript(num=layers_6)  # -> out, value_list; inputs num: Int32
# ---------- python_2: Python ----------
value_list = []

if num:
    for n in range(num):
        value = 0.04*(n/12.)
        #value = 0
        value_list.append(value)

#value_list[0] = 0.0
#value_list[1] = 0.0
#value_list[2] += 0.01
#value_list[3] += 0.01
#value_list[4] += 0.01
#value_list[5] += 0.01
value_list[6] += 0.003
value_list[7] += 0.005
value_list[8] += 0.005
value_list[9] += 0.012
value_list[10] += 0.005
value_list[11] += 0.005
#value_list[12] -= 0.03
value_list[13] -= 0.002
#value_list[14] = 0.01
#value_list[15] = 0.01
#value_list[16] = 0.0
#value_list[17] = 0.0
#value_list[18] = 0.0
#value_list[19] = 0.00
# ---------- end python_2 ----------

python_3 = GhPythonScript(
    input_crv=crv_6,
    angle1=angle1_2,
    angle2=angle2_2,
    num=layers_6,
    value_list=python_2.value_list,
    offset_step=Slider(0.02, range=-0.1..0.025),
    before_layer_num=layers,
    after_layer_num=layers_2,
    bricklen="0.235",
    interval="0.073")  # -> out, plane_grid, curves, planes; inputs input_crv: Curve, num: Int32, value_list: list
# ---------- python_3: Python ----------
import Rhino.Geometry as rg
import math as m
import rhinoscriptsyntax as rs
from Rhino.Geometry import CurveOffsetCornerStyle as cs

#new_curve = input_crv.Trim(0.1, 0.2)

start_pts = []
end_pts = []
curves = []
offset_curves = []

def list_from_2darray(array):
    return [item for sublist in array for item in sublist]
    
def create_curves(input_crv, angle1, angle2, interval, num):

    offset = 0
    
    for i in range(num):
        # duplicate and translate a new curve
        new_curve = rg.Curve.DuplicateCurve(input_crv)
        new_curve.Translate(rg.Vector3d.ZAxis*interval*i)
        
        # get the plane on which the new curve lies
        #crv_plane = rg.Plane(new_curve.PointAtStart, new_curve.PointAtEnd, new_curve.PointAtNormalizedLength(0.5))
        crv_plane = rg.Plane(new_curve.PointAtStart, rg.Vector3d.ZAxis)
        # compute an offset value based on layer number
        if i < before_layer_num:
            offset += offset_step
        elif i > after_layer_num:
            offset -= offset_step
        
        # offset the new curve
        offset_crv = rg.Curve.Offset(new_curve, crv_plane, -offset, 0.01, cs.Sharp)[0]
        
        # for visualization
        offset_curves.append(offset_crv)
        
        # rotate the new curve around the axis defined by its end points (angle1); 
        # add an additional rotation of the curve based on layer number (angle2*i)
        rot_vector = rg.Vector3d(input_crv.PointAtStart) - rg.Vector3d(input_crv.PointAtEnd)
        offset_crv.Rotate(m.radians(-angle1-(i*angle2)), rot_vector, input_crv.PointAtNormalizedLength(0.5))
        
        # add the new curve to the list of curves
        curves.append(offset_crv)
    return curves

def create_planegrid(input_crv, angle1, angle2, interval, num, bricklen):

    curves = create_curves(input_crv, angle1, angle2, interval, num)
    
    plane_grid = []
    offset = 0
    for j, c in enumerate(curves):
        
        new_start_pt = c.PointAtNormalizedLength(value_list[j])
        #new_start_pt = c.PointAtNormalizedLength(0.04*(j/10.))
        c.SetStartPoint(new_start_pt)
    
        row = []

        #vparams = rg.Curve.DivideByCount(c, cols, True)
        vparams = rg.Curve.DivideByLength(c, 0.132, True)
        planes = rg.Curve.GetPerpendicularFrames(c, vparams)

        for i, plane in enumerate(planes):
            
            plane.Rotate(m.radians(-90), plane.YAxis)
            plane.Rotate(m.radians(-90), plane.XAxis)

            if j%2 == 0 and i%2 == 0: #even course
                if i < 8:
                    #plane.Translate(plane.XAxis*0.02*(i/10.))
                    plane.Translate(plane.XAxis*0.025/i)
                    plane.Rotate(m.radians(0), plane.ZAxis)
                elif i > len(planes)-8:
                    plane.Translate(plane.XAxis*0.0/i)
                    plane.Rotate(m.radians(0), plane.ZAxis)
                    
                row.append(plane)
                
            if j%2 == 1 and i%2 == 1: #odd course
                if i < 8:
                    plane.Translate(plane.XAxis*0.025/i)
                elif i > len(planes)-8:
                    plane.Translate(plane.XAxis*-0.0/i)

                row.append(plane)

        plane_grid.append(row)
    return plane_grid

plane_grid = create_planegrid(input_crv, angle1, angle2, interval, num, bricklen)
planes = list_from_2darray(plane_grid)
# ---------- end python_3 ----------
pln_4 = Plane(python_3.planes)
crv_7 = Curve(python_3.curves)
generate_assembly_2 = GhPythonScript(
    plane_grid=python_3.plane_grid,
    rot_mode=list,
    rot_factor1=Slider(25, range=0..100),
    rot_factor2=Slider(0, range=0..100),
    attr_pts=pt_3,
    elem_full=elem_def.elem_full)  # -> assembly; inputs plane_grid: list, attr_pts: list of Point3d
# ---------- generate_assembly_2: Python ----------
import Rhino.Geometry as rg
import math
from scriptcontext import sticky as st

from compas.geometry import Frame
from compas.geometry import Transformation

from compas_ghpython import draw_frame

from cooperative_mobile_brickwork.assembly import Assembly

import Rhino.Geometry as rg


assembly = Assembly() # initialize an empty assembly class

current_course = 0
for j, row in enumerate(plane_grid):
    for i, plane in enumerate(row):
        
        new_plane = rg.Plane(plane)
        
        if rot_mode == 1:
            rotval1 = math.sin(i/8)*rot_factor1
            #rotval2 = math.sin(i/6)*rot_factor2 
            rotval2 = -rot_factor2
        
        if rot_mode == 2:
            min_dist = 1.50
            for attr_pt in attr_pts:
                dist =  attr_pt.DistanceTo(new_plane.Origin)
                #print dist
                if dist < min_dist: 
                    min_dist = dist
            dist = min_dist
            
            rot_val = (dist/10)*0.4
            angle = math.radians(rot_val**2)*5000

#            if j < 3:
#               angle = 0

        #print 'course:', j, 'brick:', i, 'angle: ' , math.degrees(angle)
        
        if j%2==0: #even layers
            new_plane.Rotate(angle, plane.ZAxis, plane.Origin)
        else:
            new_plane.Rotate(-angle, plane.ZAxis, plane.Origin)
        
        T = Transformation.from_frame_to_frame(Frame.worldXY(), Frame(new_plane.Origin, new_plane.XAxis, new_plane.YAxis))
        
        
        if plane.OriginZ > 0.35:
        #if True:
            e = elem_full.transformed(T)
            assembly.add_element(e)


if transform:
    T = Transformation.from_frame_to_frame(Frame.worldXY(), Frame(ptransf.Origin, ptransf.XAxis, ptransf.YAxis))
    assembly.transform(T)
# ---------- end generate_assembly_2 ----------

show_7 = BooleanToggle(False)
update_network_2 = PythonScript(DATA=py_2.DATA, compute_interfaces_numpy=show_7, assembly=generate_assembly_2)  # -> assembly
# ---------- update_network_2: Python ----------
from assembly_information_model.assembly.courses import assembly_courses, assembly_with_interfaces_courses


if compute_interfaces_numpy:
    import os
    from compas.rpc import Proxy
    from assembly_information_model.assembly import Assembly
    p = Proxy('cooperative_mobile_brickwork.assembly.interfaces_numpy')
    p.stop_server()
    p.start_server()

    filename_before = "brickwall_ex2.json"
    filename_after = "brickwall_interfaces_ex2.json"

    PATH_BEFORE = os.path.join(DATA, filename_before)
    PATH_AFTER = os.path.join(DATA, filename_after)
    
    # the assembly has to be serialized such that it can be called from CPython
    assembly.to_json(PATH_BEFORE)
    
    # call the CPython Function using COMPAS RPC
    p.assembly_interfaces_numpy_fromtojson(PATH_BEFORE, PATH_AFTER, nmax=10, tmax = 0.06, amin = 0.0001)

    assembly = Assembly.from_json(PATH_AFTER)


# now compute the courses
assembly_courses(assembly)

# example test: get the bottom keys
c_min = min(assembly.network.nodes_attribute(name='course'))
#print(c_min)
#keys_on_bottom = list(assembly.network.vertices_where({'course': c_min}))
#print(keys_on_bottom)

# example test: get the top keys
c_max = max(assembly.network.nodes_attribute(name='course'))
#print(c_max)
#keys_on_top = list(assembly.network.vertices_where({'course': c_max}))
#print(keys_on_top)
# ---------- end update_network_2 ----------

# ----
# to JSON
export_4 = Button()
export_5 = Button()
export_6 = PythonScript(DATA=py_2.DATA, assembly=update_network_2, export_to_json=export_4, export_to_json_unity=export_5)  # same code as export_3

midpt_2 = CurveMiddle(Curve=crv_7)
tag_2 = TextTag(Location=midpt_2, Text=series_2)
total_2 = GhPythonScript(assembly=generate_assembly_2)  # -> out; same code as total
panel_2 = Panel(total_2)

# ----
# Network Viz
number_slider_2 = Slider(0, range=0..47)
show_8 = BooleanToggle(False)
network_viz_2 = GhPythonScript(assembly=update_network_2, show_network=show_8, key=number_slider_2)  # -> out, nodes, edges, current_node, current_node_neighbors; inputs key: Int32; same code as network_viz
line_2 = Line(network_viz_2.edges)
pt_4 = Point(network_viz_2.nodes)
brep_3 = Brep(network_viz_2.current_node)
brep_4 = Brep(network_viz_2.current_node_neighbors)
preview_5 = CustomPreview(Geometry=[brep_3, line_2], Material=ColourSwatch(SwatchColor=RGB(0, 0, 0)))
preview_6 = CustomPreview(Geometry=brep_4, Material=ColourSwatch(SwatchColor=RGB(255, 207, 207)))

# ----
# Draw
# Visualise the entire assembly and its underlying network topology.
counter_2 = CountThroughList(
    assembly=generate_assembly_2,
    start=start,
    stop=stop,
    step=step,
    step_back=back,
    reset=reset,
    full=full,
    till_key=till_key,
    key=key,
    interval=list_3)  # -> item, counter; inputs start: Boolean, stop: Boolean, step_back: Boolean, key: Int32; same code as counter
idx_2 = Panel(counter_2.counter)

# ---- group: Assembly Artist
show_9 = BooleanToggle(False)
show_10 = BooleanToggle(False)
draw_4 = PythonScript(assembly=generate_assembly_2, show_all=show_9, show_counter=show_10, counter=counter_2.counter)  # -> G, tool_planes_WCS, current_tool_plane; inputs counter: Int32; same code as draw_3
geo_2 = Geometry(draw_4.G)
pln_5 = Plane(draw_4.tool_planes_WCS)
pln_6 = Plane(draw_4.current_tool_plane)
preview_7 = CustomPreview(Geometry=geo_2, Shader=ColourSwatch(SwatchColor=RGB(243, 169, 137)))
preview_8 = CustomPreview(Geometry=pln_5, Shader=ColourSwatch(SwatchColor=RGB(178, 178, 178)))
