# Grasshopper definition ex2_brick_vault_001.ghx (Grasshopper 1.0.7)

py = PythonScript()  # -> HERE, DATA
# ---------- py: Python ----------
import os

HERE = os.path.dirname(ghdoc.Path)
DATA = os.path.abspath(os.path.join(HERE, "..", "data"))
print(HERE)
print(DATA)
# ---------- end py ----------

# ----
# Brick
# Predefine a brick element and its dimensions
# Visualise the defined element
show = BooleanToggle(False)
elem_def = GhPythonScript()  # -> out, elem_full, elem_half
# ---------- elem_def: Python ----------
import os
import sys
import json

from compas.geometry import Frame
from compas.geometry import Vector
from compas.geometry import Box

from cooperative_mobile_brickwork.assembly import Element


# dimensions full brick
width = 0.11
length = 0.235
height = 0.052

elem_full = Element.from_dimensions(length, width, height)
elem_full.tool_frame = Frame([0, 0, height], [1, 0, 0], [0, -1, 0])

elem_half = Element.from_dimensions(length/2, width, height)
elem_half.tool_frame = Frame([0, 0, height], [1, 0, 0], [0, -1, 0])
# ---------- end elem_def ----------
draw = PythonScript(elem_full=elem_def.elem_full, elem_half=elem_def.elem_half, show=show)  # -> M, F, S
# ---------- draw: Python ----------
from compas.geometry import Transformation
from compas.geometry import Frame
from compas.datastructures import mesh_transformed
from compas.artists import Artist

if show:
    M = [Artist(elem_full.mesh).draw()]
    F = [Artist(elem_full.frame).draw()]
    #S = [Artist(elem_full._source.frame).draw()]
    S = [Artist(elem_full.tool_frame).draw()]
    
    
    M = [Artist(elem_half.mesh).draw()]
    F = [Artist(elem_half.frame).draw()]
    #S = [Artist(elem_half._source.frame).draw()]
    S = [Artist(elem_half.tool_frame).draw()]
# ---------- end draw ----------

angle = Slider(0.8, range=0..1)
angle_2 = Slider(0, range=0..1)
layers = Slider(19, range=10..30)
layers_2 = Slider(7, range=2..30)
angle_3 = Slider(30.17, range=-100..50)
layers_3 = Slider(15, range=2..30)
crv = Curve(<curve referenced from the Rhino model>)

# ----
# Vault 1
number_slider = Slider(0, range=0..0.015)
python = GhPythonScript(
    input_crv=crv,
    angle=angle_3,
    angle_1=angle,
    angle_2=angle_2,
    num=layers,
    offset_step=number_slider,
    start_layer_num=layers_2,
    end_layer_num=layers_3,
    bricklen="0.25",
    interval="0.062")  # -> out, plane_grid, curves, planes; inputs input_crv: Curve, num: Int32
# ---------- python: Python ----------
import Rhino.Geometry as rg
import math as m
import rhinoscriptsyntax as rs

#new_curve = input_crv.Trim(0.1, 0.2)

start_pts = []
end_pts = []
curves = []

def list_from_2darray(array):
    return [item for sublist in array for item in sublist]
    
def create_curves(input_crv, angle, angle_2, interval, num):
    for i in range(num):
        new_curve = rg.Curve.DuplicateCurve(input_crv)
        new_curve.Translate(rg.Vector3d.ZAxis*interval*i)
        rot_vector = rg.Vector3d(input_crv.PointAtEnd) - rg.Vector3d(input_crv.PointAtStart)
        new_curve.Rotate(m.radians(-angle-(i*angle_2)), rot_vector, input_crv.PointAtNormalizedLength(0.5))
        curves.append(new_curve)
    return curves

def create_planegrid(input_crv, angle, angle_2, interval, num, bricklen):
    curves = create_curves(input_crv, angle, angle_2, interval, num)

    plane_grid = []
    offset = 0
    clen = curves[0].GetLength()
    cols = int(clen/(bricklen+0.01))*2
        
    for j, c in enumerate(curves):
        
        row = []

        vparams = rg.Curve.DivideByCount(c, cols, True)
        planes = rg.Curve.GetPerpendicularFrames(c, vparams)
        
        if j < start_layer_num:
            offset += offset_step
        elif j > end_layer_num:
            offset -= offset_step
            
        #print 'Layer =', j, ',', 'Offset =', offset*100, 'cm'
        
        for i, plane in enumerate(planes):
            
            plane.Rotate(m.radians(-90), plane.YAxis)
            plane.Rotate(m.radians(-90), plane.XAxis)
            plane.Translate(plane.YAxis*-offset)

            if j%2 == 0 and i%2 == 0: #even course
                if i==0:
                    #plane.Translate(plane.XAxis*-bricklen/4)
                    #plane.Translate(plane.YAxis*-bricklen/6)
                    plane.Rotate(m.radians(0), plane.ZAxis)
                elif i==len(planes)-1:
                    #plane.Translate(plane.XAxis*bricklen/4)
                    #plane.Translate(plane.YAxis*-bricklen/5)
                    plane.Rotate(m.radians(0), plane.ZAxis)
                row.append(plane)
            if j%2 == 1 and i%2 == 1: #odd course

                row.append(plane)

        plane_grid.append(row)
    return plane_grid

plane_grid = create_planegrid(input_crv, angle, angle_2, interval, num, bricklen)
planes = list_from_2darray(plane_grid)
# ---------- end python ----------
pln = Plane(python.planes)
generate_assembly = GhPythonScript(plane_grid=python.plane_grid, rot_factor=Slider(0, range=0..100), elem_full=elem_def.elem_full)  # -> assembly; inputs plane_grid: list
# ---------- generate_assembly: Python ----------
import Rhino.Geometry as rg
import math
from scriptcontext import sticky as st


from compas.geometry import Frame
from compas.geometry import Transformation
from compas.geometry import Rotation
from compas.geometry import Translation
from compas.geometry import Point

from compas_ghpython import draw_frame

from cooperative_mobile_brickwork.assembly import Assembly

import Rhino.Geometry as rg


assembly = Assembly() # initialize an empty assembly class


for j, row in enumerate(plane_grid):
    #print row
    for i, plane in enumerate(row):
        #print plane
        rotval1 = math.sin(i/6)*rot_factor
        rotval2 = math.sin(i/6)*rot_factor

        new_plane= rg.Plane(plane)
        
        if j%2==0: #even layers
            new_plane.Rotate(-math.radians(rotval1), plane.ZAxis, plane.Origin)
        else:
            new_plane.Rotate(math.radians(rotval2), plane.ZAxis, plane.Origin)
        
        T = Transformation.from_frame_to_frame(Frame.worldXY(), Frame(new_plane.Origin, new_plane.XAxis, new_plane.YAxis))
        
#        if j%2==0: #even layers
#            if i==0 or i==len(row)-1:
#                e = elem_half.transformed(T)
#            else:
#                e = elem_full.transformed(T)
#        else:
        if plane.OriginZ > 0.35:
            e = elem_full.transformed(T)
            assembly.add_element(e)


if transform:
    T = Transformation.from_frame_to_frame(Frame.worldXY(), Frame(ptransf.Origin, ptransf.XAxis, ptransf.YAxis))
    assembly.transform(T)
# ---------- end generate_assembly ----------

show_2 = BooleanToggle(False)
update_network = PythonScript(DATA=py.DATA, compute_interfaces_numpy=show_2, assembly=generate_assembly)  # -> assembly
# ---------- update_network: Python ----------
from cooperative_mobile_brickwork.assembly.courses import assembly_courses, assembly_with_interfaces_courses


if compute_interfaces_numpy:
    import os
    from compas.rpc import Proxy
    from cooperative_mobile_brickwork.assembly import Assembly
    p = Proxy('cooperative_mobile_brickwork.assembly.interfaces_numpy')
    p.stop_server()
    p.start_server()

    filename_before = "ex2_vault.json"
    filename_after = "ex2_vault_interfaces.json"

    PATH_BEFORE = os.path.join(DATA, filename_before)
    PATH_AFTER = os.path.join(DATA, filename_after)
    
    # the assembly has to be serialized such that it can be called from CPython
    assembly.to_json(PATH_BEFORE)
    
    # call the CPython Function using COMPAS RPC
    p.assembly_interfaces_numpy_fromtojson(PATH_BEFORE, PATH_AFTER, nmax=10, amin = 0.0001)

    assembly = Assembly.from_json(PATH_AFTER)


# now compute the courses
assembly_courses(assembly)

# example test: get the bottom keys
c_min = min(assembly.network.nodes_attribute(name='course'))
#print(c_min)
#keys_on_bottom = list(assembly.network.vertices_where({'course': c_min}))
#print(keys_on_bottom)

# example test: get the top keys
c_max = max(assembly.network.nodes_attribute(name='course'))
#print(c_max)
#keys_on_top = list(assembly.network.vertices_where({'course': c_max}))
#print(keys_on_top)
# ---------- end update_network ----------

# ----
# to JSON
export = Button()
export_2 = Button()
export_3 = PythonScript(DATA=py.DATA, assembly=update_network, export_to_json=export, export_to_json_unity=export_2)
# ---------- export_3: Python ----------
import os
from compas.datastructures.mesh import mesh_quads_to_triangles
from compas.datastructures.mesh import mesh_unify_cycles

if export_to_json:
    
    filename = "brickwall_ex1.json"
    PATH = os.path.join(DATA, filename)
    
    # the assembly has to be serialized such that it can be called from CPython
    assembly.to_json(PATH)
    

if export_to_json_unity:
    
    for key, e in assembly.elements():
    
        #convert to trimesh
        mesh_quads_to_triangles(e._mesh, check_angles=False)
        #mesh_unify_cycles(e._mesh)
        #print e._mesh.faces
        #print e._mesh.face_vertices(list(e._mesh.faces())[0])

    filename = "brickwall_ex1_unity.json"
    PATH = os.path.join(DATA, filename)
    assembly.to_json(PATH)
# ---------- end export_3 ----------

crv_2 = Curve(python.curves)

key = Slider(349, range=0..388)
till_key = Button()
start = Button()
reset = Button()
stop = Button()
back = Button()
step = Button()
full = Button()
list = ValueList({"20", "50", "100", "500", "1000", "5000"}, selected="50")

# ----
# Network Viz
number_slider_2 = Slider(0, range=0..47)
show_3 = BooleanToggle(False)
network_viz = GhPythonScript(assembly=update_network, show_network=show_3, key=number_slider_2)  # -> out, nodes, edges, current_node, current_node_neighbors; inputs key: Int32
# ---------- network_viz: Python ----------
import sys, os
import ghpythonlib.components as ghcomp
from compas.datastructures import Network
from compas_ghpython.artists import NetworkArtist
from compas_rhino.geometry import RhinoLine

import compas_ghpython
import Rhino.Geometry as rg


data = assembly.network.to_data()
network = Network.from_data(data)

print assembly.network.number_of_nodes()

def draw_network(network):
    """Draw a network in Grasshopper.
    """
    points = []
    for key, attr in network.nodes(True):
        points.append({
            'pos': network.node_coordinates(key),
        })

    lines = []
    for (u, v), attr in network.edges(True):
        lines.append({
            'start': network.node_coordinates(u),
            'end': network.node_coordinates(v),
        })

    points_rg = compas_ghpython.draw_points(points)
    lines_rg = compas_ghpython.draw_lines(lines)

    return points_rg, lines_rg

if show_network:
    nodes, edges = draw_network(network)
    
    current_node = {'pos': network.node_coordinates(key), 'radius': 0.03}
    current_node = compas_ghpython.draw_spheres([current_node])
    
    current_node_neighbors_keys = network.neighbors(key)
    current_node_neighbors = [{'pos': network.node_coordinates(key), 'radius': 0.02} for key in current_node_neighbors_keys]
    current_node_neighbors = compas_ghpython.draw_spheres(current_node_neighbors)
# ---------- end network_viz ----------
pt = Point(network_viz.nodes)
line = Line(network_viz.edges)
brep = Brep(network_viz.current_node)
brep_2 = Brep(network_viz.current_node_neighbors)
preview = CustomPreview(Geometry=[brep, line], Material=ColourSwatch(SwatchColor=RGB(0, 0, 0)))
preview_2 = CustomPreview(Geometry=brep_2, Material=ColourSwatch(SwatchColor=RGB(255, 207, 207)))

total = GhPythonScript(assembly=update_network)  # -> out
# ---------- total: Python ----------
brick_weight = 3.2

total_bricks = assembly.number_of_elements()
total_weight_bricks = total_bricks*brick_weight
#total_weight_mortar = 

print total_bricks, 'bricks total.'
print total_weight_bricks, 'kg', 'weight bricks.'
print '??? kg', 'weight mortar.'
# ---------- end total ----------
panel = Panel(total)

# ----
# Draw
# Visualise the entire assembly and its underlying network topology.
counter = CountThroughList(
    assembly=update_network,
    start=start,
    stop=stop,
    step=step,
    step_back=back,
    reset=reset,
    full=full,
    till_key=till_key,
    key=key,
    interval=list)  # -> item, counter; inputs start: Boolean, stop: Boolean, step_back: Boolean, key: Int32
# ---------- counter: Python ----------
from scriptcontext import sticky as st
from compas_ghpython import update_component


L = list(assembly.elements())
# store data in component
guid = str(ghenv.Component.InstanceGuid)
counter_key = "counter_" + guid
running_key = "running_" + guid

if counter_key not in st:
    st[counter_key] = 0

if running_key not in st:
    st[running_key] = False
    

if st[running_key]:
    if st[counter_key] < len(L) - 1:
        st[counter_key] += 1
        update_component(ghenv, interval)
    else:
        st[counter_key] = 0
        st[running_key] = False
    
    
if start:
    st[running_key] = True

if stop:
    st[running_key] = False

if step:
    if st[counter_key] < len(L) - 1:
        st[counter_key] += 1

if step_back:
    if  0 < st[counter_key] < len(L):
        st[counter_key] -= 1

if reset:
    st[counter_key] = 0

if till_key:
    st[counter_key] = key

if full:
    st[counter_key] = len(L)-1

if len(L):
    item = L[st[counter_key]]



#st["visualisation_counter"] = st[counter_key]
#st[counter_key]= 500
counter = st[counter_key]
# ---------- end counter ----------
idx = Panel(counter.counter)

# ---- group: Assembly Artist
show_4 = BooleanToggle(False)
show_5 = BooleanToggle(False)
draw_2 = PythonScript(assembly=update_network, show_all=show_4, show_counter=show_5, counter=counter.counter)  # -> G, tool_planes_WCS, current_tool_plane; inputs counter: Int32
# ---------- draw_2: Python ----------
import os
import sys

import math

from compas.colors import Color
from compas.artists import Artist


G = []
color = Color.from_rgb255(243,169,137)

key_index = assembly.network.key_index()
keys = [key_index[key] for key in assembly.network.nodes()]
elements = [assembly.element(key) for key in keys]
#print elements
#print([(e.gripping_frame) for e in elements])

tool_planes_WCS = [Artist(e.tool_frame).draw() for e in elements]

current_tool_plane = tool_planes_WCS[counter]

if show_all and not show_counter:
    for element in elements:
        mesh = Artist(element.mesh).draw(color)
        G.append(mesh)

if show_counter:
    for element in elements[0:counter+1]:
        mesh = Artist(element.mesh).draw(color)
        G.append(mesh)
# ---------- end draw_2 ----------
geo = Geometry(draw_2.G)
pln_2 = Plane(draw_2.tool_planes_WCS)
pln_3 = Plane(draw_2.current_tool_plane)
preview_3 = CustomPreview(Geometry=geo, Shader=ColourSwatch(SwatchColor=RGB(243, 169, 137)))
preview_4 = CustomPreview(Geometry=pln_2, Shader=ColourSwatch(SwatchColor=RGB(178, 178, 178)))

# ----
key_2 = Slider(349, range=0..388)
till_key_2 = Button()
start_2 = Button()
reset_2 = Button()
stop_2 = Button()
back_2 = Button()
step_2 = Button()
full_2 = Button()
list_2 = ValueList({"20", "50", "100", "500", "1000", "5000"}, selected="50")

# ----
# Vault 2
number_slider_3 = Slider(0, range=0..0.015)

angle_4 = Slider(0.6, range=0..1)  # disabled
layers_4 = Slider(19, range=10..30)
angle_5 = Slider(30.17, range=-100..50)
angle_6 = Slider(0.5, range=0..1)
layers_5 = Slider(7, range=2..30)
layers_6 = Slider(15, range=2..30)
crv_3 = Curve(<curve referenced from the Rhino model>)

python_2 = GhPythonScript(
    input_crv=crv_3,
    angle=angle_5,
    angle_1=angle_4,
    angle_2=angle_6,
    num=layers_4,
    offset_step=number_slider_3,
    start_layer_num=layers_5,
    end_layer_num=layers_6,
    bricklen="0.25",
    interval="0.062")  # -> out, plane_grid, curves, planes; inputs input_crv: Curve, num: Int32; same code as python
pln_4 = Plane(python_2.planes)
generate_assembly_2 = GhPythonScript(plane_grid=python_2.plane_grid, rot_factor=Slider(0, range=0..100), elem_full=elem_def.elem_full)  # -> assembly; inputs plane_grid: list; same code as generate_assembly

show_6 = BooleanToggle(False)
update_network_2 = PythonScript(DATA=py.DATA, compute_interfaces_numpy=show_6, assembly=generate_assembly_2)  # -> assembly; same code as update_network

# ----
# to JSON
export_4 = Button()
export_5 = Button()
export_6 = PythonScript(DATA=py.DATA, assembly=update_network_2, export_to_json=export_4, export_to_json_unity=export_5)  # same code as export_3

crv_4 = Curve(python_2.curves)
total_2 = GhPythonScript(assembly=update_network_2)  # -> out; same code as total
panel_2 = Panel(total_2)

# ----
# Network Viz
number_slider_4 = Slider(0, range=0..47)
show_7 = BooleanToggle(False)
network_viz_2 = GhPythonScript(assembly=update_network_2, show_network=show_7, key=number_slider_4)  # -> out, nodes, edges, current_node, current_node_neighbors; inputs key: Int32; same code as network_viz
pt_2 = Point(network_viz_2.nodes)
line_2 = Line(network_viz_2.edges)
brep_3 = Brep(network_viz_2.current_node)
brep_4 = Brep(network_viz_2.current_node_neighbors)
preview_5 = CustomPreview(Geometry=[brep_3, line_2], Material=ColourSwatch(SwatchColor=RGB(0, 0, 0)))
preview_6 = CustomPreview(Geometry=brep_4, Material=ColourSwatch(SwatchColor=RGB(255, 207, 207)))

# ----
# Draw
# Visualise the entire assembly and its underlying network topology.
counter_2 = CountThroughList(
    assembly=update_network_2,
    start=start_2,
    stop=stop_2,
    step=step_2,
    step_back=back_2,
    reset=reset_2,
    full=full_2,
    till_key=till_key_2,
    key=key_2,
    interval=list_2)  # -> item, counter; inputs start: Boolean, stop: Boolean, step_back: Boolean, key: Int32; same code as counter
idx_2 = Panel(counter_2.counter)

# ---- group: Assembly Artist
show_8 = BooleanToggle(False)
show_9 = BooleanToggle(False)
draw_3 = PythonScript(assembly=update_network_2, show_all=show_8, show_counter=show_9, counter=counter_2.counter)  # -> G, tool_planes_WCS, current_tool_plane; inputs counter: Int32; same code as draw_2
geo_2 = Geometry(draw_3.G)
pln_5 = Plane(draw_3.tool_planes_WCS)
pln_6 = Plane(draw_3.current_tool_plane)
preview_7 = CustomPreview(Geometry=geo_2, Shader=ColourSwatch(SwatchColor=RGB(243, 169, 137)))
preview_8 = CustomPreview(Geometry=pln_5, Shader=ColourSwatch(SwatchColor=RGB(178, 178, 178)))
