# Grasshopper definition ex3_robotic_bricklaying.ghx (Grasshopper 1.0.7)
# plug-ins: Weaverbird

# ----
# 2a.
reload = Button()
py = PythonScript(reload=reload)
# ---------- py: Python ----------
from compas_rhino.utilities.misc import get_tolerance
from compas_ghpython import unload_modules

unload_modules("ur_fabrication_control")
unload_modules("fabrication_control")
unload_modules("assembly_information_model")
unload_modules("humocap")
# ---------- end py ----------

# ----
# Brick
# Predefine a brick element and its dimensions
# Visualise the defined element
show = BooleanToggle(False)
elem_def = GhPythonScript()  # -> out, elem_full, elem_half
# ---------- elem_def: Python ----------
import os
import sys
import json

from compas.geometry import Frame
from compas.geometry import Vector
from compas.geometry import Box

from assembly_information_model.assembly import Element


# dimensions full brick
width = 0.115
length = 0.240
height = 0.050

elem_full = Element.from_dimensions(length, width, height)
elem_full.tool_frame = Frame([0, 0, height], [1, 0, 0], [0, -1, 0])

elem_half = Element.from_dimensions(length/2, width, height)
elem_half.tool_frame = Frame([0, 0, height], [1, 0, 0], [0, -1, 0])
# ---------- end elem_def ----------
draw = PythonScript(elem_full=elem_def.elem_full, elem_half=elem_def.elem_half, show=show)  # -> M, F, S
# ---------- draw: Python ----------
from compas.geometry import Transformation
from compas.geometry import Frame
from compas.datastructures import mesh_transformed
from compas_ghpython.artists import MeshArtist
from compas_ghpython import draw_frame

if show:
    artist = MeshArtist(elem_full.mesh)
    M = [artist.draw_mesh()]
    F = [draw_frame(elem_full.frame)]
    #S = [draw_frame(elem_full._source.frame)]
    S = [draw_frame(elem_full.tool_frame)]
    
    
    artist = MeshArtist(elem_half.mesh)
    M += [artist.draw_mesh()]
    F += [draw_frame(elem_half.frame)]
    #S += [draw_frame(elem_half._source.frame)]
    S = [draw_frame(elem_half.tool_frame)]
# ---------- end draw ----------

disconnect = Button()

# ----
# Brick
# Predefine a brick element and its dimensions
# Visualise the defined element
show_2 = BooleanToggle(False)
# 2. Design: Wall
elem_def_2 = GhPythonScript()  # -> out, elem_full, elem_half; same code as elem_def
draw_2 = PythonScript(elem_full=elem_def_2.elem_full, elem_half=elem_def_2.elem_half, show=show_2)  # -> M, F, S; same code as draw

connect = Button()

# ----
# Load robot from local package
list = ValueList({"ur_description", "ur_e_description", "ur_setups"}, selected="ur_e_description")
list_2 = ValueList({"ur3.urdf", "ur3_rot.urdf", "ur5.urdf", "ur10.urdf", "ur3e.urdf", "ur5e.urdf", "ur10e.urdf", "ur10e_rot.urdf"}, selected="ur10e_rot.urdf")
list_3 = ValueList({"ur3.srdf", "ur5.srdf", "ur10.srdf", "ur3e.srdf", "ur5e.srdf", "ur10e.srdf"}, selected="ur10e.srdf")
py_2 = PythonScript()  # -> DATA
# ---------- py_2: Python ----------
import os
import getpass

HERE = os.path.dirname(ghdoc.Path)
DATA = os.path.abspath(os.path.join(HERE, "..", "data\models"))
print(DATA)
# ---------- end py_2 ----------
py_3 = PythonScript(data_path=py_2, package=list, urdf_name=list_2, srdf_name=list_3)  # -> loaders, urdf_filename, srdf_filename
# ---------- py_3: Python ----------
import os
from compas.robots import LocalPackageMeshLoader

path = os.path.join(data_path, "robot_description")

#loaders
packages = ["ur_description", "ur_e_description", "ur_end_effectors", "ur_setups"]
loaders = [LocalPackageMeshLoader(path, pck) for pck in packages]

#files
package_path = os.path.join(path, package)
print package_path

urdf_filename = os.path.join(package_path, "urdf", urdf_name)
srdf_filename = os.path.join(package_path, srdf_name)

assert os.path.isfile(urdf_filename)
assert os.path.isfile(srdf_filename)
# ---------- end py_3 ----------

pln = Plane(Plane(origin=(1.287467, 1.767532, 1.052754), x=(-0.4144152488, 0.9095985462, 0.02984101792), y=(-0.9100561004, -0.4139037994, -0.02194399349)))

# ----
# Assembly
panel = Panel("0.05")
pt = Point(<point referenced from the Rhino model>)
pt_2 = Point(<point referenced from the Rhino model>)
brep = Brep(<brep referenced from the Rhino model>)
python = GhPythonScript(brep=brep, pt_base=pt, pt_end=pt_2, bricklen="0.250", interval=panel)  # -> out, plane_grid, planes; inputs brep: Brep, pt_base: Point3d, pt_end: Point3d
# ---------- python: Python ----------
import Rhino.Geometry as rg
import math as m



def list_from_2darray(array):
    return [item for sublist in array for item in sublist]
    
def create_planegrid(brep, pt_base, pt_end, interval, bricklen):
    """ create diamond plane grid according to even and
    odd rows for a regualr stretcher bond.
    udiv: rows
    vdiv: cols (cols should be an odd number,
    for culling each second col to create even and odd courses)
    """

    curves = rg.Brep.CreateContourCurves(brep, pt_base, pt_end, interval)
    print(curves[0])
    clen = curves[0].GetLength()
    cols = int(clen/(bricklen+0.020))*2
    print cols
    
    plane_grid = []

    for j, c in enumerate(curves):
        row = []
        vparams = rg.Curve.DivideByCount(c, cols, True)
        planes = rg.Curve.GetPerpendicularFrames(c, vparams)
        
        for i, plane in enumerate(planes):

            plane.Rotate(m.radians(90), plane.YAxis)
            #plane.Rotate(m.radians(-90), plane.ZAxis)
            plane.Rotate(m.radians(90), plane.XAxis)

            if j%2 == 0 and i%2 == 0: #even course
                if i==0:
                    plane.Translate(plane.XAxis*-bricklen/4)
                    #plane.Translate(plane.YAxis*-bricklen/6)
                    plane.Rotate(m.radians(90), plane.ZAxis)
                elif i==len(planes)-1:
                    plane.Translate(plane.XAxis*bricklen/4)
                    plane.Translate(plane.YAxis*-bricklen/5)
                    plane.Rotate(m.radians(0), plane.ZAxis)
                row.append(plane)
            if j%2 == 1 and i%2 == 1: #odd course

                row.append(plane)

        plane_grid.append(row)
    return plane_grid

plane_grid = create_planegrid(brep, pt_base, pt_end, interval, bricklen)
planes = list_from_2darray(plane_grid)
# ---------- end python ----------
pln_2 = Plane(python.planes)
generate_assembly = GhPythonScript(
    rot_factor=Slider(40, range=0..100),
    plane_grid=python.plane_grid,
    elem_full=elem_def_2.elem_full,
    elem_half=elem_def_2.elem_half)  # -> assembly; inputs rot_factor: Int32, plane_grid: list
# ---------- generate_assembly: Python ----------
import Rhino.Geometry as rg
import math
from scriptcontext import sticky as st


from compas.geometry import Frame
from compas.geometry import Transformation
from compas.geometry import Rotation
from compas.geometry import Translation
from compas.geometry import Point

from compas_ghpython import draw_frame

from assembly_information_model.assembly import Assembly

import Rhino.Geometry as rg


assembly = Assembly() # initialize an empty assembly class


for j, row in enumerate(plane_grid):
    #print row
    for i, plane in enumerate(row):
        #print plane
        rotval1 = math.sin(i/6)*rot_factor
        rotval2 = math.sin(i/6)*(rot_factor)
        print rotval1,rotval2
        new_plane= rg.Plane(plane)
        
        if j%2==0: #even layers
            new_plane.Rotate(-math.radians(rotval1), plane.ZAxis, plane.Origin)
        else:
            new_plane.Rotate(math.radians(rotval2), plane.ZAxis, plane.Origin)
        
        T = Transformation.from_frame_to_frame(Frame.worldXY(), Frame(new_plane.Origin, new_plane.XAxis, new_plane.YAxis))
        
        if j%2==0: #even layers
            if i==0 or i==len(row)-1:
                e = elem_full.transformed(T)
            else:
                e = elem_full.transformed(T)
        else:
            e = elem_full.transformed(T)
        assembly.add_element(e)

"""
if transform:
    T = Transformation.from_frame_to_frame(Frame.worldXY(), Frame(ptransf.Origin, ptransf.XAxis, ptransf.YAxis))
    assembly.transform(T)
"""
# ---------- end generate_assembly ----------

brep_2 = Geometry(<brep referenced from the Rhino model>)
mesh = Mesh(brep_2)
mesh_2 = PythonScript(assembly=generate_assembly)  # -> elems_compas_meshes, elem_compas_mesh
# ---------- mesh_2: Python ----------
from compas.geometry import Frame, Transformation
from compas.artists import Artist

elems_compas_meshes = []

for key, elem in assembly.elements():
    m = elem.mesh
    elems_compas_meshes.append(m)

elem = assembly.element(0)
T = Transformation.from_change_of_basis(Frame.worldXY(), elem.frame)
mesh_transformed = elem.mesh.transformed(T)
elem_compas_mesh = mesh_transformed
# ---------- end mesh_2 ----------
mesh_3 = PythonScript(mesh=mesh)  # -> compas_mesh
# ---------- mesh_3: Python ----------
from compas.datastructures import Mesh
from compas_rhino.geometry import RhinoMesh

compas_mesh = RhinoMesh.from_guid(mesh).to_compas()
# ---------- end mesh_3 ----------

key = Slider(349, range=0..388)
till_key = Button()
reset = Button()
back = Button()
start = Button()
stop = Button()
step = Button()
full = Button()
list_4 = ValueList({"20", "50", "100", "500", "1000", "5000"}, selected="50")

key_2 = Slider(6, range=0..388)
start_2 = Button()
stop_2 = Button()
reset_2 = Button()
step_2 = Button()
back_2 = Button()
full_2 = Button()
list_5 = ValueList({"20", "50", "100", "500", "1000", "5000"}, selected="50")

# ----
# ROBOT - IP Settings
ur_ip = ValueList({"192.168.0.210"}, selected="192.168.0.210")

# ----
# Check robot availability
ping = Button()
py_4 = PythonScript(ping=ping)  # -> out, trigger
# ---------- py_4: Python ----------
from scriptcontext import sticky as st
from ur_fabrication_control.direct_control import is_available

guid = str(ghenv.Component.InstanceGuid)
txt_key = "txt_" + guid
if txt_key not in st:
    st[txt_key] = ""

ip = st["ur_ip"]
print ip

if ping:
    
    available = is_available(ip)
    
    if available:
        st[txt_key] = "%s is up!" % ip
        trigger = True
    else:
        st[txt_key] = "%s is down!" % ip
        trigger = False

print(st[txt_key])
# ---------- end py_4 ----------
panel_2 = Panel(py_4.out)

# ---- group: cartesian motion
# 1. 'Pick' cartesian motion
number_slider = Slider(0.01, range=0..0.01)
python_2 = PythonScript()  # -> frames_tool0; inputs frames: list
# ---------- python_2: Python ----------
from compas.geometry import Frame

if robot:
    frames_tool0 = robot.from_tcf_to_t0cf(frames)
# ---------- end python_2 ----------
start_configuration = Data()
compute = Button()
plan_cartesian_motion = PythonScript(start_configuration=start_configuration, frames=python_2, max_step=number_slider, compute=compute)  # -> out, trajectory; inputs frames: list, acm: list
# ---------- plan_cartesian_motion: Python ----------
import logging
import scriptcontext as sc

from compas.geometry import Frame

from compas_ghpython.utilities import update_component

guid = str(ghenv.Component.InstanceGuid)
response_key = "response_" + guid
if response_key not in sc.sticky:
    sc.sticky[response_key] = None

LOGGER = logging.getLogger('roslibpy')
data = dict(requesting_solution=False)

if robot and robot.client and robot.client.is_connected and start_configuration and compute :
    sc.sticky[response_key] = robot.plan_cartesian_motion(frames,
                                                          start_configuration=start_configuration,
                                                          group=group,
                                                          options=dict(
                                                              max_step=float(max_step),
                                                              attached_collision_meshes=list(acm)
                                                          ))

trajectory = sc.sticky[response_key]
# ---------- end plan_cartesian_motion ----------
py_5 = PythonScript(response=plan_cartesian_motion.trajectory)  # -> start_configuration, configurations, fraction, time
# ---------- py_5: Python ----------
from compas_fab.backends.ros import MoveItErrorCodes

joint_positions = []

if response:
    #if response.error_code == MoveItErrorCodes.SUCCESS:
    configurations = response.points
    start_configuration = response.start_configuration
    fraction = response.fraction
    time = response.time_from_start
    print configurations[-1]
# ---------- end py_5 ----------
panel_3 = Panel(plan_cartesian_motion.out)
fraction = Panel(py_5.fraction)
time_s = Panel(py_5.time)
vis = PythonScript(response=plan_cartesian_motion.trajectory)  # -> P, V, A
# ---------- vis: Python ----------
from compas_ghpython import list_to_ghtree

if response:

    positions = []
    velocities = []
    accelerations = []

    for p in response.points:
        positions.append(p.positions)
        velocities.append(p.velocities)
        accelerations.append(p.accelerations)

    P = list_to_ghtree(list(zip(*positions)))
    V = list_to_ghtree(list(zip(*velocities)))
    A = list_to_ghtree(list(zip(*accelerations)))
# ---------- end vis ----------
prismatic = QuickGraph(vis.P, SortOrder=0)
panel_4 = Panel("positions")
graph = QuickGraph(vis.A, SortOrder=0)
graph_2 = QuickGraph(vis.V, SortOrder=0)
panel_5 = Panel("velocities")
panel_6 = Panel("accelerations")

# ----
compute_2 = Button()

# ----
# Set Digital Out
number = Slider(1, range=0..10)
# 4b.
value = BooleanToggle(True)
digital_out = PythonScript(number=number, value=value)  # -> urscript; inputs number: Int32, value: Boolean
# ---------- digital_out: Python ----------
from ur_fabrication_control.direct_control import URScript

urscript = URScript()
urscript.start()
urscript.add_line("\tset_digital_out({}, {})".format(number, value))
urscript.end()
urscript = urscript.generate()

print(urscript)
# ---------- end digital_out ----------
send = Button()
send_2 = GhPythonScript(urscript=digital_out, send=send)  # -> out; inputs send: Boolean
# ---------- send_2: Python ----------
from scriptcontext import sticky as st
from ur_fabrication_control.direct_control import send_script

ur_ip = st["ur_ip"]
ur_port = st["ur_port"]

if send:
    send_script(urscript, ur_ip, ur_port)
# ---------- end send_2 ----------

# ----
# Stop
stop_3 = Button()
stop_4 = PythonScript(stop=stop_3)
# ---------- stop_4: Python ----------
from scriptcontext import sticky as st
from ur_fabrication_control.direct_control.common import send_stop

ur_ip = st["ur_ip"]
ur_port = st["ur_port"]

if stop:
    send_stop(ur_ip, ur_port)
# ---------- end stop_4 ----------

reset_3 = Button()
start_3 = Button()
stop_5 = Button()

# ----
# Area Gripper Switch
open = BooleanToggle(False)
digital_out_2 = PythonScript(open=open)  # -> urscript
# ---------- digital_out_2: Python ----------
from ur_fabrication_control.direct_control import URScript
from ur_fabrication_control.direct_control.mixins import AreaGripMixins

class URScript_AreaGrip(URScript, AreaGripMixins):
    pass

urscript = URScript_AreaGrip()
urscript.start()

if open:
    # on
    urscript.areagrip_on()
else: 
    # off
    urscript.areagrip_off()

urscript.end()
urscript = urscript.generate()
print(urscript)
# ---------- end digital_out_2 ----------
send_3 = Button()
send_4 = GhPythonScript(urscript=digital_out_2, send=send_3)  # -> out; inputs send: Boolean
# ---------- send_4: Python ----------
from scriptcontext import sticky as st
from ur_fabrication_control.direct_control import send_script

ur_ip = st["ur_ip"]
ur_port = st["ur_port"]

print ur_ip

if send:
    send_script(urscript, ur_ip, ur_port)
# ---------- end send_4 ----------

# ----
# Get Pose Cartesian
get = Button()
pose = PythonScript(get=get)  # -> pose_cartesian_meter
# ---------- pose: Python ----------
from scriptcontext import sticky as st
from ur_fabrication_control.online_control.ur_direct import get_current_pose_cartesian
from compas.geometry import Frame
from compas_ghpython import draw_frame

robot = st["robot"]

server_ip = st["server_ip"]
server_port = st["server_port"]
ur_port = st["ur_port"]
ur_ip = st["ur_ip"]
pose_cartesian_meter = []
print ur_ip

# retrieve the current tool frame in axis angle format
if robot.attached_tool:
    print ("attached")
    tool_angle_axis = list(robot.attached_tool.frame.point) + list(robot.attached_tool.frame.axis_angle_vector)
    
else:
    tool0_frame = Frame([0, 0, 0], [1, 0, 0], [0, 1, 0])
    tool_angle_axis = list(tool0_frame.point) + list(tool0_frame.axis_angle_vector)

print(tool_angle_axis)

guid = str(ghenv.Component.InstanceGuid)
pose_cartesian_key = "pose_cartesian" + guid


if get:
    print ("getting pose")
    #st[pose_cartesian_key] = get_current_pose_cartesian(tool_angle_axis, server_ip, server_port, ur_ip, ur_port, send=True)
    st[pose_cartesian_key] = get_current_pose_cartesian(server_ip, server_port, ur_ip, tool_angle_axis)
    

if pose_cartesian_key not in st:
    pose_cartesian_mm = []
    pose_cartesian_meter = []
else:
    pose_cartesian = st[pose_cartesian_key]

print(pose_cartesian)

for i in pose_cartesian:
    new_c = i / 1000
    pose_cartesian_meter.append(new_c)

print (pose_cartesian_meter)
# ---------- end pose ----------
panel_7 = Panel(pose)

# ----
# Get Pose Joint
get_2 = Button()
pose_2 = PythonScript(get=get_2)  # -> configuration, pose_joints
# ---------- pose_2: Python ----------
from scriptcontext import sticky as st
from ur_fabrication_control.online_control.ur_direct import get_current_pose_joints
from compas_fab.robots import Configuration


robot = st["robot"]

server_ip= st["server_ip"]
server_port = st["server_port"]
ur_port = st["ur_port"]
ur_ip = st["ur_ip"]
print ur_ip

guid = str(ghenv.Component.InstanceGuid)
pose_joints_key = "pose_joints" + guid

# retrieve the current tool frame in axis angle format
if robot.attached_tool:
    tool_angle_axis = list(robot.attached_tool.frame.point) + list(robot.attached_tool.frame.axis_angle_vector)
else:
    tool0_frame = Frame([0, 0, 0], [1, 0, 0], [0, 1, 0])
    tool_angle_axis = list(tool0_frame.point) + list(tool0_frame.axis_angle_vector)

print(tool_angle_axis)

# send script to the robot to receive the current joint configuration
if get:
    st[pose_joints_key] = get_current_pose_joints(server_ip, server_port, ur_ip, tool_angle_axis)

print (st[pose_joints_key])
configuration = Configuration.from_revolute_values(st[pose_joints_key])
pose_joints = configuration.joint_values
"""
if pose_joints_key not in st:
    configuration = Configuration.from_revolute_values([0,0,0,0,0,0])
else:
    configuration = Configuration.from_revolute_values(st[pose_joints_key])

pose_joints = configuration.values
"""
# ---------- end pose_2 ----------
panel_8 = Panel(pose_2.pose_joints)

pln_3 = Plane(Plane(origin=(1.502047259, 1.844065428, 1.102071041), x=(-0.4792838257, 0.8776599651, 0), y=(-0.8776599651, -0.4792838257, 0)))

# ----
# Calculate Basis - 3-Point Method
# Measure basis:
# 1. Clear the recorded poses
# 2. Move robot to origin and press "get pose"
# 3. Move robot to point in positive x-axis and press "get pose"
# 4. Move robot to an other point in your basis and press "get pose"
# (The further away these positions are, the better)
# 
# 5. Alternatively change the order in the component calc base
# 6. Copy output into base component (TODO: check if it has to be inverted)
list_6 = ValueList({"o, pos.x-axis, xy pl": 0, "o, pos.y-axis, xy pl": 1}, selected="o, pos.x-axis, xy pl")
clear = Button()
rec = PythonScript(msg=pose, rec=get, clear=clear)  # -> rec; inputs msg: list
# ---------- rec: Python ----------
from scriptcontext import sticky as st

guid = str(ghenv.Component.InstanceGuid)
recorded_key =  "recorded_" + guid
just_cleared_key = "just_cleared_" + guid


if recorded_key not in st:
    st[recorded_key] = []

if just_cleared_key not in st:
    st[just_cleared_key] = False

if clear:
    st[recorded_key] = []
    st[just_cleared_key] = True
else:
    if len(msg):
        if msg != [None] and not st[just_cleared_key] and rec:
            st[recorded_key].append(msg)
    st[just_cleared_key] = False
        


rec = st[recorded_key]

print rec
# ---------- end rec ----------
calc_base = PythonScript(poses=rec, input_type=list_6)  # -> out, base_plane; inputs poses: list
# ---------- calc_base: Python ----------
import Rhino.Geometry as rg
import math


if len(poses) > 2:
    
    O = poses[0]
    P1 = poses[1]
    P2 = poses[2]
    
    if input_type == 0:
        # origin, pt on positive x-axis, pt in xy plane
        origin = rg.Point3d(O[0], O[1], O[2])
        pt_on_xaxis = rg.Point3d(P1[0], P1[1], P1[2])
        pt_in_xyplane = rg.Point3d(P2[0], P2[1], P2[2])
        
        xaxis = pt_on_xaxis - origin
        xaxis.Unitize()
        
        v = pt_in_xyplane - origin
        zaxis = rg.Vector3d.CrossProduct(v, xaxis)
        zaxis.Unitize()
        
        # zaxis must look up!
        if math.acos(rg.Vector3d.ZAxis * zaxis) > math.acos(rg.Vector3d.ZAxis * -zaxis):
            zaxis = -zaxis
        
        yaxis = rg.Vector3d.CrossProduct(zaxis, xaxis)
    
    elif input_type == 1:
        # origin, pt on positive y-axis, pt in xy plane
        origin = rg.Point3d(O[0], O[1], O[2])
        pt_on_yaxis = rg.Point3d(P1[0], P1[1], P1[2])
        pt_in_xyplane = rg.Point3d(P2[0], P2[1], P2[2])
        
        yaxis = pt_on_yaxis - origin
        yaxis.Unitize()
        
        v = pt_in_xyplane - origin
        zaxis = rg.Vector3d.CrossProduct(v, yaxis)
        zaxis.Unitize()
        
        # zaxis must look up!
        if math.acos(rg.Vector3d.ZAxis * zaxis) > math.acos(rg.Vector3d.ZAxis * -zaxis):
            zaxis = -zaxis
        
        xaxis = rg.Vector3d.CrossProduct(yaxis, zaxis)
        
        
    print "Copy the following into base component:"
    print " "
    print "origin = [%.2f, %.2f, %.2f]" % tuple(list(origin))
    print "xaxis = [%.5f, %.5f, %.5f]" % tuple(list(xaxis))
    print "yaxis = [%.5f, %.5f, %.5f]" % tuple(list(yaxis))
    

#print rg.Vector3d.CrossProduct(rg.Vector3d.YAxis, rg.Vector3d.ZAxis)
#print rg.Vector3d.CrossProduct(rg.Vector3d.ZAxis, rg.Vector3d.XAxis)

    base_plane = rg.Plane(origin, xaxis, xaxis)
# ---------- end calc_base ----------
panel_9 = Panel(rec)
panel_10 = Panel(calc_base.out)

plane_init_guess = Plane(pln_3)

# ----
# Direct UR Control
# Calculate Basis - Point fitting method via RPC
config = GhPythonScript()  # -> out, joint_configs
# ---------- config: Python ----------
from compas_fab.robots import Configuration

values=[-0.737876, -1.64531, 1.740348, -0.367801, -0.37385, -0.110741]
joint_configs = [Configuration.from_revolute_values(values)]
# ---------- end config ----------
pt_3 = Point([<point referenced from the Rhino model> x3])
calc_base_2 = PythonScript(poses=rec, pts_cad=pt_3, base_plane_init_guess=plane_init_guess, calc=Toggle(False))  # -> out, pts_mtip_init_guess, pts_mtip_fit, base_plane_fit; inputs poses: list, pts_cad: list of Point3d, base_plane_init_guess: Plane
# ---------- calc_base_2: Python ----------
import ghpythonlib.components as ghcomp
import Rhino.Geometry as rg
from scriptcontext import sticky as st
from compas.geometry import Frame
import math as m
import sys
from compas.rpc import Proxy # for calling the numpy function in CPython

#icp_func = Proxy('ur_fabrication_control.optimisation.icp', python = 'C://Users//doerf//.conda//envs//rsrd_22//python.exe') #C:\Users\doerf\.conda\envs\rsrd_22
#print icp_func._python
#print poses
poses_estimation_1 = [[-0.52897499999999997, -0.51097899999999996, -0.62637199999999993, -0.00259867, 0.00166124, -0.00047402699999999997], [-0.93892399999999998, 0.52012900000000006, -0.61947699999999994, -0.00128827, 0.0021785199999999998, 0.00053505499999999999], [-0.440556, 0.52178999999999998, -0.624884, -0.00082253200000000006, 0.0027548, -0.000222504], [0.46294200000000002, 1.0241099999999999, -0.62009100000000006, 0.000672946, 0.0026381999999999998, 0.000130681]]
if len(poses):
    
    # get points from poses
    pts_mtip = [rg.Point3d(p[0], p[1], p[2]) for p in poses]
    
    T_W_R_init_guess = rg.Transform.PlaneToPlane(rg.Plane.WorldXY, base_plane_init_guess)
    pts_mtip_init_guess = [ghcomp.Transform(pt, T_W_R_init_guess) for pt in pts_mtip]
    
    # format Rhino transformation
    T_W_R_init_guess_flattened = [float(f) for f in T_W_R_init_guess.ToFloatArray(True)]
    T_W_R_init_guess_list = [T_W_R_init_guess_flattened[i:(i + 4)] for i in range(0, len(T_W_R_init_guess_flattened), 4)]  

    # format ptsA and ptsB
    dataB = [list(pt) for pt in pts_cad]
    dataA = [list(pt) for pt in pts_mtip]
    
    # call the function
    max_iterations = 100
    
    if calc:
        icp_func = Proxy('ur_fabrication_control.optimisation.icp', python = 'C://Users//lidet//anaconda3//envs//ur_fab//python.exe')
        #icp_func = Proxy('ur_fabrication_control.optimisation.icp', python = 'C://Users//doerf//.conda//envs//rsrd_22//python.exe') #C:\Users\doerf\.conda\envs\rsrd_22
        
        
        print icp_func._python

        transformation, distances = icp_func.icp(dataA, dataB, init_guess=T_W_R_init_guess_list, max_iterations=max_iterations, tolerance=0.000001)
        
        print "distances", distances
        
        # format result
        T = rg.Transform.Identity
        for i in range(4):
            for j in range(4):
                code = "T.M%i%i = %f" % (i, j, transformation[i][j])
                print code
                exec(code)
        #print T
        
        # now transform the points with the transformation calculated
        pts_mtip_fit = [ghcomp.Transform(pt, T) for pt in pts_mtip]
        base_plane_fit = ghcomp.Transform(rg.Plane.WorldXY, T)
        
        
        #f = Frame(base_plane_fit)
        #print f.get_pose_quaternion()
        
        # correct the zvalue
        #base_plane_fit = ghcomp.Transform(base_plane_fit, rg.Transform.Translation(0,0,-3))
# ---------- end calc_base_2 ----------
pln_4 = Plane(calc_base.base_plane)
pt_4 = Point(calc_base_2.pts_mtip_init_guess)
pt_5 = Point(calc_base_2.pts_mtip_fit)
pln_5 = Plane(calc_base_2.base_plane_fit)

pt_6 = Point([<point referenced from the Rhino model> x3])

# ----
# 1.
# 1. Design: Vault
py_6 = PythonScript()  # -> HERE, DATA
# ---------- py_6: Python ----------
import os

HERE = os.path.dirname(ghdoc.Path)
DATA = os.path.abspath(os.path.join(HERE, "..", "data"))
print(HERE)
print(DATA)
# ---------- end py_6 ----------
crv = Curve(<curve referenced from the Rhino model>)
till_key_2 = Button()

# ----
# Assembly
number_slider_2 = Slider(0.011, range=0..0.015)
python_3 = GhPythonScript(input_crv=crv, angle="40", num="28", offset_step=number_slider_2, bricklen="0.24", interval="0.06")  # -> out, plane_grid, curves, point, trimed_crv, planes; inputs input_crv: Curve, num: Int32
# ---------- python_3: Python ----------
import Rhino.Geometry as rg
import math as m
import rhinoscriptsyntax as rs

#new_curve = input_crv.Trim(0.1, 0.2)
#print input_crv

def list_from_2darray(array):
    return [item for sublist in array for item in sublist]
    
def create_curves(input_curve, angle, interval, num):
    curves = []
    for i in range(num):
        new_curve = rg.Curve.DuplicateCurve(input_curve)
        new_curve.Translate(rg.Vector3d.ZAxis*interval*i)
        new_curve.Rotate(m.radians(-angle), rg.Vector3d.XAxis, input_curve.PointAtNormalizedLength(0.5))
        cutting_plane = rg.PlaneSurface(rg.Plane.WorldXY, rg.Interval(-20,20), rg.Interval(-20,20))
        split_crv = new_curve.Split(cutting_plane, 0.001)
        curves.append(split_crv[1])
        #curves.append(new_curve)
    return curves
    
curves = create_curves(input_crv, angle, interval, num)
    
def create_planegrid(input_crv, angle, interval, num, bricklen):
    """ create diamond plane grid according to even and
    odd rows for a regualar stretcher bond.
    udiv: rows
    vdiv: cols (cols should be an odd numbe),
    for culling each second col to create even and odd courses)
    """

    curves = create_curves(input_crv, angle, interval, num)
    #curves.pop(0)
    


    plane_grid = []
    offset = 0
    for j, c in enumerate(curves):
        
        clen = c.GetLength()
        cols = int(clen/(bricklen+0.010))
        cshift = (clen - cols*(bricklen+0.01))/2.
        row = []
        #vparams = rg.Curve.DivideByCount(c, cols, True)
        trimed_crv = c.Trim(0.6, 3.6)
        print 'trimed_crv', j, trimed_crv

        vparams = rg.Curve.DivideByLength(c, bricklen+0.01, True)
        planes = rg.Curve.GetPerpendicularFrames(c, vparams)
        
        
        if j < 7:
            offset += offset_step
        elif j > 15:
            offset -= offset_step
            
        #print 'Layer =', j, ',', 'Offset =', offset*100, 'cm'
        
        for i, plane in enumerate(planes):
            
            plane.Rotate(m.radians(-90), plane.YAxis)
            plane.Rotate(m.radians(-90), plane.XAxis)
            plane.Translate(plane.YAxis*-offset)

#            if j%2 == 0 and i%2 == 0: #even course
#                if i==0:
#                    #plane.Translate(plane.XAxis*-bricklen/4)
#                    #plane.Translate(plane.YAxis*-bricklen/6)
#                    #plane.Rotate(m.radians(90), plane.ZAxis)
#                elif i==len(planes)-1:
#                    #plane.Translate(plane.XAxis*bricklen/4)
#                    #plane.Translate(plane.YAxis*-bricklen/5)
#                    #plane.Rotate(m.radians(0), plane.ZAxis)
#                row.append(plane)
#            if j%2 == 1 and i%2 == 1: #odd course

            row.append(plane)

        plane_grid.append(row)
    return plane_grid

plane_grid = create_planegrid(input_crv, angle, interval, num, bricklen)
planes = list_from_2darray(plane_grid)
# ---------- end python_3 ----------
pln_6 = Plane(python_3.planes)
crv_2 = Curve(python_3.curves)
generate_assembly_2 = GhPythonScript(plane_grid=python_3.plane_grid, elem_full=elem_def.elem_full, elem_half=elem_def.elem_half)  # -> assembly; inputs plane_grid: list
# ---------- generate_assembly_2: Python ----------
import Rhino.Geometry as rg
import math
from scriptcontext import sticky as st


from compas.geometry import Frame
from compas.geometry import Transformation
from compas.geometry import Rotation
from compas.geometry import Translation
from compas.geometry import Point

from compas_ghpython import draw_frame

from assembly_information_model.assembly import Assembly

import Rhino.Geometry as rg


assembly = Assembly() # initialize an empty assembly class


for j, row in enumerate(plane_grid):
    #print row
    for i, plane in enumerate(row):
        #print plane
#        rotval1 = math.sin(i/6)*rot_factor
#        rotval2 = math.sin(i/6)*(rot_factor)
#        print rotval1,rotval2
        new_plane= rg.Plane(plane)
        
#        if j%2==0: #even layers
#            new_plane.Rotate(-math.radians(rotval1), plane.ZAxis, plane.Origin)
#        else:
#            new_plane.Rotate(math.radians(rotval2), plane.ZAxis, plane.Origin)
        
        T = Transformation.from_frame_to_frame(Frame.worldXY(), Frame(new_plane.Origin, new_plane.XAxis, new_plane.YAxis))
        
#        if j%2==0: #even layers
#            if i==0 or i==len(row)-1:
#                e = elem_half.transformed(T)
#            else:
#                e = elem_full.transformed(T)
#        else:
        e = elem_full.transformed(T)
        assembly.add_element(e)


if transform:
    T = Transformation.from_frame_to_frame(Frame.worldXY(), Frame(ptransf.Origin, ptransf.XAxis, ptransf.YAxis))
    assembly.transform(T)
# ---------- end generate_assembly_2 ----------

show_3 = BooleanToggle(False)
update_network = PythonScript(DATA=py_6.DATA, compute_interfaces_numpy=show_3, assembly=generate_assembly_2)  # -> assembly
# ---------- update_network: Python ----------
from assembly_information_model.assembly.courses import assembly_courses, assembly_with_interfaces_courses


if compute_interfaces_numpy:
    import os
    from compas.rpc import Proxy
    from assembly_information_model.assembly import Assembly
    p = Proxy('assembly_information_model.assembly.interfaces_numpy')
    p.stop_server()
    p.start_server()

    filename_before = "brickwall_ex2.json"
    filename_after = "brickwall_interfaces_ex2.json"

    PATH_BEFORE = os.path.join(DATA, filename_before)
    PATH_AFTER = os.path.join(DATA, filename_after)
    
    # the assembly has to be serialized such that it can be called from CPython
    assembly.to_json(PATH_BEFORE)
    
    # call the CPython Function using COMPAS RPC
    p.assembly_interfaces_numpy_fromtojson(PATH_BEFORE, PATH_AFTER, nmax=10, amin = 0.0001)

    assembly = Assembly.from_json(PATH_AFTER)


# now compute the courses
assembly_courses(assembly)

# example test: get the bottom keys
c_min = min(assembly.network.nodes_attribute(name='course'))
#print(c_min)
#keys_on_bottom = list(assembly.network.vertices_where({'course': c_min}))
#print(keys_on_bottom)

# example test: get the top keys
c_max = max(assembly.network.nodes_attribute(name='course'))
#print(c_max)
#keys_on_top = list(assembly.network.vertices_where({'course': c_max}))
#print(keys_on_top)
# ---------- end update_network ----------

show_4 = BooleanToggle(False)
update_network_2 = PythonScript(DATA=py_6.DATA, compute_interfaces_numpy=show_4, assembly=generate_assembly)  # -> assembly; same code as update_network

# ----
# to JSON
export = Button()
export_2 = Button()
export_3 = PythonScript(DATA=py_6.DATA, assembly=update_network, export_to_json=export, export_to_json_unity=export_2)
# ---------- export_3: Python ----------
import os
from compas.datastructures.mesh import mesh_quads_to_triangles
from compas.datastructures.mesh import mesh_unify_cycles

if export_to_json:
    
    filename = "brickwall_ex1.json"
    PATH = os.path.join(DATA, filename)
    
    # the assembly has to be serialized such that it can be called from CPython
    assembly.to_json(PATH)
    

if export_to_json_unity:
    
    for key, e in assembly.elements():
    
        #convert to trimesh
        mesh_quads_to_triangles(e._mesh, check_angles=False)
        #mesh_unify_cycles(e._mesh)
        #print e._mesh.faces
        #print e._mesh.face_vertices(list(e._mesh.faces())[0])

    filename = "brickwall_ex1_unity.json"
    PATH = os.path.join(DATA, filename)
    assembly.to_json(PATH)
# ---------- end export_3 ----------

# ----
# to JSON
export_4 = Button()
export_5 = Button()
export_6 = PythonScript(DATA=py_6.DATA, assembly=update_network_2, export_to_json=export_4, export_to_json_unity=export_5)  # same code as export_3

crv_3 = Curve(python_3.trimed_crv)

# ----
# Draw
# Visualise the entire assembly and its underlying network topology.
counter = CountThroughList(
    assembly=update_network,
    start=start,
    stop=stop,
    step=step,
    step_back=back,
    reset=reset,
    full=full,
    till_key=till_key,
    key=key,
    interval=list_4)  # -> item, counter; inputs start: Boolean, stop: Boolean, step_back: Boolean, key: Int32
# ---------- counter: Python ----------
from scriptcontext import sticky as st
from compas_ghpython import update_component


L = list(assembly.elements())
# store data in component
guid = str(ghenv.Component.InstanceGuid)
counter_key = "counter_" + guid
running_key = "running_" + guid

if counter_key not in st:
    st[counter_key] = 0

if running_key not in st:
    st[running_key] = False
    

if st[running_key]:
    if st[counter_key] < len(L) - 1:
        st[counter_key] += 1
        update_component(ghenv, interval)
    else:
        st[counter_key] = 0
        st[running_key] = False
    
    
if start:
    st[running_key] = True

if stop:
    st[running_key] = False

if step:
    if st[counter_key] < len(L) - 1:
        st[counter_key] += 1

if step_back:
    if st[counter_key] < len(L):
        st[counter_key] -= 1

if reset:
    st[counter_key] = 0

if till_key:
    st[counter_key] = key

if full:
    st[counter_key] = len(L)-1

if len(L):
    item = L[st[counter_key]]



#st["visualisation_counter"] = st[counter_key]
#st[counter_key]= 500
counter = st[counter_key]
# ---------- end counter ----------
idx = Panel(counter.counter)

# ---- group: Assembly Artist
show_5 = BooleanToggle(False)
show_6 = BooleanToggle(True)
draw_3 = PythonScript(assembly=update_network, show_all=show_5, show_counter=show_6, counter=counter.counter)  # -> G, tool_planes_WCS, current_tool_plane; inputs counter: Int32
# ---------- draw_3: Python ----------
import os
import sys

import math

from compas_ghpython.artists import MeshArtist
from compas_ghpython import draw_frame


G = []

key_index = assembly.network.key_index()
keys = [key_index[key] for key in assembly.network.nodes()]
elements = [assembly.element(key) for key in keys]
#print elements
#print([(e.gripping_frame) for e in elements])

tool_planes_WCS = [draw_frame(e.tool_frame) for e in elements]

current_tool_plane = tool_planes_WCS[counter]

if show_all and not show_counter:
    for element in elements:
        artist = MeshArtist(element.mesh)
        mesh = artist.draw_mesh(color=[0.6,0.4,0.4,0.4])
        G.append(mesh)

if show_counter:
    for element in elements[0:counter+1]:
        artist = MeshArtist(element.mesh)
        mesh = artist.draw_mesh(color=[0.6,0.4,0.4,0.4])
        G.append(mesh)
# ---------- end draw_3 ----------
geo = Geometry(draw_3.G)
pln_7 = Plane(draw_3.tool_planes_WCS)
pln_8 = Plane(draw_3.current_tool_plane)
preview = CustomPreview(Geometry=pln_7, Shader=ColourSwatch(SwatchColor=RGB(178, 178, 178)))
preview_2 = CustomPreview(Geometry=geo, Shader=ColourSwatch(SwatchColor=RGB(243, 169, 174)))

# ----
# Draw
# Visualise the entire assembly and its underlying network topology.
counter_2 = CountThroughList(
    assembly=update_network_2,
    start=start_2,
    stop=stop_2,
    step=step_2,
    step_back=back_2,
    reset=reset_2,
    full=full_2,
    till_key=till_key_2,
    key=key_2,
    interval=list_5)  # -> item, counter; inputs start: Boolean, stop: Boolean, step_back: Boolean, key: Int32; same code as counter
idx_2 = Panel(counter_2.counter)

# ---- group: Assembly Artist
show_7 = BooleanToggle(False)
show_8 = BooleanToggle(True)
draw_4 = PythonScript(assembly=update_network_2, show_all=show_7, show_counter=show_8, counter=counter_2.counter)  # -> G, tool_planes_WCS, current_tool_plane; inputs counter: Int32
# ---------- draw_4: Python ----------
import os
import sys

import math

from compas_ghpython.artists import MeshArtist
from compas_ghpython import draw_frame


G = []

key_index = assembly.network.key_index()
keys = [key_index[key] for key in assembly.network.nodes()]
elements = [assembly.element(key) for key in keys]
#print elements
#print([(e.gripping_frame) for e in elements])

tool_planes_WCS = [draw_frame(e.tool_frame) for e in elements]

current_tool_plane = tool_planes_WCS[counter]

if show_all and not show_counter:
    for element in elements:
        artist = MeshArtist(element.mesh)
        mesh = artist.draw_mesh()
        G.append(mesh)

if show_counter:
    for element in elements[0:counter+1]:
        artist = MeshArtist(element.mesh)
        mesh = artist.draw_mesh()
        G.append(mesh)
# ---------- end draw_4 ----------
pln_9 = Plane(draw_4.current_tool_plane)
pln_10 = Plane(draw_4.tool_planes_WCS)
geo_2 = Geometry(draw_4.G)
wbtriangles = WeaverbirdsSplitTrianglesSubdivision(MeshCurves=geo_2, Level=1)
preview_3 = CustomPreview(Geometry=pln_10, Shader=ColourSwatch(SwatchColor=RGB(178, 178, 178)))
preview_4 = CustomPreview(Geometry=wbtriangles, Shader=ColourSwatch(SwatchColor=RGB(255, 255, 255)))

# ---- group: ROS client
list_7 = ValueList({"local": 0, "linux computer": 1}, selected="local")

# ----
connect_2 = PythonScript(ip=list_7, connect=connect, disconnect=disconnect)  # -> out, ros_client
# ---------- connect_2: Python ----------
import sys
import scriptcontext as sc
from compas_fab.backends import RosClient

key = 'rosclient_%s' % str(ghenv.Component.InstanceGuid)
previous_client = sc.sticky.get(key, None)

if previous_client and (connect or disconnect):
    previous_client.close()

if connect:
    if ip == 0: #local, own laptop
        ros_client = RosClient('127.0.0.1', 9090)
    elif ip == 1: # linux computer
        ros_client = RosClient('192.168.0.41', 9090)
    sc.sticky[key] = ros_client
    ros_client.run(5)

ros_client = sc.sticky.get(key, None)
print('ROS connected: {}'.format(ros_client.is_connected if ros_client else 'False'))
# ---------- end connect_2 ----------

# ---- group: ROS client (continued)
is_connected = Panel(connect_2.out)
ros_client = Data(connect_2.ros_client)

# ----
# Robot
units = ValueList({"m": 1, "cm": 100, "mm": 1000}, selected="m")
load = Button()
create = PythonScript(load=load, loaders=py_3.loaders, urdf_filename=py_3.urdf_filename, srdf_filename=py_3.srdf_filename, scale_factor=units)  # -> out, robot; inputs load: Boolean, loaders: list
# ---------- create: Python ----------
import os
from scriptcontext import sticky as st

import compas

from compas.robots import RobotModel
from compas.robots import LocalPackageMeshLoader

#from compas_fab.robots import Robot
from robot_see_robot_do.robot import Robot
from compas_fab.robots import RobotSemantics

from compas_fab.ghpython import RobotArtist

compas.PRECISION = '12f'

# store robot in component
guid = str(ghenv.Component.InstanceGuid)
robot_key = "robot_" + guid

if robot_key not in st:
    st[robot_key] = None

print loaders
if load:
    model = RobotModel.from_urdf_file(urdf_filename)
    
    model.load_geometry(*loaders)
    artist = RobotArtist(model)
    semantics = RobotSemantics.from_srdf_file(srdf_filename, model)
    robot = Robot(model, artist, semantics, client=None)

    
    st[robot_key] = robot

robot = st[robot_key]


if robot:
    robot.scale(scale_factor)
# ---------- end create ----------
set = PythonScript(robot=create.robot, client=ros_client)  # -> robot
# ---------- set: Python ----------
if robot and client:
    robot.client = client
# ---------- end set ----------
robot = Data(set)

# ----
# Base
x_axis = Curve(<curve referenced from the Rhino model>)
y_axis = Curve(<curve referenced from the Rhino model>)
x_axis_2 = Curve(<curve referenced from the Rhino model>)
y_axis_2 = Curve(<curve referenced from the Rhino model>)
breps = Geometry([<mesh referenced from the Rhino model> x22, <brep referenced from the Rhino model> x82])
plane = PythonScript(plane_axes=[x_axis, y_axis])  # -> plane; inputs plane_axes: list of Curve
# ---------- plane: Python ----------
import Rhino.Geometry as rg

x_axis, y_axis = plane_axes

x_axis = rg.Line(x_axis.PointAtStart, x_axis.PointAtEnd)
y_axis = rg.Line(y_axis.PointAtStart, y_axis.PointAtEnd)

if x_axis.From.DistanceTo(y_axis.From) < 0.01:
    origin = x_axis.From
    xvec = x_axis.Direction
    yvec = y_axis.Direction
elif x_axis.To.DistanceTo(y_axis.To) < 0.01:
    origin = x_axis.To
    xvec = -x_axis.Direction
    yvec = -y_axis.Direction
elif x_axis.From.DistanceTo(y_axis.To) < 0.01:
    origin = x_axis.From
    xvec = x_axis.Direction
    yvec = -y_axis.Direction
elif x_axis.To.DistanceTo(y_axis.From) < 0.01:
    origin = x_axis.To
    xvec = -x_axis.Direction
    yvec = y_axis.Direction

plane = rg.Plane(origin, xvec, yvec)
# ---------- end plane ----------
plane_2 = PythonScript(plane_axes=[x_axis_2, y_axis_2])  # -> plane; inputs plane_axes: list of Curve; same code as plane
base = PythonScript(base_plane=plane, pickup_plane=plane_2)  # -> base_frame, picking_frame
# ---------- base: Python ----------
from compas.geometry import Frame
from compas.geometry import Transformation, Rotation
from compas_ghpython import draw_frame
import math
import Rhino.Geometry as rg



base_frame = Frame(base_plane.Origin, base_plane.XAxis, base_plane.YAxis)

picking_frame = Frame(pickup_plane.Origin, pickup_plane.XAxis, pickup_plane.YAxis)
# ---------- end base ----------
py_7 = PythonScript(
    robot=robot,
    origin_frame=base.base_frame,
    base_geometry=breps,
    picking_frame=base.picking_frame,
    set_to_origin_frame=Toggle(True))  # -> a, picking_plane_WCF; inputs base_geometry: list, set_to_origin_frame: Boolean
# ---------- py_7: Python ----------
from compas_ghpython import draw_frame
from compas.geometry import Frame, Point, Vector, Transformation
from compas.datastructures import Mesh
from compas_rhino.geometry import RhinoMesh
from compas_fab.robots import CollisionMesh



if set_to_origin_frame == True:
    robot.set_origin_frame(origin_frame)
else:
    robot.set_origin_frame(Frame.worldXY())

if len(base_geometry):
    robot.set_base_geometry(base_geometry)

if picking_frame:
    picking_frame_WCF = robot.to_world_coordinates_origin(picking_frame)
    robot.set_picking_frame(picking_frame_WCF)
    picking_plane_WCF = draw_frame(picking_frame_WCF)
# ---------- end py_7 ----------

# ----
# Tool
panel_11 = Panel("Attach a custom tool")
list_8 = ValueList({"measurement_tool": 0, "air_pick_15mm": 1, "area_gripper": 2, "parallel_gripper": 3}, selected="area_gripper")
show_9 = BooleanToggle(False)
python_4 = PythonScript(data_path=py_2, tool=list_8, show=show_9)  # -> tool, M, compas_mesh
# ---------- python_4: Python ----------
import os, math
from compas.geometry import Frame, Rotation
from compas.datastructures import Mesh
from compas_ghpython.artists import MeshArtist
from compas_fab.robots import Tool

tolerance = 0


if tool == 0:
    filename = 'measurement_tool_zaxis.stl'
    ee_frame = Frame([0, 0, 0.109], [1, 0, 0], [0, 1, 0])

elif tool == 1:
    filename = 'airpick_40.stl'
    ee_frame = Frame([0, 0, 0.158 + tolerance], [1, 0, 0], [0, 1, 0])
    
elif tool == 2:
    filename = 'area_gripper_zaxis.stl'
    ee_frame = Frame([0, 0, 0.10219 + tolerance], [0, 1, 0], [-1, 0, 0])

elif tool == 3:
    filename = 'parallel_gripper_iaac.stl'
    ee_frame = Frame([0, 0, 0.1135 + tolerance], [1, 0, 0], [0, 1, 0])    
    
data_path = os.path.join(data_path, "tool_geometry")
fullfilename = os.path.join(data_path, filename)
print fullfilename

ee_mesh = Mesh.from_stl(fullfilename)

#R = Rotation.from_axis_and_angle(ee_frame.zaxis, math.radians(180), point=ee_frame.point)
#ee_frame.transform(R)

if show:
    artist = MeshArtist(ee_mesh)
    M = artist.draw()

tool = Tool(ee_mesh, ee_frame)
compas_mesh = ee_mesh
# ---------- end python_4 ----------
py_8 = PythonScript(robot=robot, tool=python_4.tool, attach=Toggle(True))  # -> a
# ---------- py_8: Python ----------
if attach:
    robot.attach_tool(tool)
else:
    robot.detach_tool()
# ---------- end py_8 ----------

scene = PythonScript(robot=robot)  # -> scene
# ---------- scene: Python ----------
from scriptcontext import sticky as st

from compas_fab.robots import PlanningScene

# store scene in component
guid = str(ghenv.Component.InstanceGuid)
scene_key = "scene_" + guid

if scene_key not in st:
    st[scene_key] = None

if robot:
    scene = PlanningScene(robot)
    scene.cm = []
    scene.acm = []
    scene.bcm = None
    st[scene_key] = scene

scene = st[scene_key]
# ---------- end scene ----------

panel_12 = Panel("base collision mesh")
remove = Button()
scale = BooleanToggle(False)
add = Button()
collision = PythonScript(robot=robot, scene=scene, compas_mesh=mesh_3, scale=scale, id="base_cm", add=add, remove=remove)  # -> out, a
# ---------- collision: Python ----------
from compas_fab.robots import CollisionMesh


cm = CollisionMesh(compas_mesh, id)


if scene:
    if add:
        scene.add_collision_mesh(cm, scale)
        scene.bcm = cm
    if remove:
        scene.remove_collision_mesh(id)
        scene.bcm = None
# ---------- end collision ----------
panel_13 = Panel(collision.out)

panel_14 = Panel("assembly collision mesh")
remove_2 = Button()
add_2 = Button()
collision_2 = PythonScript(robot=robot, scene=scene, compas_meshes=mesh_2.elems_compas_meshes, add=add_2, remove=remove_2)  # -> out, a; inputs compas_meshes: list
# ---------- collision_2: Python ----------
from compas_fab.robots import CollisionMesh



T = robot.transformation_WCF_OCF()

cms_OCF = []
for i, compas_mesh in enumerate(compas_meshes):
    id = 'element_' + str(i)
    compas_mesh_OCF = compas_mesh.transformed(T)
    cm_OFC = CollisionMesh(compas_mesh_OCF, id)
    cms_OCF.append(cm_OFC)


if scene:
    if add:
        for cm in cms_OCF:
            scene.add_collision_mesh(cm)
            scene.cm.append(cm)
    if remove:
        for cm in cms_OCF:
            scene.remove_collision_mesh(id)
            scene.cm.remove(scene.cm[-1])
# ---------- end collision_2 ----------
panel_15 = Panel(collision_2.out)

info = PythonScript(robot=robot)  # -> out, main_group_name
# ---------- info: Python ----------
if robot:
    robot.info()
    main_group_name = robot.main_group_name
# ---------- end info ----------
panel_16 = Panel(info.out)

# ----
# Attach an collision object
# Select link name to attach
# Select the links the object is allowed to touch
number_slider_3 = Slider(7, range=0..7)
idxs = Data([3, 4, 5, 6, 7])
py_9 = PythonScript(robot=robot, idx=number_slider_3)  # -> link_name; inputs idx: Int32
# ---------- py_9: Python ----------
if robot:
    link_names = robot.get_link_names()
    #print link_names
    link_name = link_names[idx]
# ---------- end py_9 ----------
panel_17 = Panel(py_9)
py_10 = PythonScript(robot=robot, idxs=idxs)  # -> touch_links; inputs idxs: list of Int32
# ---------- py_10: Python ----------
if robot:
    link_names = robot.get_link_names()
    touch_links = [link_names[i] for i in idxs]
# ---------- end py_10 ----------
panel_18 = Panel(py_10)
remove_3 = Button()
scale_2 = BooleanToggle(False)
add_3 = Button()
attached = PythonScript(
    scene=scene,
    compas_mesh=mesh_2.elem_compas_mesh,
    scale=scale_2,
    id="tip",
    link_name=py_9,
    touch_links=py_10,
    add=add_3,
    remove=remove_3)  # -> acm, out; inputs touch_links: list
# ---------- attached: Python ----------
from compas_fab.robots import CollisionMesh
from compas_fab.robots import AttachedCollisionMesh

cm = CollisionMesh(compas_mesh, id)
acm = AttachedCollisionMesh(cm, link_name, touch_links)

if scene:
    if add:
        scene.add_attached_collision_mesh(acm, scale)
        scene.acm.append(acm)
    if remove:
        scene.remove_attached_collision_mesh(id)
        scene.remove_collision_mesh(id)
        scene.acm.remove(scene.acm[-1])
# ---------- end attached ----------

server_ip = ValueList({"192.168.0.48", "127.0.0.1", "192.168.10.111"}, selected="192.168.0.48")
server_port = ValueList({"50000", "50002", "50003", "50004", "50005", "30003"}, selected="50004")
ur_port = ValueList({"30002", "30001"}, selected="30002")
globals = PythonScript(server_ip=server_ip, server_port=server_port, ur_ip=ur_ip, ur_port=ur_port, robot=robot, clear=Button())  # inputs server_port: Int32
# ---------- globals: Python ----------
from scriptcontext import sticky as st

st["server_ip"] = server_ip
st["server_port"] = server_port



st["ur_ip"] = ur_ip
    
st["ur_port"] = ur_port

st["robot"] = robot



if clear:
    st.clear()
# ---------- end globals ----------

# ----
# 2b.
# Fabrication Settings
python_5 = GhPythonScript(robot=robot, current_tool_plane=pln_9)  # -> out, picking_configuration, picking_plane_WCF, placing_plane_WCF, picking_plane_safe_WCF, placing_plane_safe_WCF
# ---------- python_5: Python ----------
import math
from compas.geometry import Frame, Transformation
from compas_ghpython import draw_frame
from compas_fab.robots import Configuration
import Rhino.Geometry as rg

if current_tool_plane:
    picking_frame_WCF = robot.get_picking_frame()
    picking_plane_WCF = draw_frame(picking_frame_WCF)
    #picking_plane_WCF.Translate(rg.Vector3d.ZAxis*-0.015)
    #picking_plane_WCF.Translate(rg.Vector3d.ZAxis*0.05)

    placing_plane_WCF = current_tool_plane
    
    picking_plane_safe_WCF = rg.Plane(picking_plane_WCF)
    R = rg.Transform.Rotation(math.radians(-10.03), picking_plane_WCF.XAxis, picking_plane_WCF.Origin)
    picking_plane_safe_WCF.Transform(R)
    picking_plane_safe_WCF.Translate(picking_plane_safe_WCF.ZAxis*-0.5)
    
    placing_plane_safe_WCF = rg.Plane(placing_plane_WCF)
    placing_plane_safe_WCF.Translate(placing_plane_WCF.ZAxis*-0.80)
    
    #picking_configuration = Configuration((2.116, 4.127, -0.573, -2.464, -1.224, -1.571), (0, 0, 0, 0, 0, 0), ('elbow_joint', 'wrist_3_joint', 'shoulder_pan_joint', 'shoulder_lift_joint', 'wrist_1_joint', 'wrist_2_joint'))
    #picking_configuration = Configuration((-1.403, -1.615, 2.324, -2.280, -1.571, -0.617), (0, 0, 0, 0, 0, 0), ('shoulder_pan_joint', 'shoulder_lift_joint', 'elbow_joint', 'wrist_1_joint', 'wrist_2_joint', 'wrist_3_joint'))
    picking_configuration = Configuration((-2.928, -1.954, 2.372, -1.989, -1.571, -3.714), (0, 0, 0, 0, 0, 0), ('shoulder_pan_joint', 'shoulder_lift_joint', 'elbow_joint', 'wrist_1_joint', 'wrist_2_joint', 'wrist_3_joint'))
# ---------- end python_5 ----------

# ----
# 3.
# Configuration
main_planning_group = Text(info.main_group_name)

# ---- group: inverse kinematics
py_11 = PythonScript()  # -> configuration
# ---------- py_11: Python ----------
from compas_fab.robots import Configuration

if robot:
    types = robot.get_configurable_joint_types()
    values = [0] * len(types)
    configuration = Configuration(values, types)
    print configuration
    print robot.get_configurable_joint_names()
# ---------- end py_11 ----------
start_configuration_2 = Data(python_5.picking_configuration)
list_9 = ValueList({"start": 0, "end": 1, "placing": 2}, selected="start")
list_10 = ValueList({"0", "1"}, selected="0")
filter = StreamFilter(
    Gate=list_9,
    Stream0=python_5.picking_plane_safe_WCF,
    Stream1=python_5.placing_plane_safe_WCF,
    Stream2=python_5.placing_plane_WCF)
filter_2 = StreamFilter(Gate=list_10, Stream0=start_configuration_2, Stream1=py_11)
inverse = PythonScript(robot=robot, group=main_planning_group, start_configuration=filter_2, plane=filter, compute=Toggle(True))  # -> out, configuration
# ---------- inverse: Python ----------
import scriptcontext as sc
import logging

from compas.geometry import Frame

from compas_fab.backends.ros import RosError
from compas_fab.robots import Configuration

LOGGER = logging.getLogger('roslibpy')

frame_WCF = Frame(plane.Origin, plane.XAxis, plane.YAxis)
frame_OCF = robot.to_local_coordinates_origin(frame_WCF) # express within the robot frame
if robot.attached_tool:
    frame_OCF = robot.from_tcf_to_t0cf([frame_OCF])[0]

if robot:
    if robot.client and compute:
        if robot.client.is_connected:
            configuration = robot.inverse_kinematics(frame_OCF, start_configuration, group)
            print(configuration)
        else:
            print("Robot is not connected")
# ---------- end inverse ----------
panel_19 = Panel(inverse.out)

# ---- group: forward kinematics
a1 = Slider(-135, range=-360..360)
a5 = Slider(-90, range=-360..360)
a2 = Slider(-90, range=-360..360)
a3 = Slider(90, range=-360..360)
a4 = Slider(-90, range=-360..360)
a6 = Slider(-90, range=-360..360)
jp = GhPythonScript()  # -> joint_positions
# ---------- jp: Python ----------
import math
from compas_fab.robots import Configuration

joint_positions = [0,-90,90,0,90,0]
joint_positions = [-180,-90,90,-90,-90,-90]
joint_positions = [math.radians(a) for a in joint_positions]
#joint_positions = [-3.136, -0.328, -1.218, 3.129, 0.852, 0.008]
joint_positions = [-2.316, -1.814, 2.209, -1.965, -1.571, 2.396]
joint_positions = [-2.356, -1.571, 1.571, -1.571, -1.571, -1.571]
#joint_positions = [5.2996800000000004, -1.8766700000000001, -2.4221200000000001, -0.39607100000000001, 1.54617, 0.074741500000000002]


#joint_positions = [0] * 6

print joint_positions
# ---------- end jp ----------
forward_kinematics = PythonScript(robot=robot, set_joint_positions=Button(), joint_positions=jp, a1=a1, a2=a2, a3=a3, a4=a4, a5=a5, a6=a6)  # -> full_configuration; inputs joint_positions: list
# ---------- forward_kinematics: Python ----------
import math
import Grasshopper
from compas.robots import Joint
from compas_fab.robots import Configuration

if set_joint_positions:

    j = 0
    for i in range(ghenv.Component.Params.Input.Count):
        nslider = ghenv.Component.Params.Input[i].Sources[0]
        if nslider.GetType() == Grasshopper.Kernel.Special.GH_NumberSlider:
            nslider.TrySetSliderValue(math.degrees(joint_positions[j]))
            j += 1

if robot:
    joint_positions = [a1, a2, a3, a4, a5, a6]
    joint_types = robot.get_configurable_joint_types()
    for i, joint_type in enumerate(joint_types):
        if joint_type == Joint.REVOLUTE:
            joint_positions[i] = math.radians(joint_positions[i])
    full_configuration = Configuration(joint_positions, joint_types)


print(full_configuration)
# ---------- end forward_kinematics ----------

# ----
test = PythonScript(start_plane=python_5.picking_plane_safe_WCF, end_plane=python_5.picking_plane_WCF)  # -> planes
# ---------- test: Python ----------
planes = [start_plane, end_plane]
print planes
# ---------- end test ----------

# ---- group: forward kinematics
forward = PythonScript(group=main_planning_group, full_configuration=forward_kinematics)  # -> out, frame_WCF
# ---------- forward: Python ----------
"""Calculate the robot's forward kinematic.
    Inputs:
        robot: :class:`compas_fab.robots.Robot`
            The robot.
        group: str, optional
            The planning group used for calculation. Defaults to the robot's
            main planning group.
        full_configuration : :class:`compas_fab.robots.Configuration`
            The full configuration to calculate the forward kinematic for. If no
            full configuration is passed, the zero-joint state for the other
            configurable joints is assumed.
    Output:
        :class:`Frame`
            The frame in the world coordinate frame (WCF).
"""
from __future__ import print_function
import logging

import compas_fab
print(compas_fab.__version__)

LOGGER = logging.getLogger('roslibpy')

if robot and robot.client and full_configuration:
    if robot.client.is_connected:
        frame_WCF = robot.forward_kinematics(full_configuration, group, options={'backend':'model'})
        #frame_WCF = robot.forward_kinematics(full_configuration, group, backend='model')
        print(frame_WCF)
    else:
        print("Robot is not connected")
# ---------- end forward ----------
panel_20 = Panel(forward.out)

# ----
# Move Cartesian
list_11 = ValueList({"send all positions": 0, "send only one position": 1, "from inverse": 2}, selected="send all positions")
add_4 = Button()
clear_2 = Button()
crv_4 = Curve(<curve referenced from the Rhino model>)
idx_3 = Slider(0, range=0..100)
hframes = HorizontalFrames(Curve=crv_4, Count=10)  # -> Frames, Parameters
rec_car = PythonScript(rec=add_4, clear=clear_2)  # -> rec; same code as rec
item = ListItem(List=python_5.placing_plane_safe_WCF, Index=idx_3, Wrap=True)
filter_3 = StreamFilter(Gate=list_11, Stream0=hframes.Frames, Stream1=item, Stream2=rec_car)
radius = Slider(0.5, range=0..0.5)
movel = PythonScript(planes_WCS=filter_3, velocity=Slider(0.05, range=0..0.5), radius=radius)  # -> urscript; inputs planes_WCS: list
# ---------- movel: Python ----------
import Rhino.Geometry as rg
from compas.geometry import Frame
from compas.geometry import Transformation, Rotation
from compas_ghpython import draw_frame
from compas_fab.robots import robot
from ur_fabrication_control import direct_control 
import math

from scriptcontext import sticky as st
from ur_fabrication_control.direct_control import URScript

robot = st["robot"]

# retrieve the current tool frame in axis angle format
if robot.attached_tool:
    tool_angle_axis = list(robot.attached_tool.frame.point) + list(robot.attached_tool.frame.axis_angle_vector)
else:
    tool0_frame = Frame([0, 0, 0], [1, 0, 0], [0, 1, 0])
    tool_angle_axis = list(tool0_frame.point) + list(tool0_frame.axis_angle_vector)

frames_RCS = []
for plane_WCS in planes_WCS:
    frame_WCS = Frame(plane_WCS.Origin, plane_WCS.XAxis, plane_WCS.YAxis)
    frame_RCS = robot.to_local_coordinates(frame_WCS)
    frames_RCS.append(frame_RCS)

urscript = URScript()
urscript.start()
urscript.moves_linear(frames_RCS, velocity, radius)
urscript.end()

urscript = urscript.generate()

print(urscript)
# ---------- end movel ----------
send_5 = Button()
send_6 = GhPythonScript(urscript=movel, send=send_5)  # -> out; inputs send: Boolean; same code as send_2

start_configurations = Data(python_5.picking_configuration)

# ---- group: plan motion
# 2. 'Move' free-space motion
# If you specify the tolerance vector with [360, 1, 1], it means that
#     the frame's y-axis and z-axis are allowed to rotate about the x-axis by an
#     angle of 360 degrees, whereas the x-axis can only change 1 degree.
# TODO Example:
# Add path constraints
group = Data(main_planning_group)
list_12 = ValueList({"don't use attached collision mesh": 0, "use attached collision mesh": 1}, selected="use attached collision mesh")
python_6 = PythonScript(
    robot=robot,
    group=group,
    goal_plane=python_5.placing_plane_safe_WCF,
    tolerance_position=Slider(0.001, range=0..0.001),
    tolerance_xaxis_deg=Slider(1, range=1..360),
    tolerance_yaxis_deg=Slider(1, range=1..360),
    tolerance_zaxis_deg=Slider(1, range=1..360))  # -> goal_constraints
# ---------- python_6: Python ----------
import math
from compas.geometry import Frame

frame_WCF = Frame(goal_plane.Origin, goal_plane.XAxis, goal_plane.YAxis)
frame_OCF = robot.to_local_coordinates_origin(frame_WCF)

if robot.attached_tool:
    frame_OCF = robot.from_tcf_to_t0cf([frame_OCF])[0]

tolerances_axes = [math.radians(tolerance_xaxis_deg), math.radians(tolerance_yaxis_deg), math.radians(tolerance_zaxis_deg)]

if robot:
    goal_constraints = robot.constraints_from_frame(frame_OCF, tolerance_position, tolerances_axes, group)
# ---------- end python_6 ----------
start_4 = Button()
reset_4 = Button()
step_3 = Button()
compute_3 = Button()
list_13 = ValueList({"RRT", "RRT*": "RRTStar", "EST", "PRM": "RPM", "PRM*": "RPMStar", "SPARS"}, selected="RRT")
filter_4 = StreamFilter(Gate=list_12)

# ---- group: cartesian motion
# 1. 'Pick' cartesian motion
group_2 = Data(main_planning_group)
list_14 = ValueList({"don't use attached collision mesh": 0, "use attached collision mesh": 1}, selected="don't use attached collision mesh")
py_12 = PythonScript()  # -> configuration
# ---------- py_12: Python ----------
from compas_fab.robots import Configuration

if robot:
    types = robot.get_configurable_joint_types()
    values = [0] * len(types)

    configuration = Configuration(values, types)
    print configuration
# ---------- end py_12 ----------
start_configuration_3 = Data(python_5.picking_configuration)
list_15 = ValueList({"0", "1"}, selected="0")
py_13 = PythonScript(start_plane=python_5.picking_plane_WCF, end_plane=python_5.picking_plane_safe_WCF)  # -> planes; same code as test
compute_4 = Button()
filter_5 = StreamFilter(Gate=list_15, Stream0=start_configuration_3, Stream1=py_12)
filter_6 = StreamFilter(Gate=list_14)
plan_cartesian_motion_2 = PythonScript(
    robot=robot,
    group=group_2,
    planes=py_13,
    start_configuration=filter_5,
    max_step=Slider(0.01, range=0..0.1),
    attached_collision_meshes=filter_6,
    compute=compute_4)  # -> out, trajectory; inputs planes: list, attached_collision_meshes: list
# ---------- plan_cartesian_motion_2: Python ----------
"""Calculates a cartesian motion path (linear in tool space).
    Inputs:
        robot: The robot
        group: str, optional
            The planning group used for calculation. Defaults to the robot's
            main planning group.
        planes: The planes in world coordinate frame through which the path is defined.
        start_configuration: :class:`compas_fab.robots.Configuration`, optional
            The robot's full configuration, i.e. values for all configurable
            joints of the entire robot cell, at the starting position. Defaults
            to the all-zero configuration.
        max_step: float
            The approximate distance between the calculated points. (Defined in
            the robot's units)
        avoid_collisions: bool, optional
            Whether or not to avoid collisions. Defaults to True.
        attached_collision_meshes: list of :class:`compas_fab.robots.AttachedCollisionMesh`
            Defaults to None.
        compute: bool
            Press to calculate solution.
    Output:
        :class:`compas_fab.robots.JointTrajectory`
            The calculated trajectory.
"""
from __future__ import print_function
import logging
import scriptcontext as sc

from compas.geometry import Frame

frames_WCF = [Frame(plane.Origin, plane.XAxis, plane.YAxis) for plane in planes]
frames_OCF = [robot.to_local_coordinates_origin(frame_WCF) for frame_WCF in frames_WCF]
if robot.attached_tool:
    frames_OCF = [robot.from_tcf_to_t0cf([frame])[0] for frame in frames_OCF]

guid = str(ghenv.Component.InstanceGuid)
response_key = "response_" + guid
if response_key not in sc.sticky:
    sc.sticky[response_key] = None

LOGGER = logging.getLogger('roslibpy')
data = dict(requesting_solution=False)

if robot and robot.client and start_configuration and compute:
    if robot.client.is_connected:
        
        sc.sticky[response_key] = robot.plan_cartesian_motion(frames_OCF,
                                                              start_configuration=start_configuration,
                                                              group=group,
                                                              options=dict(
                                                                max_step=float(max_step),
                                                                attached_collision_meshes=list(attached_collision_meshes),
                                                              ))
    else:
        print("Robot client is not connected")

trajectory = sc.sticky[response_key]
# ---------- end plan_cartesian_motion_2 ----------
vis_2 = PythonScript(response=plan_cartesian_motion_2.trajectory)  # -> P, V, A
# ---------- vis_2: Python ----------
from compas_ghpython import list_to_ghtree

if response:
    #print response.points
    positions = []
    velocities = []
    accelerations = []

    for p in response.points:
        positions.append(p.positions)
        velocities.append(p.velocities)
        accelerations.append(p.accelerations)
    #print positions
    P = list_to_ghtree(list(zip(*positions)))
    V = list_to_ghtree(list(zip(*velocities)))
    A = list_to_ghtree(list(zip(*accelerations)))
# ---------- end vis_2 ----------
prismatic_2 = QuickGraph(vis_2.P, SortOrder=0)
panel_25 = Panel(plan_cartesian_motion_2.out)
graph_3 = QuickGraph(vis_2.V, SortOrder=0)
graph_4 = QuickGraph(vis_2.A, SortOrder=0)
start_5 = Button()
reset_5 = Button()
step_4 = Button()

# 1. 'Move' cartesian motion
group_3 = Data(main_planning_group)
list_16 = ValueList({"don't use attached collision mesh": 0, "use attached collision mesh": 1}, selected="don't use attached collision mesh")
py_14 = PythonScript(start_plane=python_5.placing_plane_safe_WCF, end_plane=python_5.placing_plane_safe_WCF)  # -> planes; same code as test
filter_7 = StreamFilter(Gate=list_16)
start_6 = Button()
reset_6 = Button()
step_5 = Button()

# 3. 'Place' cartesian motion
group_4 = Data(main_planning_group)
list_17 = ValueList({"don't use attached collision mesh": 0, "use attached collision mesh": 1}, selected="don't use attached collision mesh")
py_15 = PythonScript(start_plane=python_5.placing_plane_safe_WCF, end_plane=python_5.placing_plane_WCF)  # -> planes; same code as test
compute_5 = Button()
filter_8 = StreamFilter(Gate=list_17)
start_7 = Button()
reset_7 = Button()
step_6 = Button()

# ----
# 3.
list_18 = ValueList({"0 forward_kinematics": 0, "1 inverse_kinematics": 1, "2 cartesian motion": 2, "3 free-space motion": 3, "4 'pick and place'": 4}, selected="2 cartesian motion")

# ----
# Move Joints
clear_3 = Button()
add_5 = Button()
# 4a.
list_19 = ValueList({"send all positions": 0, "send only one position": 1, "from inverse": 2}, selected="send all positions")
idx_4 = Slider(5, range=0..100)
rec_joints = PythonScript(msg=pose_2.configuration, rec=add_5, clear=clear_3)  # -> rec
# ---------- rec_joints: Python ----------
from scriptcontext import sticky as st

guid = str(ghenv.Component.InstanceGuid)
recorded_key =  "recorded_" + guid
just_cleared_key = "just_cleared_" + guid


if recorded_key not in st:
    st[recorded_key] = []

if just_cleared_key not in st:
    st[just_cleared_key] = False

if clear:
    st[recorded_key] = []
    st[just_cleared_key] = True
else:
    if msg != [None] and not st[just_cleared_key] and rec:
        st[recorded_key].append(msg)
    st[just_cleared_key] = False
        


rec = st[recorded_key]

print rec
# ---------- end rec_joints ----------
send_7 = Button()

# ----
# Generate 'pick and place' commands
list_20 = ValueList({"1a. pick_to_pickup_safe": 0, "1b. pickup_safe_to_placing_safe": 1, "1c. placing_safe_to_placing": 2, "2. placing_to_pickup_safe": 3, "3. pick and place": 4}, selected="1a. pick_to_pickup_safe")
radius_2 = Slider(0.01, range=0..0.1)
send_8 = Button()

# ----
# Select configuration input: from fk, ik, path, or from real robot
# Visualisation
show_end_effector_frame = BooleanToggle(True)
show_picking_frame = BooleanToggle(True)
show_origin_frame = BooleanToggle(True)
show_base_frame = BooleanToggle(False)
show_collision = BooleanToggle(False)
show_in_world = BooleanToggle(True)
show_frames = BooleanToggle(False)
show_visual = BooleanToggle(True)
show_bcm = BooleanToggle(True)
show_acm = BooleanToggle(True)
show_cm = BooleanToggle(True)

# ---- group: cartesian motion (continued)
py_16 = PythonScript(robot=robot, group=group_2, trajectory=plan_cartesian_motion_2.trajectory, in_world=show_in_world)  # -> configurations, full_configurations, frames, planes, fraction, time
# ---------- py_16: Python ----------
from compas.geometry import Transformation
from compas.geometry import Frame
from compas_ghpython import draw_frame
from compas_rhino.conversions import xform_to_rhino

import ghpythonlib.components as ghcomp

joint_positions = []

if in_world:
    T = robot.transformation_OCF_WCF()
else:
    T = Transformation()

if trajectory:
    configurations = trajectory.points
    start_configuration = trajectory.start_configuration
    fraction = trajectory.fraction
    time = trajectory.time_from_start
    full_configurations = [robot.merge_group_with_full_configuration(c, trajectory.start_configuration, group) for c in configurations]
    frames = [robot.forward_kinematics(c, group, options=dict(solver='model')) for c in full_configurations]
    if robot.attached_tool:
        frames = [robot.from_t0cf_to_tcf([frame])[0] for frame in frames]
    planes = [draw_frame(frame) for frame in frames]
    planes = ghcomp.Transform(planes, xform_to_rhino(T))
# ---------- end py_16 ----------
pline = PolyLine(Vertices=py_16.planes, Closed=False)
fraction_2 = Panel(py_16.fraction)
counter_3 = CountThroughList(L=py_16.full_configurations, start=start_5, step=step_4, reset=reset_5)  # -> item; inputs L: list, start: Boolean
# ---------- counter_3: Python ----------
from scriptcontext import sticky as st
from compas_ghpython.utilities import update_component


interval = 1

# store data in component
guid = str(ghenv.Component.InstanceGuid)
counter_key = "counter_" + guid
running_key = "running_" + guid

if counter_key not in st:
    st[counter_key] = 0

if running_key not in st:
    st[running_key] = False

if start:
    st[running_key] = True

if step:
    if st[counter_key] < len(L) - 1:
        st[counter_key] += 1
    
if len(L):
    item = L[st[counter_key]]

if st[running_key]:
    if st[counter_key] < len(L) - 1:
        st[counter_key] += 1
        update_component(ghenv, interval)
    else:
        st[counter_key] = 0
        st[running_key] = False
# ---------- end counter_3 ----------
preview_5 = CustomPreview(Geometry=[pline, py_16.planes], Material=ColourSwatch(SwatchColor=RGB(59, 137, 161)))

py_17 = PythonScript(configurations=py_16.configurations)  # -> last_configuration; inputs configurations: list
# ---------- py_17: Python ----------
from compas_fab.robots import Configuration

if list(configurations) != [None]:
    last_configuration = Configuration(configurations[-1].joint_values, configurations[-1].joint_types)
    print last_configuration
# ---------- end py_17 ----------
plan_cartesian_motion_3 = PythonScript(
    robot=robot,
    group=group_3,
    planes=py_14,
    start_configuration=py_17,
    max_step=Slider(0.01, range=0..0.01),
    attached_collision_meshes=filter_7,
    compute=compute_2)  # -> out, trajectory; inputs planes: list, attached_collision_meshes: list
# ---------- plan_cartesian_motion_3: Python ----------
"""Calculates a cartesian motion path (linear in tool space).
    Inputs:
        robot: The robot
        group: str, optional
            The planning group used for calculation. Defaults to the robot's
            main planning group.
        planes: The planes in world coordinate frame through which the path is defined.
        start_configuration: :class:`compas_fab.robots.Configuration`, optional
            The robot's full configuration, i.e. values for all configurable
            joints of the entire robot cell, at the starting position. Defaults
            to the all-zero configuration.
        max_step: float
            The approximate distance between the calculated points. (Defined in
            the robot's units)
        avoid_collisions: bool, optional
            Whether or not to avoid collisions. Defaults to True.
        attached_collision_meshes: list of :class:`compas_fab.robots.AttachedCollisionMesh`
            Defaults to None.
        compute: bool
            Press to calculate solution.
    Output:
        :class:`compas_fab.robots.JointTrajectory`
            The calculated trajectory.
"""
from __future__ import print_function
import logging
import scriptcontext as sc

from compas.geometry import Frame

LOGGER = logging.getLogger('roslibpy')

guid = str(ghenv.Component.InstanceGuid)
response_key = "response_" + guid
if response_key not in sc.sticky:
    sc.sticky[response_key] = None

frames_WCF = [Frame(plane.Origin, plane.XAxis, plane.YAxis) for plane in planes]
frames_OCF = [robot.to_local_coordinates_origin(frame_WCF) for frame_WCF in frames_WCF]
if robot.attached_tool:
    frames_OCF = [robot.from_tcf_to_t0cf([frame])[0] for frame in frames_OCF]

if robot and robot.client and start_configuration and compute:
    if robot.client.is_connected:
        
        sc.sticky[response_key] = robot.plan_cartesian_motion(frames_OCF,
                                                              start_configuration=start_configuration,
                                                              group=group,
                                                              options={
                                                                'max_step': float(max_step),
                                                                'attached_collision_meshes': list(attached_collision_meshes),
                                                              })
    else:
        print("Robot client is not connected")

trajectory = sc.sticky[response_key]
# ---------- end plan_cartesian_motion_3 ----------
vis_3 = PythonScript(response=plan_cartesian_motion_3.trajectory)  # -> P, V, A; same code as vis_2
prismatic_3 = QuickGraph(vis_3.P, SortOrder=0)
py_18 = PythonScript(robot=robot, group=group_3, trajectory=plan_cartesian_motion_3.trajectory, in_world=show_in_world)  # -> configurations, full_configurations, frames, planes, fraction, time; same code as py_16
panel_34 = Panel(plan_cartesian_motion_3.out)
graph_5 = QuickGraph(vis_3.V, SortOrder=0)
graph_6 = QuickGraph(vis_3.A, SortOrder=0)
pline_2 = PolyLine(Vertices=py_18.planes, Closed=False)
fraction_3 = Panel(py_18.fraction)
counter_4 = CountThroughList(L=py_18.full_configurations, start=start_6, step=step_5, reset=reset_6)  # -> item; inputs L: list, start: Boolean; same code as counter_3
preview_6 = CustomPreview(Geometry=[pline_2, py_18.planes], Material=ColourSwatch(SwatchColor=RGB(59, 137, 161)))

py_19 = PythonScript(configurations=py_18.configurations)  # -> last_configuration; inputs configurations: list
# ---------- py_19: Python ----------
from compas_fab.robots import Configuration
if list(configurations) != [None]:
    last_configuration = Configuration(configurations[-1].joint_values, configurations[-1].joint_types)
    print last_configuration
# ---------- end py_19 ----------
plan_cartesian_motion_4 = PythonScript(
    robot=robot,
    group=group_4,
    planes=py_15,
    start_configuration=py_19,
    max_step=Slider(0.01, range=0..0.01),
    attached_collision_meshes=filter_8,
    compute=compute_5)  # -> out, trajectory; inputs planes: list, attached_collision_meshes: list; same code as plan_cartesian_motion_3
vis_4 = PythonScript(response=plan_cartesian_motion_4.trajectory)  # -> P, V, A; same code as vis_2
prismatic_4 = QuickGraph(vis_4.P, SortOrder=0)
py_20 = PythonScript(robot=robot, group=group_4, trajectory=plan_cartesian_motion_4.trajectory, in_world=show_in_world)  # -> configurations, full_configurations, frames, planes, fraction, time; same code as py_16
panel_35 = Panel(plan_cartesian_motion_4.out)
graph_7 = QuickGraph(vis_4.V, SortOrder=0)
graph_8 = QuickGraph(vis_4.A, SortOrder=0)
pline_3 = PolyLine(Vertices=py_20.planes, Closed=False)
fraction_4 = Panel(py_20.fraction)
counter_5 = CountThroughList(L=py_20.full_configurations, start=start_7, step=step_6, reset=reset_7)  # -> item; inputs L: list, start: Boolean; same code as counter_3
preview_7 = CustomPreview(Geometry=[pline_3, py_20.planes], Material=ColourSwatch(SwatchColor=RGB(59, 137, 161)))

# ---- group: plan motion (continued)
py_21 = PythonScript(configurations=py_16.configurations)  # -> last_configuration; inputs configurations: list; same code as py_17
plan_motion = PythonScript(
    robot=robot,
    group=group,
    start_configuration=py_21,
    goal_constraints=python_6,
    planner_id=list_13,
    attached_collision_meshes=filter_4,
    compute=compute_3)  # -> out, trajectory; inputs goal_constraints: list, attached_collision_meshes: list
# ---------- plan_motion: Python ----------
"""Calculates a motion path.
    Inputs:
        robot: The robot
        group: str, optional
            The planning group used for calculation. Defaults to the robot's
            main planning group.
        start_configuration: :class:`compas_fab.robots.Configuration`, optional
            The robot's full configuration, i.e. values for all configurable
            joints of the entire robot cell, at the starting position. Defaults
            to the all-zero configuration.
        goal_constraints: list of :class:`compas_fab.robots.Constraint`
            The goal to be achieved, defined in a set of constraints.
            Constraints can be very specific, for example defining value domains
            for each joint, such that the goal configuration is included,
            or defining a volume in space, to which a specific robot link (e.g.
            the end-effector) is required to move to.
        planner_id: str
            The name of the algorithm used for path planning. Defaults to 'RRT'.
        attached_collision_meshes: list of :class:`compas_fab.robots.AttachedCollisionMesh`
            Defaults to None.
        compute: bool
            Press to calculate solution.
    Output:
        :class:`compas_fab.robots.JointTrajectory`
            The calculated trajectory.
"""
from __future__ import print_function
import logging
import scriptcontext as sc

guid = str(ghenv.Component.InstanceGuid)
response_key = "response_" + guid
if response_key not in sc.sticky:
    sc.sticky[response_key] = None

LOGGER = logging.getLogger('roslibpy')

if robot and robot.client and start_configuration and compute:
    if robot.client.is_connected:
        
        sc.sticky[response_key] = robot.plan_motion(goal_constraints,
                                                    start_configuration,
                                                    group,
                                                    options={
                                                        'planner_id': str(planner_id),
                                                        'attached_collision_meshes': list(attached_collision_meshes),
                                                    })
    else:
        print("Robot client is not connected.")

trajectory = sc.sticky[response_key]
# ---------- end plan_motion ----------
vis_5 = PythonScript(response=plan_motion.trajectory)  # -> P, V, A, time
# ---------- vis_5: Python ----------
from compas_ghpython import list_to_ghtree

if response:

    positions = []
    velocities = []
    accelerations = []
    time_from_start = []

    for p in response.points:
        positions.append(p.positions)
        velocities.append(p.velocities)
        accelerations.append(p.accelerations)
        time_from_start.append(p.time_from_start.seconds)

    P = list_to_ghtree(list(zip(*positions)))
    V = list_to_ghtree(list(zip(*velocities)))
    A = list_to_ghtree(list(zip(*accelerations)))

    time = time_from_start[-1]
    print time
# ---------- end vis_5 ----------
time_s_2 = Panel(vis_5.time)
py_22 = PythonScript(robot=robot, group=group, trajectory=plan_motion.trajectory, in_world=show_in_world)  # -> start_configuration, configurations, full_configurations, frames, planes
# ---------- py_22: Python ----------
from compas.geometry import Transformation
from compas.geometry import Frame
from compas_ghpython import draw_frame
from compas_rhino.conversions import xform_to_rhino

import ghpythonlib.components as ghcomp

joint_positions = []

if in_world:
    T = robot.transformation_OCF_WCF()
else:
    T = Transformation()


if trajectory:
    configurations = trajectory.points
    start_configuration = trajectory.start_configuration
    fraction = trajectory.fraction
    time = trajectory.time_from_start
    full_configurations = [robot.merge_group_with_full_configuration(c, trajectory.start_configuration, group) for c in configurations]
    frames = [robot.forward_kinematics(c, group, options=dict(solver='model')) for c in full_configurations]
    if robot.attached_tool:
        frames = [robot.from_t0cf_to_tcf([frame])[0] for frame in frames]
        
    planes = [draw_frame(frame) for frame in frames]
    planes = ghcomp.Transform(planes, xform_to_rhino(T))
    

    print configurations[0].joint_values
    print full_configurations[0]
# ---------- end py_22 ----------
prismatic_5 = QuickGraph(vis_5.P, SortOrder=0)
panel_36 = Panel(plan_motion.out)
pline_4 = PolyLine(Vertices=py_22.planes, Closed=False)
graph_9 = QuickGraph(vis_5.V, SortOrder=0)
graph_10 = QuickGraph(vis_5.A, SortOrder=0)
counter_6 = CountThroughList(L=py_22.full_configurations, start=start_4, step=step_3, reset=reset_4)  # -> item; inputs L: list, start: Boolean; same code as counter_3
preview_8 = CustomPreview(Geometry=pline_4, Material=ColourSwatch(SwatchColor=RGB(139, 59, 161)))

# ----
python_7 = PythonScript(trajectory1=py_16.configurations, trajectory2=py_18.configurations, trajectory3=py_20.configurations)  # -> trajectory; inputs trajectory1: list, trajectory2: list, trajectory3: list
# ---------- python_7: Python ----------
trajectory = []

if trajectory1 != [None]:
    trajectory += trajectory1

if trajectory2 != [None]:
    trajectory += trajectory2

if trajectory3 != [None]:
    trajectory += trajectory3
# ---------- end python_7 ----------
move_configurations = Data(py_22.configurations)
move_configurations_2 = Data(py_18.configurations)
place_configurations = Data(py_20.configurations)

item_2 = ListItem(List=py_16.configurations, Index=idx_4, Wrap=True)
filter_9 = StreamFilter(Gate=list_19, Stream0=python_5.picking_configuration, Stream1=item_2, Stream2=rec_joints)
movej = PythonScript(joint_configurations=filter_9, velocity=Slider(0.05, range=0..0.5))  # -> urscript, values; inputs joint_configurations: list
# ---------- movej: Python ----------
from ur_fabrication_control.direct_control import URScript
import math



#for c in joint_configurations:
#    for i,v in enumerate(c.joint_values):
#        #print v
#        if v>math.pi:
#            v-=2*math.pi
#        if v<-math.pi:
#            v+=2*math.pi
#        c.joint_values[i]=v
#print joint_configurations
#values = joint_configurations[0].joint_values
#print([math.degrees(v) for v in values])


#joint_config = ["movej({}, v={})".format(c.values, velocity/10) for c in joint_configurations]

urscript = URScript()
urscript.start()
for jc in joint_configurations:
    urscript.move_joint(jc, velocity)
urscript.end()

urscript = urscript.generate()

print(urscript)
# ---------- end movej ----------
send_9 = GhPythonScript(urscript=movej.urscript, send=send_7)  # -> out; inputs send: Boolean
# ---------- send_9: Python ----------
from scriptcontext import sticky as st
from ur_fabrication_control.direct_control import send_script

ur_ip = st["ur_ip"]
ur_port = st["ur_port"]

print urscript

if send:
    send_script(urscript, ur_ip, ur_port)
# ---------- end send_9 ----------

pick_configurations = Data(py_16.configurations)
generate_ur_script = PythonScript(
    robot=robot,
    start_configuration=start_configurations,
    joints_pick_cartesian=pick_configurations,
    joints_move_freemotion=move_configurations,
    joints_move_cartesian=move_configurations_2,
    joints_place_cartesian=place_configurations,
    routine=list_20,
    velocity=Slider(0.1, range=0..0.1),
    radius=radius_2,
    in_world=show_in_world)  # -> out, urscript; inputs joints_pick_cartesian: list, joints_move_freemotion: list, joints_move_cartesian: list, joints_place_cartesian: list, routine: Int32
# ---------- generate_ur_script: Python ----------
from ur_fabrication_control.direct_control import URScript
from ur_fabrication_control.direct_control.mixins import AreaGripMixins

import math
from scriptcontext import sticky as st
import Rhino.Geometry as rg

from compas.geometry import Frame, Transformation


class URScript_RSRD(URScript, AreaGripMixins):
    pass

tool_angle_axis = list(robot.attached_tool.frame.point) + list(robot.attached_tool.frame.axis_angle_vector)
sleep = 3.0

def plane_to_frame_OCF(plane_WCS):
    frame_WCS = Frame(plane_WCS.Origin, plane_WCS.XAxis, plane_WCS.YAxis)
    if in_world:
        T = robot.transformation_WCF_OCF()
    else:
        T = Transformation()
    frame_WCS.transform(T)
    return frame_WCS

# 
#traj_frames = []
#for plane in traj_planes_WCF:
#    traj_frames.append(plane_to_frame(plane))

if joints_pick_cartesian:
    print(joints_pick_cartesian[-1].joint_values)

    
# pick_to_pickup_safe
if routine == 0:
    commands = URScript_RSRD()
    commands.start()
    commands.set_tcp(tool_angle_axis)
    #commands.areagrip_on()  
    commands.moves_joint([joint_pick_cartesian for joint_pick_cartesian in joints_pick_cartesian[::-1]], velocity)
    commands.add_line("\tsleep({})".format(2.0))
    #commands.moves_joint([joint_pick_cartesian for joint_pick_cartesian in joints_pick_cartesian], velocity)
    #commands.areagrip_off()  
    commands.end()      
#
## pick_to_pickup_safe
#if routine == 0:
#    commands = URScript_RSRD()
#    commands.start()
#    commands.set_tcp(tool_angle_axis)
#    commands.areagrip_on()  
#    commands.moves_joint([joint_pick_cartesian for joint_pick_cartesian in joints_pick_cartesian[::-1]], velocity)
#    commands.add_line("\tsleep({})".format(sleep))
#    commands.moves_joint([joint_pick_cartesian for joint_pick_cartesian in joints_pick_cartesian], velocity)
#    #commands.areagrip_off()  
#    commands.end()  
#    
## pickup_safe_to_placing_safe
#if routine == 1:
#    commands = URScript_RSRD()
#    commands.start()
#    commands.set_tcp(tool_angle_axis)
#    commands.moves_joint([joint_move_cartesian for joint_move_cartesian in joints_move_cartesian], velocity)
#    commands.end()    
    
# pickup_safe_to_placing_safe
if routine == 1:
    commands = URScript_RSRD()
    commands.start()
    commands.set_tcp(tool_angle_axis)
    commands.moves_joint([joint_move_freemotion for joint_move_freemotion in joints_move_freemotion], velocity)
    commands.end()    

# placing_safe_to_placing
if routine == 2:
    commands = URScript_RSRD()
    commands.start()
    commands.set_tcp(tool_angle_axis)
    commands.moves_joint([joint_place_cartesian for joint_place_cartesian in joints_place_cartesian], velocity)
    commands.end()   

# placing_to_pickup_safe
if routine == 3:
    commands = URScript_RSRD()
    commands.start()
    commands.set_tcp(tool_angle_axis)
    commands.areagrip_off() 
    commands.moves_joint([joint_place_cartesian for joint_place_cartesian in joints_place_cartesian[::-1]], velocity)
    commands.moves_joint([joint_move_cartesian for joint_move_cartesian in joints_move_cartesiann[::-1]], velocity)
    commands.end()   

#  pick and place
if routine == 4:
    commands = URScript_RSRD()
    commands.start()
    commands.set_tcp(tool_angle_axis)
    commands.areagrip_on()  
    commands.moves_joint([joint_pick_cartesian for joint_pick_cartesian in joints_pick_cartesian[::-1]], velocity)
    commands.add_line("\tsleep({})".format(sleep))
    commands.moves_joint([joint_pick_cartesian for joint_pick_cartesian in joints_pick_cartesian], velocity)
    commands.moves_joint([joint_move_cartesian for joint_move_cartesian in joints_move_cartesian], velocity)
    commands.moves_joint([joint_place_cartesian for joint_place_cartesian in joints_place_cartesian], velocity)
    commands.add_line("\tsleep({})".format(sleep))
    commands.areagrip_off() 
    commands.moves_joint([joint_place_cartesian for joint_place_cartesian in joints_place_cartesian[::-1]], velocity)
    commands.moves_joint([joint_move_cartesian for joint_move_cartesian in joints_move_cartesiann[::-1]], velocity)
    commands.end()   


urscript = commands.generate()

print(urscript)
# ---------- end generate_ur_script ----------
send_10 = GhPythonScript(urscript=generate_ur_script.urscript, send=send_8)  # -> out; inputs send: Boolean
# ---------- send_10: Python ----------
from scriptcontext import sticky as st
from ur_fabrication_control.direct_control import send_script

ur_ip = st["ur_ip"]
ur_port = st["ur_port"]

print urscript
if send:
    send_script(urscript, ur_ip, ur_port)
# ---------- end send_10 ----------
panel_37 = Panel(generate_ur_script.out)

counter_7 = CountThroughList(L=python_7, start=start_3, stop=stop_5, step=False, reset=reset_3, interval=10)  # -> item; inputs L: list, start: Boolean, stop: Boolean
# ---------- counter_7: Python ----------
from scriptcontext import sticky as st
from compas_ghpython.utilities import update_component

if not interval:
    interval = 10

# store data in component
guid = str(ghenv.Component.InstanceGuid)
counter_key = "counter_" + guid
running_key = "running_" + guid

if counter_key not in st:
    st[counter_key] = 0

if running_key not in st:
    st[running_key] = False

if start:
    st[running_key] = True

if stop:
    st[running_key] = False

if step:
    if st[counter_key] < len(L) - 1:
        st[counter_key] += 1

if back:
    if st[counter_key] > 1:
        st[counter_key] -= 1

if len(L):
    item = L[st[counter_key]]

if st[running_key]:
    if st[counter_key] < len(L) - 1:
        st[counter_key] += 1
        update_component(ghenv, interval)
    else:
        st[counter_key] = 0
        st[running_key] = False


print interval
# ---------- end counter_7 ----------

filter_10 = StreamFilter(
    Gate=list_18,
    Stream0=forward_kinematics,
    Stream1=inverse.configuration,
    Stream2=counter_3,
    Stream3=counter_6,
    Stream4=counter_7)

visualize = PythonScript(
    robot=robot,
    group=main_planning_group,
    scene=scene,
    configuration=filter_10,
    redraw=[collision.a, collision_2.a, py_7.a, py_8],
    show_visual=show_visual,
    show_collision=show_collision,
    show_end_effector_frame=show_end_effector_frame,
    show_robot_frames=show_frames,
    show_base_frame=show_base_frame,
    show_origin_frame=show_origin_frame,
    show_picking_frame=show_picking_frame,
    show_cm=show_cm,
    show_bcm=show_bcm,
    show_acm=show_acm,
    in_world=show_in_world)  # -> out, robot, visual, collision_meshes_robot, collision_mesh_base, collision_meshes_obstacles, collision_meshes_attached, frames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; inputs redraw: list, attached_collision_meshes: list
# ---------- visualize: Python ----------
from compas.geometry import Vector
from compas.geometry import Point
from compas.geometry import Transformation
from compas.geometry import Frame
from compas_ghpython.artists import MeshArtist
from compas_fab.robots import Configuration

import ghpythonlib.components as ghcomp
from compas_rhino.conversions import xform_to_rhino


if robot and configuration:
    
    robot.update(configuration, visual=show_visual, collision=show_collision)
    if in_world:
        T = robot.transformation_OCF_WCF()
    else:
        T = Transformation()

    if show_visual:
        visual = robot.artist.draw_visual()
        visual += robot.base_geometry
        visual = ghcomp.Transform(visual, xform_to_rhino(T))

    if show_collision:
        collision_meshes_robot = robot.artist.draw_collision()
        collision_meshes_robot = ghcomp.Transform(collision_meshes_robot, xform_to_rhino(T))
    
    if show_end_effector_frame:
        ee_frame = robot.get_end_effector_frame(group=group, full_configuration=configuration)
        if robot.attached_tool:
            ee_frame = robot.from_t0cf_to_tcf([ee_frame])[0]
        ee_frame = ee_frame.transformed(T)
    
    if show_robot_frames:
        frames = robot.transformed_frames(configuration)
        [f.transform(T) for f in frames]

    if show_base_frame:
        base_frame = robot.get_base_frame(group, configuration)
        base_frame = base_frame.transformed(T)
    
    if show_origin_frame:
        origin_frame = robot.get_origin_frame()

    if show_picking_frame:
        picking_frame = robot.get_picking_frame()
        #picking_frame = picking_frame.transformed(T)
    
    if show_cm:
        M = []
        for cm in scene.cm:
            mesh = cm.mesh
            M.append(MeshArtist(mesh).draw())
        collision_meshes_obstacles = M
        collision_meshes_obstacles = ghcomp.Transform(collision_meshes_obstacles, xform_to_rhino(T))
    
    if show_bcm:
        if scene.bcm:
            collision_mesh_base = MeshArtist(scene.bcm.mesh).draw()
            collision_mesh_base = ghcomp.Transform(collision_mesh_base, xform_to_rhino(T))
    
    if show_acm:
        M = []
        for acm in scene.acm:
            ee_frame = robot.get_end_effector_frame(group=group, full_configuration=configuration)
            if robot.attached_tool:
                ee_frame = robot.from_t0cf_to_tcf([ee_frame])[0]
            T_ee = Transformation.from_frame_to_frame(Frame.worldXY(), ee_frame)
            mesh = acm.collision_mesh.mesh.transformed(T_ee)
            M.append(MeshArtist(mesh).draw(color=[0.6,0.4,0.4,0.4]))
            
        collision_meshes_attached = M
        collision_meshes_attached = ghcomp.Transform(collision_meshes_attached, xform_to_rhino(T))
# ---------- end visualize ----------
geo_3 = Geometry(visualize.collision_meshes_attached)
draw_5 = GhPythonScript(
    frames=[visualize.frames, visualize.ee_frame, visualize.base_frame, visualize.origin_frame, visualize.picking_frame],
    scale=Slider(0.2, range=0..1))  # -> P, V, C, W; inputs frames: list
# ---------- draw_5: Python ----------
from System.Drawing import Color
from compas_ghpython.utilities import draw_frame

red = Color.FromArgb(255, 0, 0)
green = Color.FromArgb(0, 255, 0)
blue = Color.FromArgb(0, 0, 255)

P = []
V = []
C = []

scale = float(scale)

for frame in frames:
    if not frame:
        continue
    plane = draw_frame(frame)
    P += [plane.Origin] * 3
    V.append(plane.XAxis * scale)
    V.append(plane.YAxis * scale)
    V.append(plane.ZAxis * scale)
    C += [red, green, blue]

W = 3
# ---------- end draw_5 ----------
geo_4 = Geometry(visualize.collision_meshes_obstacles)
geo_5 = Geometry(visualize.visual)
geo_6 = Geometry(visualize.collision_meshes_robot)
geo_7 = Geometry(visualize.collision_mesh_base)
preview_9 = CustomPreview(Geometry=geo_5, Shader=ColourSwatch(SwatchColor=RGB(105, 105, 105)))
preview_10 = CustomPreview(Geometry=[geo_6, geo_4, geo_3, geo_7], Shader=ColourSwatch(SwatchColor=RGB(108, 79, 255)))
vdisex = VectorDisplayEx(Point=draw_5.P, Vector=draw_5.V, Colour=draw_5.C, Width=draw_5.W)
